# Grasshopper definition 20221106_check.gh (Grasshopper 1.0.7)
# plug-ins: Human

number_slider = Slider(100, range=0..100)

# ----
# Magnetic Field in GH -1
number_slider_2 = Slider(12, range=0..100)  # disabled
number_slider_3 = Slider(28, range=0..100)  # disabled
number_slider_4 = Slider(2, range=0..10)  # disabled
circle = Circle(Plane=PlaneXY(0, 0, 0), Radius=number_slider_2)  # disabled
negative = Negative(Value=number_slider_3)  # disabled
number_slider_5 = Slider(0.6, range=0..1)  # disabled
number_slider_6 = Slider(5.7, range=0..10)  # disabled
number_slider_7 = Slider(2, range=0..10)  # disabled
construct_domain = ConstructDomain(DomainStart=number_slider_3, DomainEnd=negative)  # disabled
divide_curve = DivideCurve(Curve=circle, Count=number_slider_4, Kinks=False)  # -> Points, Tangents, Parameters; disabled
number_slider_8 = Slider(1.5, range=0..10)  # disabled
number_slider_9 = Slider(0.6, range=0..1)  # disabled
number_slider_10 = Slider(8.2, range=0..10)  # disabled
number_slider_11 = Slider(2, range=0..10)  # disabled
number_slider_12 = Slider(1, range=0..1)  # disabled
number_slider_13 = Slider(1.4, range=0..10)  # disabled
number_slider_14 = Slider(5, range=0..10)  # disabled
rectangle = Rectangle(Plane=PlaneXY(0, 0, 0), XSize=construct_domain, YSize=construct_domain, Radius=0)  # -> Rectangle, Length; disabled
spin_force = SpinForce(
    Plane=divide_curve.Points,
    Strength=number_slider_9,
    Radius=number_slider_10,
    Decay=number_slider_13,
    Bounds=rectangle.Rectangle)  # disabled
point_charge = PointCharge(Point=divide_curve.Points, Charge=number_slider_12, Decay=number_slider_8, Bounds=rectangle.Rectangle)  # disabled
circle_2 = Circle(Plane=divide_curve.Points, Radius=number_slider_14)  # disabled
merge_fields = MergeFields(Fields=[spin_force, point_charge])  # disabled
divide_curve_2 = DivideCurve(Curve=circle_2, Count=number_slider_11, Kinks=False)  # -> Points, Tangents, Parameters; disabled
field_line = FieldLine(Field=merge_fields, Point=divide_curve_2.Points, Steps=1000, Accuracy=0.1, Method=3)  # disabled
divide_curve_3 = DivideCurve(Curve=field_line, Count=10, Kinks=False)  # -> Points, Tangents, Parameters; disabled
nurbs_curve = NurbsCurve(Vertices=divide_curve_3.Points, Degree=3, Periodic=False)  # -> Curve, Length, Domain; disabled
point_on_curve = PointOnCurve(nurbs_curve.Curve, parameter=0.458)  # disabled
pull_point = PullPoint(Point=divide_curve_3.Points, Geometry=point_on_curve, ClosestOnly=True)  # -> ClosestPoint, Distance; disabled
graph_mapper = GraphMapper(
    pull_point.Distance,
    x0=0,
    x1=25,
    y0=0,
    y1=25,
    A=0.4769431406,
    B=0.1307642148,
    container_name="Linear",
    Graph_x0=0.25,
    Graph_x1=0.8221700788,
    Graph_y0=0.25,
    Graph_y1=0.5228925943)  # disabled
unit_z = UnitZ(Factor=graph_mapper)  # disabled
move = Move(Geometry=divide_curve_3.Points, Motion=unit_z)  # -> Geometry, Transform; disabled
nurbs_curve_2 = NurbsCurve(Vertices=move.Geometry, Degree=3, Periodic=False)  # -> Curve, Length, Domain; disabled
weave = Weave(Pattern=[0, 1], Stream0=nurbs_curve.Curve, Stream1=nurbs_curve_2.Curve, NullGaps=False)  # disabled
loft = Loft(Curves=weave, Options={Adjust=False, Closed=False, LoftEnds=0, LoftSimp=0, LoftType=0, Rebuild=10, Refit=0.01})  # disabled

number_slider_15 = Slider(100, range=0..100)

# ---- group: BRICK DIMENSIONS / length
panel = Panel("31.5")

# ---- group: BRICK DIMENSIONS / height
panel_2 = Panel("10")

# ---- group: BRICK DIMENSIONS / width
panel_3 = Panel("15")

# ----
negative_2 = Negative(Value=number_slider)
negative_3 = Negative(Value=number_slider_15)
construct_domain_2 = ConstructDomain(DomainStart=number_slider, DomainEnd=negative_2)
construct_domain_3 = ConstructDomain(DomainStart=number_slider_15, DomainEnd=negative_3)

outer_curve = Curve(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)
inner_curve = Curve(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)

dist_tolerance = Slider(1.15, range=0.9..2.1)
number_slider_16 = Slider(5, range=1..15)
multiplication = Multiplication(A=panel, B=number_slider_16)
python = GhPythonScript(
    crv1=inner_curve,
    crv2=outer_curve,
    x=panel,
    y=panel_3,
    z=panel_2,
    reqHeight=multiplication,
    st_lb=Slider(0.194, range=0.1..0.45),
    st_hb=Slider(0.422, range=0.1..0.45),
    levels=number_slider_16,
    reductionVal=Slider(0.6, range=0.2..0.8),
    dist_tolerance=dist_tolerance)  # -> out, planes_in, points_in, planes_out, points_out, crvs, ready_pts_out, ready_planes_out, ready_pts_in, ready_planes_in; inputs crv1: Curve, crv2: Curve, levels: Int32
# ---------- python: Python ----------
import Rhino.Geometry as rg
import copy
from ghpythonlib.components import ColourRGB



class Brick(object):
    
    
    global length
    global width
    global height
    
    
    def __init__(self, origin, rotation = 0, color = [240, 255, 255, 255] ):
        
        self.origin = origin 
        self.param = None
        self.plane = rg.Plane.WorldXY
        self.curve = curve
        self. rotation = 0
        self.gap = gap
        if self.rotation != 0:
            RotateBrick() 
        
        self.neighbours = []
        self.color = ColourRGB(255, color[0], color[1], color[2])
        self.att_dist = None
        
    #makes an actual brick mesh from bounding box
    
    def BrickParam(param):
        self.param = param
        
    def BrickPlane(plane):
        self.plane = plane
        
    def BrickRotation(rotation):
        self.rotation = rotation 
        RotateBrick()
    
    def CreateBrickMesh(self):
        return rg.Mesh.CreateFromBox(rg.Box(self.plane, length, width, height), 1, 1)
        
    def RotateBrick(self):
        return 0
        



gap = 5
#currentLevel = 0
#for each crv divide equidistannt
#add a gap in the beginning?? (later)

#distance that triggers the combination of two curves into one
dist_tolerance *= y

crvs = []
crvs.append(crv1)
crvs.append(crv2)

current_in_crv = crv1
current_out_crv = crv2

def CalculateISF(st_lb, st_hb,levels, currentLevel):
    trel = currentLevel/levels
    return st_lb * ( 1/st_lb * st_hb ) ** trel


#function that provides the new points 
# list of points extruded 
def CreatePointsOnDome(prev_points, prev_planes, curve, st_lb, st_hb, levels, currentLevel, width, isInside):
    #we take the points, tangent and planes from prev height
    #Declare ISF for this level:
    iSF = CalculateISF(st_lb, st_hb,levels, currentLevel)
    iSF *= width
    #move based on the tangents
    i = 0
    new_points = []
    adj_new_pts = []
    new_planes = []
    new_params = []
    
    for i in range(len(prev_points)):
        #get the right direction vector
        unitizedDir = prev_planes[i].XAxis * -1
        actualDir = unitizedDir * iSF
        if isInside:
            actualDir *= reductionVal
        new_point = actualDir + prev_points[i]
        new_point.Z += z
        new_points.append(new_point)
        
    #create the Curve
    new_crv = rg.Curve.CreateInterpolatedCurve(new_points, 3)
    #get the tangents and create the new planes
    #redundant but check !!!
    adj_new_pts = new_crv.DivideEquidistant(x/2+gap/2)
    for pt in adj_new_pts:
        output = new_crv.ClosestPoint(pt,0.0001)
        if not None:
            new_params.append(output[1])
        
    for i in new_params:
        p = new_crv.PointAt(i)
        t = new_crv.TangentAt(i)
        v = rg.Vector3d.CrossProduct(t, rg.Vector3d.ZAxis)
        pn =  rg.Plane(p,v,t)
        new_planes.append(pn)
    
    return adj_new_pts, new_params, new_planes, new_crv

#def CheckIntersection(points_in_lvl, points_out_lvl, curve_in, curve_out, st_lb, st_hb, levels, currentLevel, width, dist_tolerance isInside):
#    checked_pts_in = []
#    checked_pts_out = []
#    
#    for pt in points_in_lvl
#        if curve_out.ClosestPoint(pt, dist_tolerance):
#            checked_pts_in.append(pt)

def CheckIntersection(pt, curve_out):
    print curve_out.ClosestPoint(pt, dist_tolerance)[0]
    return curve_out.ClosestPoint(pt, dist_tolerance)[0]


planes_out = []
params_out = []
points_out = []
curves_out = []

planes_in = []
params_in = []
points_in = []
curves_in = []

for crv in crvs:
    params = []
    planes = []
    points = crv.DivideEquidistant(x/2+gap/2)
    for pt in points:
        output = crv.ClosestPoint(pt,0.0001)
        if not None:
            params.append(output[1])
        
    for i in params:
        p = crv.PointAt(i)
        t = crv.TangentAt(i)

        v = rg.Vector3d.CrossProduct(t, rg.Vector3d.ZAxis)
        
        pn =  rg.Plane(p,v,t)

        planes.append(pn)
    
    if crvs.index(crv) == 0:
        planes_in.append(planes)
        params_in.append(params)
        points_in.append(points)
        curves_in.append(crv)
    
    else:
        planes_out.append(planes)
        params_out.append(params)
        points_out.append(points)
        curves_out.append(crv)

#increment the current height
#currentLevel +=1

#take each curve
#iterate of height 



#for outside Curve:
for level in range(levels-1):
    new_pts, new_params, new_planes, new_crv = CreatePointsOnDome(points_out[-1], planes_out[-1], current_out_crv, st_lb, st_hb, levels, level+1,y, False)
    points_out.append(new_pts)
    params_out.append(new_params)
    planes_out.append(new_planes)
    current_out_crv = new_crv
    curves_out.append(new_crv)
    
#for inside Curve:
for level in range(levels-1):
    new_pts, new_params, new_planes, new_crv = CreatePointsOnDome(points_in[-1], planes_in[-1], current_in_crv, st_lb, st_hb, levels, level+1,y ,True)
    points_in.append(new_pts)
    params_in.append(new_params)
    planes_in.append(new_planes)
    current_in_crv = new_crv
    curves_in.append(new_crv)


ready_pts_out = []
ready_params_out = []
ready_planes_out = []
#ready_curves_out = []


#for outer curve 
for i in range(len(points_out)):
    #get a list of point based on i
    pts = [pt for pt in points_out[i][i%2::2]]
    #get a list of params based on i
    params = [param for param in params_out[i][i%2::2]]
    #get a list of planes based on i 
    planes = [plane for plane in planes_out[i][i%2::2]]
    
    ready_pts_out.append(pts)
    ready_params_out.append(params)
    ready_planes_out.append(planes)


ready_pts_in = []
ready_params_in = []
ready_planes_in = []
#ready_curves_in = []

#for inner curve 
for i in range(len(points_in)):
    pts = []
    planes = []
    params = []
    
    #get a list of point based on i
    #print points_in[i]
    points_in[i] = [pt for pt in points_in[i][i%2::2]]
    params_in[i] = [param for param in params_in[i][i%2::2]]
    planes_in[i] = [plane for plane in planes_in[i][i%2::2]]

    for j in range(len(points_in[i])):
        if not CheckIntersection(points_in[i][j], curves_out[i]):
            pts.append(points_in[i][j])
            params.append(params_in[i][j])
            planes.append(planes_in[i][j])
            print "we are here"
            
    ready_pts_in.append(pts)
    ready_params_in.append(params)
    ready_planes_in.append(planes)
# ---------- end python ----------

# ---- group: BRICK PLANES
python_2 = GhPythonScript(x=python.ready_pts_in, y=python.ready_planes_in)  # -> a, b
# ---------- python_2: Python ----------
a = x
b = y
# ---------- end python_2 ----------
python_3 = GhPythonScript(x=python.ready_pts_out, y=python.ready_planes_out)  # -> a, b; same code as python_2
pln = Plane(python_3.b)
pln_2 = Plane(python_2.b)

# ----
# CHECK COLLISION
# Problem:
# if there is only one layer,
# unable to use this way
# Step 0.
# {a;0} -> outer crv
pln_outer = Plane(simplify(pln))
# {a;1} -> inner crv
# Step 1.
# check on single crv
# collidie -> random pick one
# Step 2.
# check 2 crvs in the same group
# collidie -> pick the one outside
pln_inner = Plane(simplify(pln_2))
path_mapper = PathMapper(pln_outer, source="{a}", target="{a;0}")
path_mapper_2 = PathMapper(pln_inner, source="{a}", target="{a;1}")
merge = Merge(Data1=path_mapper, Data2=path_mapper_2)

merge_2 = Merge(Data1=pln, Data2=pln_2)
prot = RotatePlane(Plane=merge_2, Angle=degrees("90"))

# ----
# BRICKS PREVIEW
panel_4 = Panel("2")
division = Division(A=panel, B=panel_4)
division_2 = Division(A=panel_3, B=panel_4)
division_3 = Division(A=panel_2, B=panel_4)
x = Panel(division)
y = Panel(division_2)
z = Panel(division_3)
vector_xyz = VectorXYZ(XComponent=x, YComponent=y, ZComponent=z)  # -> Vector, Length
box = DomainBox(Base="0,0,0", X=panel, Y=panel_3, Z=panel_2)
orient = Orient(Geometry=box, Source=vector_xyz.Vector, Target=prot)  # -> Geometry, Transform
preview = CustomPreview(Geometry=orient.Geometry, Material=ColourSwatch(SwatchColor=RGB(73, 200, 235)))

prot_2 = RotatePlane(Plane=merge, Angle=degrees("90"))
orient_2 = Orient(Geometry=box, Source=vector_xyz.Vector, Target=prot_2)  # -> Geometry, Transform

seed = Slider(70, range=50..150)  # disabled
y_dist = Slider(100, range=50..150)  # disabled
x_dist = Slider(125, range=50..150)  # disabled

n = Slider(5, range=0..20)  # disabled
degree = Slider(316, range=0..500)  # disabled
angle = Slider(77, range=0..180)  # disabled
mult = Slider(0.4, range=0..1)  # disabled
point = Point(Point(339.954269, 248.8084769, 0))  # disabled
ghpython_script = GhPythonScript(seed=seed, x_dist=y_dist, y_dist=x_dist, n=n, degree=degree, appPt=point, angle=angle, mult=mult)  # -> out, pt2D_out, CurveList_out; inputs n: Int32, degree: Int32, appPt: Point3d; disabled
# ---------- ghpython_script: Python ----------
import Rhino.Geometry as rg
import rhinoscriptsyntax as rs
import random

random.seed(seed)

pt2D = []
curveList = []


for i in range(n):
    for j in range(n):
        pt2D.append(rg.Point3d(200+x_dist*i,200+y_dist*j,0))
        
for k in range(len(pt2D)):
    IPCPts = []
    for m in range(degree):
        
        tmpVector = rs.VectorCreate(appPt,pt2D[k])
        
        unitVector = rs.VectorUnitize(tmpVector)
        vector = rs.VectorScale(unitVector, mult+k*random.random()*0.05)
        vector = rs.VectorRotate(vector, angle, [0,0,1])
        newPt = rs.CopyObject(pt2D[k],vector)
        IPCPts.append(newPt)
        pt2D[k] = newPt
        
    curve = rs.AddInterpCurve(IPCPts,3)
    curveList.append(curve)
pt2D_out = pt2D
CurveList_out = curveList
# ---------- end ghpython_script ----------
point_2 = Point(ghpython_script.pt2D_out)  # disabled
curve = Curve(ghpython_script.CurveList_out)  # disabled

construct_domain_4 = ConstructDomain(DomainStart=0, DomainEnd="10")
construct_domain_5 = ConstructDomain(DomainStart=0, DomainEnd="10")
series = Series(Start="1", Step=1, Count="10")
series_2 = Series(Start="1", Step=1, Count="10")
number_slider_17 = Slider(0.2, range=0..1)  # disabled
evaluate_curve = EvaluateCurve(Curve=reparameterize(ghpython_script.CurveList_out), Parameter=number_slider_17)  # -> Point, Tangent, Angle; disabled
# when they are in the same group
# but not close to each other,
# they will naturally become individual wall
distance = Distance(PointA=point, PointB=evaluate_curve.Point)  # disabled
create_set = CreateSet(List=distance)  # -> Set, Map; disabled
number_slider_18 = Slider(2, range=0..10)  # disabled
number_slider_19 = Slider(3, range=0..10)  # disabled
number_slider_20 = Slider(7, range=0..11)  # disabled
colour_swatch = ColourSwatch(SwatchColor=RGB(255, 0, 0))  # disabled
colour_swatch_2 = ColourSwatch(SwatchColor=RGB(25, 0, 255))  # disabled
end_points = EndPoints(Curve=curve)  # -> Start, End; disabled
sort_list = SortList(Keys=create_set.Set, ValuesValuesA=create_set.Map)  # -> Keys, ValuesValuesA; disabled
panel_5 = Panel("{a}")  # disabled
panel_6 = Panel("a")  # disabled
dot_display = DotDisplay(Point=evaluate_curve.Point, Colour=colour_swatch_2, Size=number_slider_18)  # disabled
dot_display_2 = DotDisplay(Point=end_points.Start, Colour=colour_swatch, Size=number_slider_19)  # disabled
replace_text = ReplaceText(Text=panel_5, Find=panel_6, Replace=number_slider_20, RecursiveReplace=False)  # disabled
list_item = ListItem(List=curve, Index=sort_list.ValuesValuesA, Wrap=True)  # disabled
partition_list = PartitionList(List=list_item, Size=2)  # disabled
split_tree = SplitTree(Data=simplify(partition_list), Masks=flatten(replace_text))  # -> Positive, Negative; disabled
number_slider_21 = Slider(0, range=0..1)  # disabled
number_slider_22 = Slider(1, range=0..1)  # disabled
list_item_2 = ListItem(List=split_tree.Positive, Index=0, Wrap=True)  # -> Item, Item1; disabled
list_item_3 = ListItem(List=partition_list, Index=number_slider_21, Wrap=True)  # disabled
list_item_4 = ListItem(List=partition_list, Index=number_slider_22, Wrap=True)  # disabled
panel_7 = Panel(partition_list)  # disabled

inner_curve_2 = Curve(simplify(list_item_3))  # disabled
outer_curve_2 = Curve(simplify(list_item_4))  # disabled

# ---- group: BRICK DIMENSIONS / length
panel_8 = Panel("31.5")  # disabled

# ---- group: BRICK DIMENSIONS / height
panel_9 = Panel("10")  # disabled

# ---- group: BRICK DIMENSIONS / width
panel_10 = Panel("15")  # disabled

# ----
number_slider_23 = Slider(6, range=0..10)  # disabled
number_slider_24 = Slider(6, range=0..10)  # disabled

# ----
# Before_Planes
plane = Data(prot_2)

# ----
# Before_Bricks
brick = Data(orient_2.Geometry)

number_slider_25 = Slider(1, range=-1..1)  # disabled
dist_tolerance_2 = Slider(1.5, range=0.9..2.1)  # disabled
boolean_toggle = BooleanToggle(True)  # disabled
boolean_toggle_2 = BooleanToggle(True)  # disabled
number_slider_26 = Slider(0.56, range=0.2..0.8)  # disabled
colour_swatch_3 = ColourSwatch(SwatchColor=RGB(0, 0, 0))  # disabled
colour_swatch_4 = ColourSwatch(SwatchColor=RGB(255, 255, 255))  # disabled
colour_swatch_5 = ColourSwatch(SwatchColor=RGB(0, 0, 0))  # disabled
colour_swatch_6 = ColourSwatch(SwatchColor=RGB(255, 255, 255))  # disabled
number_slider_27 = Slider(0.194, range=0.1..0.45)  # disabled
number_slider_28 = Slider(0.422, range=0.1..0.45)  # disabled
# CHECK COLLISION
# Step 0.
# Step 1.
number_slider_29 = Slider(2, range=1..15)  # disabled
custom_preview_lineweights = CustomPreviewLineweights(Geometry=list_item_2.Item, Shader=colour_swatch_3, Thickness=number_slider_23, Absolute=boolean_toggle)  # disabled
custom_preview_lineweights_2 = CustomPreviewLineweights(Geometry=list_item_2.Item1, Shader=colour_swatch_4, Thickness=number_slider_24, Absolute=boolean_toggle_2)  # disabled
custom_preview = CustomPreview(Geometry=inner_curve_2, Material=colour_swatch_5)  # disabled
custom_preview_2 = CustomPreview(Geometry=outer_curve_2, Material=colour_swatch_6)  # disabled
multiplication_2 = Multiplication(A=panel_8, B=number_slider_29)  # disabled
python_4 = GhPythonScript(
    crv1=inner_curve_2,
    crv2=outer_curve_2,
    x=panel_8,
    y=panel_10,
    z=panel_9,
    reqHeight=multiplication_2,
    st_lb=number_slider_27,
    st_hb=number_slider_28,
    levels=number_slider_29,
    reductionVal=number_slider_26,
    dist_tolerance=dist_tolerance_2,
    dome_type=number_slider_25)  # -> out, planes_in, points_in, planes_out, points_out, crvs, ready_pts_out, ready_planes_out, ready_pts_in, ready_planes_in; inputs crv1: Curve, crv2: Curve, levels: Int32, dome_type: Int32; disabled
# ---------- python_4: Python ----------
import Rhino.Geometry as rg
import copy

gap = 3

#currentLevel = 0
#for each crv divide equidistannt
#add a gap in the beginning?? (later)

#distance that triggers the combination of two curves into one
dist_tolerance *= y

crvs = []
crvs.append(crv1)
crvs.append(crv2)

current_in_crv = crv1
current_out_crv = crv2

def CalculateISF(st_lb, st_hb,levels, currentLevel):
    trel = currentLevel/levels
    return st_lb * ( 1/st_lb * st_hb ) ** trel


#function that provides the new points 
# list of points extruded 
def CreatePointsOnDome(prev_points, prev_planes, curve, st_lb, st_hb, levels, currentLevel, width, isInside):
    #we take the points, tangent and planes from prev height
    #Declare ISF for this level:
    iSF = CalculateISF(st_lb, st_hb,levels, currentLevel)
    iSF *= width
    #move based on the tangents
    i = 0
    new_points = []
    adj_new_pts = []
    new_planes = []
    new_params = []
    
    for i in range(len(prev_points)):
        #get the right direction vector
        unitizedDir = prev_planes[i].XAxis * -1
        actualDir = unitizedDir * iSF
        if isInside:
            actualDir *= reductionVal * dome_type
        new_point = actualDir + prev_points[i]
        new_point.Z += z
        new_points.append(new_point)
        
    #create the Curve
    new_crv = rg.Curve.CreateInterpolatedCurve(new_points, 3)
    #get the tangents and create the new planes
    #redundant but check !!!
    adj_new_pts = new_crv.DivideEquidistant(x/2+gap/2)
    for pt in adj_new_pts:
        output = new_crv.ClosestPoint(pt,0.0001)
        if not None:
            new_params.append(output[1])
        
    for i in new_params:
        p = new_crv.PointAt(i)
        t = new_crv.TangentAt(i)
        v = rg.Vector3d.CrossProduct(t, rg.Vector3d.ZAxis)
        pn =  rg.Plane(p,v,t)
        new_planes.append(pn)
    
    return adj_new_pts, new_params, new_planes, new_crv

#def CheckIntersection(points_in_lvl, points_out_lvl, curve_in, curve_out, st_lb, st_hb, levels, currentLevel, width, dist_tolerance isInside):
#    checked_pts_in = []
#    checked_pts_out = []
#    
#    for pt in points_in_lvl
#        if curve_out.ClosestPoint(pt, dist_tolerance):
#            checked_pts_in.append(pt)

def CheckIntersection(pt, curve_out):
    print curve_out.ClosestPoint(pt, dist_tolerance)[0]
    return curve_out.ClosestPoint(pt, dist_tolerance)[0]


planes_out = []
params_out = []
points_out = []
curves_out = []

planes_in = []
params_in = []
points_in = []
curves_in = []

for crv in crvs:
    params = []
    planes = []
    points = crv.DivideEquidistant(x/2+gap/2)
    for pt in points:
        output = crv.ClosestPoint(pt,0.0001)
        if not None:
            params.append(output[1])
        
    for i in params:
        p = crv.PointAt(i)
        t = crv.TangentAt(i)

        v = rg.Vector3d.CrossProduct(t, rg.Vector3d.ZAxis)
        
        pn =  rg.Plane(p,v,t)

        planes.append(pn)
    
    if crvs.index(crv) == 0:
        planes_in.append(planes)
        params_in.append(params)
        points_in.append(points)
        curves_in.append(crv)
    
    else:
        planes_out.append(planes)
        params_out.append(params)
        points_out.append(points)
        curves_out.append(crv)

#increment the current height
#currentLevel +=1

#take each curve
#iterate of height 



#for outside Curve:
for level in range(levels-1):
    new_pts, new_params, new_planes, new_crv = CreatePointsOnDome(points_out[-1], planes_out[-1], current_out_crv, st_lb, st_hb, levels, level+1,y, False)
    points_out.append(new_pts)
    params_out.append(new_params)
    planes_out.append(new_planes)
    current_out_crv = new_crv
    curves_out.append(new_crv)
    
#for inside Curve:
for level in range(levels-1):
    new_pts, new_params, new_planes, new_crv = CreatePointsOnDome(points_in[-1], planes_in[-1], current_in_crv, st_lb, st_hb, levels, level+1,y ,True)
    points_in.append(new_pts)
    params_in.append(new_params)
    planes_in.append(new_planes)
    current_in_crv = new_crv
    curves_in.append(new_crv)


ready_pts_out = []
ready_params_out = []
ready_planes_out = []
#ready_curves_out = []


#for outer curve 
for i in range(len(points_out)):
    #get a list of point based on i
    pts = [pt for pt in points_out[i][i%2::2]]
    #get a list of params based on i
    params = [param for param in params_out[i][i%2::2]]
    #get a list of planes based on i 
    planes = [plane for plane in planes_out[i][i%2::2]]
    
    ready_pts_out.append(pts)
    ready_params_out.append(params)
    ready_planes_out.append(planes)


ready_pts_in = []
ready_params_in = []
ready_planes_in = []
#ready_curves_in = []

#for inner curve 
for i in range(len(points_in)):
    pts = []
    planes = []
    params = []
    
    #get a list of point based on i
    #print points_in[i]
    points_in[i] = [pt for pt in points_in[i][i%2::2]]
    params_in[i] = [param for param in params_in[i][i%2::2]]
    planes_in[i] = [plane for plane in planes_in[i][i%2::2]]

    for j in range(len(points_in[i])):
        if not CheckIntersection(points_in[i][j], curves_out[i]):
            pts.append(points_in[i][j])
            params.append(params_in[i][j])
            planes.append(planes_in[i][j])

            
    ready_pts_in.append(pts)
    ready_params_in.append(params)
    ready_planes_in.append(planes)
# ---------- end python_4 ----------

# ---- group: BRICK PLANES
python_5 = GhPythonScript(x=python_4.ready_pts_out, y=python_4.ready_planes_out)  # -> a, b; disabled; same code as python_2
python_6 = GhPythonScript(x=python_4.ready_pts_in, y=python_4.ready_planes_in)  # -> a, b; disabled; same code as python_2
pln_3 = Plane(simplify(python_5.b))  # disabled
pln_4 = Plane(simplify(python_6.b))  # disabled

# ----
# {a;0} -> outer crv
# {a;1} -> inner crv
pln_outer_2 = Plane(simplify(pln_3))  # disabled
# check on single crv
# collidie -> random pick one
# Step 2.
# check 2 crvs in the same group
# collidie -> pick the one outside
pln_inner_2 = Plane(simplify(pln_4))  # disabled
# Problem:
# if there is only one layer,
# unable to use this way
path_mapper_3 = PathMapper(pln_outer_2, source="{a;b}", target="{a;b;0}")  # disabled
path_mapper_4 = PathMapper(pln_inner_2, source="{a;b}", target="{a;b;1}")  # disabled
merge_3 = Merge(Data1=path_mapper_3, Data2=path_mapper_4)  # disabled
merge_4 = Merge(Data1=pln_3, Data2=pln_4)  # disabled

panel_11 = Panel("0,0,0")  # disabled
panel_12 = Panel("2")  # disabled
division_4 = Division(A=panel_9, B=panel_12)  # disabled
box_2 = DomainBox(Base=panel_11, X=panel_8, Y=panel_10, Z=panel_9)  # disabled
division_5 = Division(A=panel_10, B=panel_12)  # disabled
division_6 = Division(A=panel_8, B=panel_12)  # disabled
x_2 = Panel(division_6)  # disabled
y_2 = Panel(division_5)  # disabled
z_2 = Panel(division_4)  # disabled
vector_xyz_2 = VectorXYZ(XComponent=x_2, YComponent=y_2, ZComponent=z_2)  # -> Vector, Length; disabled
panel_13 = Panel("90")  # disabled
prot_3 = RotatePlane(Plane=merge_3, Angle=degrees(panel_13))  # disabled
orient_3 = Orient(Geometry=box_2, Source=vector_xyz_2.Vector, Target=prot_3)  # -> Geometry, Transform; disabled

panel_14 = Panel("90")  # disabled
prot_4 = RotatePlane(Plane=merge_4, Angle=degrees(panel_14))  # disabled

# ----
# BRICKS PREVIEW
panel_15 = Panel("2")  # disabled
division_7 = Division(A=panel_8, B=panel_15)  # disabled
division_8 = Division(A=panel_10, B=panel_15)  # disabled
division_9 = Division(A=panel_9, B=panel_15)  # disabled
x_3 = Panel(division_7)  # disabled
y_3 = Panel(division_8)  # disabled
z_3 = Panel(division_9)  # disabled
panel_16 = Panel("0,0,0")  # disabled
vector_xyz_3 = VectorXYZ(XComponent=x_3, YComponent=y_3, ZComponent=z_3)  # -> Vector, Length; disabled
box_3 = DomainBox(Base=panel_16, X=panel_8, Y=panel_10, Z=panel_9)  # disabled
orient_4 = Orient(Geometry=box_3, Source=vector_xyz_3.Vector, Target=prot_4)  # -> Geometry, Transform; disabled
swatch = ColourSwatch(SwatchColor=RGB(73, 200, 235))  # disabled
# Q1:
# Some curves will not output any planes and bricks from python
# 
# Q2:
# Collision will happen on the single crv/ the other crv at the same group/ other groups
# 
# Q3:
# After picking, some bricks will have nothing below them
preview_2 = CustomPreview(Geometry=orient_4.Geometry, Material=swatch)  # disabled

# ---- group: BRICK DIMENSIONS / height
panel_17 = Panel("10")

# ---- group: BRICK DIMENSIONS / length
panel_18 = Panel("31.5")

# ---- group: BRICK DIMENSIONS / width
panel_19 = Panel("15")

# ----
dist_tolerance_3 = Slider(1.5, range=0.9..2.1)
number_slider_30 = Slider(3, range=1..15)
multiplication_3 = Multiplication(A=panel_18, B=number_slider_30)

panel_20 = Panel("""a
b
c
d
e""")
panel_21 = Panel("""2
4""")
item_index = ItemIndex(List=panel_21, Item=panel_21)
subtraction = Subtraction(A=panel_21, B=item_index)
insert_items = InsertItems(List=panel_20, Item=panel_21, Indices=subtraction, Wrap=True)
panel_22 = Panel(insert_items)

# ----
# Before_Planes
plane_2 = Data(prot_3)  # disabled

# ----
# Before_Bricks
brick_2 = Data(orient_3.Geometry)  # disabled

# ---- group: FINAL PLANES
# Origin_PlanestoRobot
# Adjusted_PlanestoRobot
pln_5 = Plane(prot)

# ----
number_slider_31 = Slider(10, range=0..10)  # disabled

# ----
# PLANE EDITOR
crv = Curve(<curve referenced from the Rhino model>)
end = EndPoints(Curve=crv)  # -> Start, End
ln = Line(StartPoint=end.Start, EndPoint=end.End)
vec = Vector(ln)
prot_5 = RotatePlane(Plane=pln_5, Angle=degrees("-90"))
Z = UnitZ(Factor=Slider(10, range=0..10))
move_2 = Move(Geometry=prot_5, Motion=vec)  # -> Geometry, Transform
move_3 = Move(Geometry=move_2.Geometry, Motion=Z)  # -> flatten(Geometry), Transform

replace_items = ReplaceItems(List="0", Indices="0", Wrap=False)

# ----
# FABRICAITON
button = Button()
python_7 = GhPythonScript(brick_planes=move_3.Geometry, fabricate=button)  # -> script, vis_planes, pick_up_plane; inputs brick_planes: list of Plane, fabricate: Boolean
# ---------- python_7: Python ----------
from imp import reload
import Rhino.Geometry as rg
import simple_ur_script as ur
reload(ur)
import simple_comm as c
reload(c)
import math as m


# change these values if needed
ROBOT_IP = "192.168.10.10"
SAFE_ROBOT_ACC = 0.4
SAFE_ROBOT_VEL = 0.9
IO = 4




def tcp(script):
    script += ur.set_tcp_by_angles(0.0, 0.0, 80.0, m.radians(0.0), m.radians(180.0),m.radians(0.0))
    
    return script


def set_robot_base():
    pt_0 = rg.Point3d(-233.9,-503.5,-11.4) # base plane origin
    pt_1 = rg.Point3d(-272.9,648.2,-23.5) # point on positive x axis
    pt_2 = rg.Point3d(-729.7,-519.9,-10.4) # point on positive xy plane
    robot_base = rg.Plane(pt_0,pt_1-pt_0,pt_2-pt_0)
    return robot_base


def rhino_to_robot_space(rhino_plane):
    plane = rhino_plane.Clone()
    robot_base_plane = set_robot_base()
    rhino_matrix = rg.Transform.PlaneToPlane(rg.Plane.WorldXY,robot_base_plane)
    plane.Transform(rhino_matrix)
    return plane


def pickup_brick(script,pick_up_plane):
    planes = []
    #change the distance if needed
    SAFE_DIST = 150
    
    safe_plane = pick_up_plane.Clone()
    safe_plane.Translate(rg.Vector3d.ZAxis*SAFE_DIST)
    
    ## add to the path: go to the safe plane
    script += ur.move_l(safe_plane, SAFE_ROBOT_ACC, SAFE_ROBOT_VEL)
    planes.append(safe_plane)
    
    ## add to the path: go to the pick up plane
    script += ur.move_l(pick_up_plane, SAFE_ROBOT_ACC, SAFE_ROBOT_VEL)
    planes.append(pick_up_plane)
    
    ## add to the path: turn on the vacuum and wait 1 sec.
    script += ur.set_digital_out(IO,True)
    script += ur.sleep(1)

    # add to the path: go back to the safe_plane
    script += ur.move_l(safe_plane, SAFE_ROBOT_ACC, SAFE_ROBOT_VEL)
    planes.append(safe_plane)
    
    
    return script, planes


def place_brick(script, place_plane):
    
    planes = []
    
    SAFE_DIST = 100
    safe_plane = place_plane.Clone()
    safe_plane.Translate(rg.Vector3d.ZAxis*SAFE_DIST)
    
    # add to the path: go to the safe plane
    script += ur.move_l(safe_plane, SAFE_ROBOT_ACC, SAFE_ROBOT_VEL)
    planes.append(safe_plane)
    
    # add to the path: go to the place plane
    script += ur.move_l(place_plane, SAFE_ROBOT_ACC, SAFE_ROBOT_VEL)
    planes.append(place_plane)
    
    ## add to the path: turn off the vacuum and wait 1 second (hold the brick)
    script += ur.set_digital_out(IO,False)
    script += ur.sleep(1)
    
    # add to the path: go back to the safe plane
    script += ur.move_l(safe_plane, SAFE_ROBOT_ACC, SAFE_ROBOT_VEL)
    planes.append(safe_plane)
    
    return script,planes


def send(script):
    script = c.concatenate_script(script)
    c.send_script(script, ROBOT_IP)
    return script 


#location of a pick up station
pick_station = rg.Plane(rg.Point3d(-344.2, 306.2, -10.2), rg.Vector3d.XAxis, rg.Vector3d.YAxis)


script = ""
script = tcp(script)
vis_planes = []



# translate from rhino to robot_space and iterate through all planes
robot_planes = []

for p in brick_planes:
    r_plane = rhino_to_robot_space(p)
    robot_planes.append(r_plane)


for b_plane in robot_planes:
    
    script, p = pickup_brick(script,pick_station)
    vis_planes.extend(p) #only to visualize the planes
    
    script, p = place_brick(script,b_plane)
    vis_planes.extend(p)


if fabricate:
    send(script)
# ---------- end python_7 ----------
pln_6 = Plane(python_7.vis_planes)

panel_23 = Panel("""a
b
c
d
e""")  # disabled
panel_24 = Panel("""2
4""")  # disabled
item_index_2 = ItemIndex(List=panel_24, Item=panel_24)  # disabled
subtraction_2 = Subtraction(A=panel_24, B=item_index_2)  # disabled
insert_items_2 = InsertItems(List=panel_23, Item=panel_24, Indices=subtraction_2, Wrap=True)  # disabled
panel_25 = Panel(insert_items_2)  # disabled

number_slider_32 = Slider(10, range=0..10)  # disabled
number_slider_33 = Slider(10, range=0..10)  # disabled
number_slider_34 = Slider(10, range=0..10)  # disabled
number_slider_35 = Slider(10, range=0..10)  # disabled

# ----
# Magnetic Field in GH -2
number_slider_36 = Slider(50, range=0..100)
negative_4 = Negative(Value=number_slider_36)
construct_domain_6 = ConstructDomain(DomainStart=number_slider_36, DomainEnd=negative_4)
rectangle_2 = Rectangle(Plane=PlaneXY(0, 0, 0), XSize=construct_domain_6, YSize=construct_domain_2, Radius=0)  # -> Rectangle, Length
area = Area(Geometry=rectangle_2.Rectangle)  # -> Area, Centroid
scale = Scale(Geometry=rectangle_2.Rectangle, Center=area.Centroid, Factor=Slider(0.5, range=0..1))  # -> Geometry, Transform
number_slider_37 = Slider(2, range=0..10)
number_slider_38 = Slider(38, range=0..100)
populate_geometry = PopulateGeometry(Geometry=scale.Geometry, Count=number_slider_37, Seed=number_slider_38)
populate_2d = Populate2D(Region=scale.Geometry, Count=number_slider_37, Seed=number_slider_38)
spin_force_2 = SpinForce(
    Plane=populate_2d,
    Strength=Slider(0.16, range=0..10),
    Radius=Slider(11.32, range=0..20),
    Decay=Slider(0.22, range=0..10),
    Bounds=rectangle_2.Rectangle)
point_charge_2 = PointCharge(Point=populate_2d, Charge=Slider(1.2, range=0..10), Decay=Slider(1.4, range=0..2), Bounds=rectangle_2.Rectangle)
construct_domain_7 = ConstructDomain(DomainStart=Slider(5, range=0..20), DomainEnd=Slider(20, range=0..50))
list_length = ListLength(List=populate_2d)
random = Random(Range=construct_domain_7, Number=list_length, Seed=Slider(35, range=0..100))
merge_fields_2 = MergeFields(Fields=[spin_force_2, point_charge_2])

round = Round(Number=random)  # -> Nearest, Floor, Ceiling
construct_domain_8 = ConstructDomain(DomainStart=0, DomainEnd=round.Nearest)  # -> graft(Domain)
remap_numbers = RemapNumbers(Value=series_2, Source=construct_domain_5, Target=construct_domain_8)  # -> Mapped, Clipped
list_item_5 = ListItem(List=remap_numbers.Mapped, Index=0, Wrap=True)
multiplication_4 = Multiplication(A=list_item_5, B=Slider(3.1, range=0..20))  # -> flatten(Result)

circle_3 = Circle(Plane=populate_2d, Radius=round.Nearest)
divide_curve_4 = DivideCurve(Curve=circle_3, Count=multiplication_4, Kinks=False)  # -> Points, Tangents, Parameters
field_line_2 = FieldLine(
    Field=merge_fields_2,
    Point=divide_curve_4.Points,
    Steps=Slider(2000, range=0..2000),
    Accuracy=0.1,
    Method=Slider(1, range=1..4))

custom_preview_lineweights_3 = CustomPreviewLineweights(
    Geometry=field_line_2,
    Shader=ColourSwatch(SwatchColor=RGB(0, 0, 0)),
    Thickness=Slider(1, range=0..10),
    Absolute=Toggle(True))

# ----
# Magnetic Field in GH -2
number_slider_39 = Slider(50, range=0..100)
negative_5 = Negative(Value=number_slider_39)
construct_domain_9 = ConstructDomain(DomainStart=number_slider_39, DomainEnd=negative_5)
rectangle_3 = Rectangle(Plane=PlaneXY(0, 0, 0), XSize=construct_domain_9, YSize=construct_domain_3, Radius=0)  # -> Rectangle, Length
area_2 = Area(Geometry=rectangle_3.Rectangle)  # -> Area, Centroid
scale_2 = Scale(Geometry=rectangle_3.Rectangle, Center=area_2.Centroid, Factor=Slider(0.8, range=0..1))  # -> Geometry, Transform
number_slider_40 = Slider(3, range=0..10)
number_slider_41 = Slider(36, range=0..100)
populate_geometry_2 = PopulateGeometry(Geometry=scale_2.Geometry, Count=number_slider_40, Seed=number_slider_41)
populate_2d_2 = Populate2D(Region=scale_2.Geometry, Count=number_slider_40, Seed=number_slider_41)
spin_force_3 = SpinForce(
    Plane=populate_2d_2,
    Strength=Slider(0.49, range=0..10),
    Radius=Slider(3.13, range=0..10),
    Decay=Slider(0.09, range=0..10),
    Bounds=rectangle_3.Rectangle)
point_charge_3 = PointCharge(Point=populate_2d_2, Charge=Slider(0.2, range=0..10), Decay=Slider(0.82, range=0..2), Bounds=rectangle_3.Rectangle)
construct_domain_10 = ConstructDomain(DomainStart=Slider(5, range=0..20), DomainEnd=Slider(45, range=0..50))
list_length_2 = ListLength(List=populate_2d_2)
random_2 = Random(Range=construct_domain_10, Number=list_length_2, Seed=Slider(853, range=0..1000))
merge_fields_3 = MergeFields(Fields=[spin_force_3, point_charge_3])

round_2 = Round(Number=random_2)  # -> Nearest, Floor, Ceiling
construct_domain_11 = ConstructDomain(DomainStart=0, DomainEnd=round_2.Nearest)  # -> graft(Domain)
remap_numbers_2 = RemapNumbers(Value=series, Source=construct_domain_4, Target=construct_domain_11)  # -> Mapped, Clipped
list_item_6 = ListItem(List=remap_numbers_2.Mapped, Index=0, Wrap=True)
multiplication_5 = Multiplication(A=list_item_6, B=Slider(1.8, range=0..20))  # -> flatten(Result)

circle_4 = Circle(Plane=populate_2d_2, Radius=round_2.Nearest)
divide_curve_5 = DivideCurve(Curve=circle_4, Count=multiplication_5, Kinks=False)  # -> Points, Tangents, Parameters
field_line_3 = FieldLine(
    Field=merge_fields_3,
    Point=divide_curve_5.Points,
    Steps=Slider(2281, range=0..10000),
    Accuracy=0.1,
    Method=Slider(1, range=1..4))  # -> simplify(Curve)

boundary_center = Data(area_2.Centroid)
field_crv = Data(field_line_3)
circle_5 = Data(circle_4)
scale_3 = Scale(Geometry=field_crv, Center=boundary_center, Factor=Slider(4, range=0..10))  # -> Geometry, Transform
graft_tree = GraftTree(Tree=circle_5, IncludeEmptyLists=True, IncludeNullItems=True)
area_3 = Area(Geometry=graft_tree)  # -> Area, simplify(Centroid)
explode_tree = ExplodeTree(Data=scale_3.Geometry)  # -> Branch0, Branch1, Branch2
evaluate_curve_2 = EvaluateCurve(Curve=reparameterize(scale_3.Geometry), Parameter=Slider(0.05, range=0..1))  # -> Point, Tangent, Angle
custom_preview_lineweights_4 = CustomPreviewLineweights(
    Geometry=explode_tree.Branch0,
    Shader=ColourSwatch(SwatchColor=RGB(255, 225, 0)),
    Thickness=Slider(1, range=0..10),
    Absolute=Toggle(True))
custom_preview_lineweights_5 = CustomPreviewLineweights(
    Geometry=explode_tree.Branch1,
    Shader=ColourSwatch(SwatchColor=RGB(255, 0, 0)),
    Thickness=Slider(1, range=0..10),
    Absolute=Toggle(True))
custom_preview_lineweights_6 = CustomPreviewLineweights(
    Geometry=explode_tree.Branch2,
    Shader=ColourSwatch(SwatchColor=RGB(0, 51, 255)),
    Thickness=Slider(1, range=0..10),
    Absolute=Toggle(True))
distance_2 = Distance(PointA=area_3.Centroid, PointB=evaluate_curve_2.Point)
point_list = PointList(Points=evaluate_curve_2.Point, Size=Slider(4, range=0..10))
create_set_2 = CreateSet(List=distance_2)  # -> Set, Map
sort_list_2 = SortList(Keys=create_set_2.Set, ValuesValuesA=create_set_2.Map)  # -> Keys, ValuesValuesA
list_item_7 = ListItem(List=scale_3.Geometry, Index=sort_list_2.ValuesValuesA, Wrap=True)  # -> reverse(Item)
partition_list_2 = PartitionList(List=list_item_7, Size=2)
list_item_8 = ListItem(List=partition_list_2, Index=Slider(0, range=0..1), Wrap=True)
list_item_9 = ListItem(List=partition_list_2, Index=Slider(1, range=0..1), Wrap=True)
panel_26 = Panel(partition_list_2)

inner_curve_3 = Curve(simplify(list_item_8))
outer_curve_3 = Curve(simplify(list_item_9))

custom_preview_3 = CustomPreview(Geometry=inner_curve_3, Material=ColourSwatch(SwatchColor=RGB(0, 0, 0)))
custom_preview_4 = CustomPreview(Geometry=outer_curve_3, Material=ColourSwatch(SwatchColor=RGB(255, 255, 255)))
python_8 = GhPythonScript(
    crv1=inner_curve_3,
    crv2=outer_curve_3,
    x=panel_18,
    y=panel_19,
    z=panel_17,
    reqHeight=multiplication_3,
    st_lb=Slider(0.194, range=0.1..0.45),
    st_hb=Slider(0.422, range=0.1..0.45),
    levels=number_slider_30,
    reductionVal=Slider(0.56, range=0.2..0.8),
    dist_tolerance=dist_tolerance_3,
    dome_type=Slider(1, range=-1..1))  # -> out, planes_in, points_in, planes_out, points_out, crvs, ready_pts_out, ready_planes_out, ready_pts_in, ready_planes_in; inputs crv1: Curve, crv2: Curve, levels: Int32, dome_type: Int32; same code as python_4

# ---- group: BRICK PLANES
python_9 = GhPythonScript(x=python_8.ready_pts_out, y=python_8.ready_planes_out)  # -> a, b; same code as python_2
python_10 = GhPythonScript(x=python_8.ready_pts_in, y=python_8.ready_planes_in)  # -> a, b; same code as python_2
pln_7 = Plane(simplify(python_9.b))
pln_8 = Plane(simplify(python_10.b))

# ----
pln_outer_3 = Plane(simplify(pln_7))
pln_inner_3 = Plane(simplify(pln_8))
path_mapper_5 = PathMapper(pln_outer_3, source="{a;b;c}", target="{a;b;c;0}")
path_mapper_6 = PathMapper(pln_inner_3, source="{a;b;c}", target="{a;b;c;1}")
merge_5 = Merge(Data1=path_mapper_5, Data2=path_mapper_6)
merge_6 = Merge(Data1=pln_7, Data2=pln_8)

division_10 = Division(A=panel_17, B="2")
box_4 = DomainBox(Base="0,0,0", X=panel_18, Y=panel_19, Z=panel_17)
division_11 = Division(A=panel_19, B="2")
division_12 = Division(A=panel_18, B="2")
y_4 = Panel(division_11)
x_4 = Panel(division_12)
z_4 = Panel(division_10)
vector_xyz_4 = VectorXYZ(XComponent=x_4, YComponent=y_4, ZComponent=z_4)  # -> Vector, Length
prot_6 = RotatePlane(Plane=merge_5, Angle=degrees("90"))
orient_5 = Orient(Geometry=box_4, Source=vector_xyz_4.Vector, Target=prot_6)  # -> Geometry, Transform

prot_7 = RotatePlane(Plane=merge_6, Angle=degrees("90"))

# ----
# BRICKS PREVIEW
panel_27 = Panel("2")
division_13 = Division(A=panel_18, B=panel_27)
division_14 = Division(A=panel_19, B=panel_27)
division_15 = Division(A=panel_17, B=panel_27)
x_5 = Panel(division_13)
y_5 = Panel(division_14)
z_5 = Panel(division_15)
vector_xyz_5 = VectorXYZ(XComponent=x_5, YComponent=y_5, ZComponent=z_5)  # -> Vector, Length
box_5 = DomainBox(Base="0,0,0", X=panel_18, Y=panel_19, Z=panel_17)
orient_6 = Orient(Geometry=box_5, Source=vector_xyz_5.Vector, Target=prot_7)  # -> Geometry, Transform
preview_3 = CustomPreview(Geometry=orient_6.Geometry, Material=ColourSwatch(SwatchColor=RGB(73, 200, 235)))

# ----
# Before_Planes
plane_3 = Data(prot_6)

# ----
# Before_Bricks
brick_3 = Data(orient_5.Geometry)

# ----
# Step 1.
brick_4 = Data(orient_2.Geometry)
collision_many_many = CollisionManyMany(Colliders=brick_4)  # -> Collision, Indices
merge_7 = Merge(Data1=Toggle(True), Data2=Toggle(False))
member_index = MemberIndex(Set=collision_many_many.Collision, Member=merge_7)  # -> Index, Count
split_tree_2 = SplitTree(Data=member_index.Index, Masks=flatten("{?;?;0}"))  # -> simplify(Positive), Negative
replace_items_2 = ReplaceItems(List="0", Indices="0", Wrap=False)
plane_4 = Data(prot_2)

# ----
# List A
# replace by null
# List B
# keep the bricks
dispatch = Dispatch(List=split_tree_2.Positive, DispatchPattern=[True, False])  # -> ListA, ListB

data = Data(dispatch.ListA)

# ----
# After_Planes
replace_items_3 = ReplaceItems(List=plane_4, Item=replace_items_2, Indices=data, Wrap=False)

# ----
# After_Bricks
replace_items_4 = ReplaceItems(List=brick_4, Item=replace_items_2, Indices=data, Wrap=False)

# ----
# TIP
# Step 2.
# {0;?} -> Lv.1
# {1;?} -> Lv.2
# {2;?} -> Lv.3
# List A -> intersecting with others
panel_28 = Panel("-1")
shift_paths = ShiftPaths(Data=simplify(replace_items_4), Offset=panel_28)
shift_paths_2 = ShiftPaths(Data=replace_items_3, Offset="-1")
collision_many_many_2 = CollisionManyMany(Colliders=shift_paths)  # -> Collision, Indices
plane_5 = Data(shift_paths_2)
brick_5 = Data(shift_paths)
dispatch_2 = Dispatch(List=plane_5, DispatchPattern=collision_many_many_2.Collision)  # -> ListA, ListB
dispatch_3 = Dispatch(List=brick_5, DispatchPattern=collision_many_many_2.Collision)  # -> ListA, ListB

# ----
# check how many bricks
# on the outer curve/each lv.
list_length_3 = ListLength(List=replace_items_4)  # -> simplify(Length)
split_tree_3 = SplitTree(Data=list_length_3, Masks=flatten("{?;0}"))  # -> simplify(Positive), Negative

# ----
# cuz we import outer crv first
# the order of index will start from outer crv
# if the index > the last point on outer crv
# it will be on the inner crv
# if the num of the bricks (intersecting with others) > 0
# check those bricks are on the outer or inter curve
list_length_4 = ListLength(List=dispatch_3.ListA)
larger_than = LargerThan(FirstNumber=list_length_4, SecondNumber="0")  # -> LargerThan, OrEqualTo
dispatch_4 = Dispatch(List=split_tree_3.Positive, DispatchPattern=larger_than.LargerThan)  # -> ListA, ListB
item_index_3 = ItemIndex(List=brick_5, Item=dispatch_3.ListA)
subtraction_3 = Subtraction(A=dispatch_4.ListA, B="1")  # -> simplify(Result)
panel_29 = Panel(dispatch_4.ListA)
smaller_than = SmallerThan(FirstNumber=item_index_3, SecondNumber=subtraction_3)  # -> SmallerThan, OrEqualTo
dispatch_5 = Dispatch(List=item_index_3, DispatchPattern=smaller_than.OrEqualTo)  # -> ListA, ListB

# ----
# Colliding Bricks
# Safe Bricks
swatch_2 = ColourSwatch(SwatchColor=RGBA(235, 73, 73, 36))
preview_4 = CustomPreview(Geometry=dispatch_3.ListA, Material=swatch_2)
preview_5 = CustomPreview(Geometry=dispatch_3.ListB, Material=ColourSwatch(SwatchColor=RGBA(46, 126, 148, 197)))

# ----
# collision brick_out -> keep
item_index_4 = ItemIndex(List=item_index_3, Item=dispatch_5.ListA)

# ----
# collision brick_in -> delet
item_index_5 = ItemIndex(List=item_index_3, Item=dispatch_5.ListB)

# ----
# insert back to list
list_item_10 = ListItem(List=dispatch_2.ListA, Index=item_index_4, Wrap=True)
item_index_6 = ItemIndex(List=dispatch_5.ListA, Item=dispatch_5.ListA)
list_item_11 = ListItem(List=dispatch_3.ListA, Index=item_index_4, Wrap=True)
subtraction_4 = Subtraction(A=dispatch_5.ListA, B=item_index_6)
insert_items_3 = InsertItems(List=dispatch_2.ListB, Item=list_item_10, Indices=subtraction_4, Wrap=True)
insert_items_4 = InsertItems(List=dispatch_3.ListB, Item=list_item_11, Indices=subtraction_4, Wrap=True)

# ---- group: FINAL PLANES
pln_9 = Plane(insert_items_3)

# ----
volume = Volume(Geometry=insert_items_4)  # -> Volume, Centroid

# ----
# Final Look of Bricks
swatch_3 = ColourSwatch(SwatchColor=RGBA(84, 76, 105, 135))
preview_6 = CustomPreview(Geometry=insert_items_4, Material=swatch_3)

point_3 = Point(pln_9)
point_list_2 = PointList(Points=point_3, Size=Slider(10, range=0..10))
point_list_3 = PointList(Points=volume.Centroid, Size=number_slider_31)  # disabled

# ----
# Step 1.
brick_6 = Data(orient_3.Geometry)  # disabled
collision_many_many_3 = CollisionManyMany(Colliders=brick_6)  # -> Collision, Indices; disabled
boolean_toggle_3 = BooleanToggle(True)  # disabled
boolean_toggle_4 = BooleanToggle(False)  # disabled
merge_8 = Merge(Data1=boolean_toggle_3, Data2=boolean_toggle_4)  # disabled
member_index_2 = MemberIndex(Set=collision_many_many_3.Collision, Member=merge_8)  # -> Index, Count; disabled
panel_30 = Panel("{?;?;?;0}")  # disabled
split_tree_4 = SplitTree(Data=member_index_2.Index, Masks=flatten(panel_30))  # -> simplify(Positive), Negative; disabled
panel_31 = Panel("0")  # disabled
replace_items_5 = ReplaceItems(List=panel_31, Indices=panel_31, Wrap=False)  # disabled
plane_6 = Data(prot_3)  # disabled

# ----
# List A
# replace by null
# List B
# keep the bricks
dispatch_6 = Dispatch(List=split_tree_4.Positive, DispatchPattern=[True, False])  # -> ListA, ListB; disabled

data_2 = Data(dispatch_6.ListA)  # disabled

# ----
# After_Bricks
replace_items_6 = ReplaceItems(List=brick_6, Item=replace_items_5, Indices=data_2, Wrap=False)  # disabled

# ----
# After_Planes
replace_items_7 = ReplaceItems(List=plane_6, Item=replace_items_5, Indices=data_2, Wrap=False)  # disabled

# ----
# TIP
# Step 2.
# {0;?} -> Lv.1
# {1;?} -> Lv.2
# {2;?} -> Lv.3
# List A -> intersecting with others
panel_32 = Panel("-1")  # disabled
panel_33 = Panel("-1")  # disabled
shift_paths_3 = ShiftPaths(Data=simplify(replace_items_6), Offset=panel_33)  # disabled
shift_paths_4 = ShiftPaths(Data=replace_items_7, Offset=panel_32)  # disabled
collision_many_many_4 = CollisionManyMany(Colliders=shift_paths_3)  # -> Collision, Indices; disabled
plane_7 = Data(shift_paths_4)  # disabled
brick_7 = Data(shift_paths_3)  # disabled
dispatch_7 = Dispatch(List=plane_7, DispatchPattern=collision_many_many_4.Collision)  # -> ListA, ListB; disabled
dispatch_8 = Dispatch(List=brick_7, DispatchPattern=collision_many_many_4.Collision)  # -> ListA, ListB; disabled

# ----
# check how many bricks
# on the outer curve/each lv.
list_length_5 = ListLength(List=replace_items_6)  # -> simplify(Length); disabled
panel_34 = Panel("{?;0}")  # disabled
split_tree_5 = SplitTree(Data=list_length_5, Masks=flatten(panel_34))  # -> simplify(Positive), Negative; disabled

# ----
# cuz we import outer crv first
# the order of index will start from outer crv
# if the index > the last point on outer crv
# it will be on the inner crv
# if the num of the bricks (intersecting with others) > 0
# check those bricks are on the outer or inter curve
list_length_6 = ListLength(List=dispatch_8.ListA)  # disabled
panel_35 = Panel("0")  # disabled
larger_than_2 = LargerThan(FirstNumber=list_length_6, SecondNumber=panel_35)  # -> LargerThan, OrEqualTo; disabled
dispatch_9 = Dispatch(List=split_tree_5.Positive, DispatchPattern=larger_than_2.LargerThan)  # -> ListA, ListB; disabled
panel_36 = Panel("1")  # disabled
item_index_7 = ItemIndex(List=brick_7, Item=dispatch_8.ListA)  # disabled
subtraction_5 = Subtraction(A=dispatch_9.ListA, B=panel_36)  # -> simplify(Result); disabled
panel_37 = Panel(dispatch_9.ListA)  # disabled
smaller_than_2 = SmallerThan(FirstNumber=item_index_7, SecondNumber=subtraction_5)  # -> SmallerThan, OrEqualTo; disabled
dispatch_10 = Dispatch(List=item_index_7, DispatchPattern=smaller_than_2.OrEqualTo)  # -> ListA, ListB; disabled

# ----
# Colliding Bricks
# Safe Bricks
swatch_4 = ColourSwatch(SwatchColor=RGBA(235, 73, 73, 36))  # disabled
swatch_5 = ColourSwatch(SwatchColor=RGBA(46, 126, 148, 197))  # disabled
preview_7 = CustomPreview(Geometry=dispatch_8.ListA, Material=swatch_4)  # disabled
preview_8 = CustomPreview(Geometry=dispatch_8.ListB, Material=swatch_5)  # disabled

# ----
# collision brick_out -> keep
item_index_8 = ItemIndex(List=item_index_7, Item=dispatch_10.ListA)  # disabled

# ----
# collision brick_in -> delet
item_index_9 = ItemIndex(List=item_index_7, Item=dispatch_10.ListB)  # disabled

# ----
# insert back to list
list_item_12 = ListItem(List=dispatch_7.ListA, Index=item_index_8, Wrap=True)  # disabled
item_index_10 = ItemIndex(List=dispatch_10.ListA, Item=dispatch_10.ListA)  # disabled
list_item_13 = ListItem(List=dispatch_8.ListA, Index=item_index_8, Wrap=True)  # disabled
subtraction_6 = Subtraction(A=dispatch_10.ListA, B=item_index_10)  # disabled
insert_items_5 = InsertItems(List=dispatch_7.ListB, Item=list_item_12, Indices=subtraction_6, Wrap=True)  # disabled
insert_items_6 = InsertItems(List=dispatch_8.ListB, Item=list_item_13, Indices=subtraction_6, Wrap=True)  # disabled

volume_2 = Volume(Geometry=insert_items_6)  # -> Volume, Centroid; disabled

# ----
# Final Look of Bricks
swatch_6 = ColourSwatch(SwatchColor=RGBA(84, 76, 105, 135))  # disabled
preview_9 = CustomPreview(Geometry=insert_items_6, Material=swatch_6)  # disabled

# ---- group: FINAL PLANES
# Adjusted_PlanestoRobot
pln_10 = Plane(insert_items_5)  # disabled

# ----
point_4 = Point(pln_10)  # disabled
point_list_4 = PointList(Points=point_4, Size=number_slider_32)  # disabled
point_list_5 = PointList(Points=volume_2.Centroid, Size=number_slider_33)  # disabled

# ----
# PLANE EDITOR
crv_2 = Curve(<curve referenced from the Rhino model>)  # disabled
end_2 = EndPoints(Curve=crv_2)  # -> Start, End; disabled
ln_2 = Line(StartPoint=end_2.Start, EndPoint=end_2.End)  # disabled
vec_2 = Vector(ln_2)  # disabled
panel_38 = Panel("-90")  # disabled
number_slider_42 = Slider(9, range=0..10)  # disabled
prot_8 = RotatePlane(Plane=pln_10, Angle=degrees(panel_38))  # disabled
Z_2 = UnitZ(Factor=number_slider_42)  # disabled
move_4 = Move(Geometry=prot_8, Motion=vec_2)  # -> Geometry, Transform; disabled
move_5 = Move(Geometry=move_4.Geometry, Motion=Z_2)  # -> flatten(Geometry), Transform; disabled

panel_39 = Panel(move_4.Geometry)  # disabled
geometry = Geometry(move_5.Geometry)  # disabled
panel_40 = Panel(move_5.Geometry)  # disabled

# ----
# FABRICAITON
button_2 = Button()  # disabled
python_11 = GhPythonScript(brick_planes=move_5.Geometry, fabricate=button_2)  # -> script, vis_planes, pick_up_plane; inputs brick_planes: list of Plane, fabricate: Boolean; disabled; same code as python_7
pln_11 = Plane(python_11.vis_planes)  # disabled

# ----
# Step 1.
brick_8 = Data(orient_5.Geometry)
collision_many_many_5 = CollisionManyMany(Colliders=brick_8)  # -> Collision, Indices
merge_9 = Merge(Data1=Toggle(True), Data2=Toggle(False))
member_index_3 = MemberIndex(Set=collision_many_many_5.Collision, Member=merge_9)  # -> Index, Count
split_tree_6 = SplitTree(Data=simplify(member_index_3.Index), Masks=flatten("{?;?;?;?;0}"))  # -> Positive, Negative
replace_items_8 = ReplaceItems(List="0", Indices="0", Wrap=False)
plane_8 = Data(prot_6)

param_viewer = ParamViewer(brick_8)
split_tree_7 = SplitTree(Data=simplify(member_index_3.Index), Masks=flatten("{?;?;?;0;0}"))  # -> Positive, Negative

# ----
# List A
# replace by null
# List B
# keep the bricks
dispatch_11 = Dispatch(List=split_tree_6.Positive, DispatchPattern=[True, False])  # -> ListA, ListB

dispatch_12 = Dispatch(List=split_tree_7.Positive, DispatchPattern=[True, False])  # -> ListA, ListB
split_tree_8 = SplitTree(Data=split_tree_7.Negative, Masks=flatten("{?;?;?;?;0}"))  # -> Positive, Negative
volume_3 = Volume(Geometry=dispatch_12.ListA)  # -> Volume, Centroid

data_3 = Data(dispatch_11.ListA)

data_4 = Data(dispatch_12.ListA)

# ----
# After_Bricks
replace_items_9 = ReplaceItems(List=brick_8, Item=replace_items_8, Indices=simplify(data_3), Wrap=False)

# ----
# After_Planes
replace_items_10 = ReplaceItems(List=plane_8, Item=replace_items_8, Indices=data_3, Wrap=False)

replace_items_11 = ReplaceItems(List=brick_8, Item=replace_items, Indices=data_4, Wrap=False)
panel_41 = Panel(replace_items_11)
param_viewer_2 = ParamViewer(data_4)
param_viewer_3 = ParamViewer(brick_8)

# ----
# Step 2.
# {0;?} -> Lv.1
# {1;?} -> Lv.2
# {2;?} -> Lv.3
# List A -> intersecting with others
panel_42 = Panel("-1")
shift_paths_5 = ShiftPaths(Data=simplify(replace_items_9), Offset="-1")
# Q1:
# Collision will happen on the single crv/ the other crv at the same group/ other groups
# 
# Q2:
# After picking, some bricks will have nothing below them
shift_paths_6 = ShiftPaths(Data=replace_items_10, Offset=panel_42)
collision_many_many_6 = CollisionManyMany(Colliders=shift_paths_5)  # -> Collision, Indices
plane_9 = Data(shift_paths_6)
brick_9 = Data(shift_paths_5)
dispatch_13 = Dispatch(List=plane_9, DispatchPattern=collision_many_many_6.Collision)  # -> ListA, ListB
dispatch_14 = Dispatch(List=brick_9, DispatchPattern=collision_many_many_6.Collision)  # -> ListA, ListB

# ----
# check how many bricks
# on the outer curve/each lv.
list_length_7 = ListLength(List=replace_items_9)  # -> simplify(Length)
split_tree_9 = SplitTree(Data=list_length_7, Masks=flatten("{?;0}"))  # -> simplify(Positive), Negative

# ----
# cuz we import outer crv first
# the order of index will start from outer crv
# if the index > the last point on outer crv
# it will be on the inner crv
# if the num of the bricks (intersecting with others) > 0
# check those bricks are on the outer or inter curve
list_length_8 = ListLength(List=dispatch_14.ListA)
larger_than_3 = LargerThan(FirstNumber=list_length_8, SecondNumber="0")  # -> LargerThan, OrEqualTo
dispatch_15 = Dispatch(List=split_tree_9.Positive, DispatchPattern=larger_than_3.LargerThan)  # -> ListA, ListB
item_index_11 = ItemIndex(List=brick_9, Item=dispatch_14.ListA)
subtraction_7 = Subtraction(A=dispatch_15.ListA, B="1")  # -> simplify(Result)
panel_43 = Panel(dispatch_15.ListA)
smaller_than_3 = SmallerThan(FirstNumber=item_index_11, SecondNumber=subtraction_7)  # -> SmallerThan, OrEqualTo
dispatch_16 = Dispatch(List=item_index_11, DispatchPattern=smaller_than_3.OrEqualTo)  # -> ListA, ListB

# ----
# Colliding Bricks
# Safe Bricks
swatch_7 = ColourSwatch(SwatchColor=RGBA(235, 73, 73, 36))
preview_10 = CustomPreview(Geometry=dispatch_14.ListA, Material=swatch_7)
preview_11 = CustomPreview(Geometry=dispatch_14.ListB, Material=ColourSwatch(SwatchColor=RGBA(46, 126, 148, 77)))

# ----
# collision brick_out -> keep
item_index_12 = ItemIndex(List=item_index_11, Item=dispatch_16.ListA)

# ----
# collision brick_in -> delet
item_index_13 = ItemIndex(List=item_index_11, Item=dispatch_16.ListB)

# ----
# insert back to list
list_item_14 = ListItem(List=dispatch_13.ListA, Index=item_index_12, Wrap=True)
item_index_14 = ItemIndex(List=dispatch_16.ListA, Item=dispatch_16.ListA)
list_item_15 = ListItem(List=dispatch_14.ListA, Index=item_index_12, Wrap=True)
subtraction_8 = Subtraction(A=dispatch_16.ListA, B=item_index_14)
insert_items_7 = InsertItems(List=dispatch_13.ListB, Item=list_item_14, Indices=subtraction_8, Wrap=True)
insert_items_8 = InsertItems(List=dispatch_14.ListB, Item=list_item_15, Indices=subtraction_8, Wrap=True)

# ----
# Final Look of Bricks
swatch_8 = ColourSwatch(SwatchColor=RGBA(84, 76, 105, 135))
preview_12 = CustomPreview(Geometry=insert_items_8, Material=swatch_8)

volume_4 = Volume(Geometry=insert_items_8)  # -> Volume, Centroid; disabled

# ---- group: FINAL PLANES
# Adjusted_PlanestoRobot
pln_12 = Plane(insert_items_7)  # disabled

# ----
point_5 = Point(pln_12)  # disabled
point_list_6 = PointList(Points=point_5, Size=number_slider_34)  # disabled
point_list_7 = PointList(Points=volume_4.Centroid, Size=number_slider_35)  # disabled

# ----
# PLANE EDITOR
crv_3 = Curve(<curve referenced from the Rhino model>)  # disabled
end_3 = EndPoints(Curve=crv_3)  # -> Start, End; disabled
ln_3 = Line(StartPoint=end_3.Start, EndPoint=end_3.End)  # disabled
vec_3 = Vector(ln_3)  # disabled
panel_44 = Panel("-90")  # disabled
number_slider_43 = Slider(9, range=0..10)  # disabled
prot_9 = RotatePlane(Plane=pln_12, Angle=degrees(panel_44))  # disabled
Z_3 = UnitZ(Factor=number_slider_43)  # disabled
move_6 = Move(Geometry=prot_9, Motion=vec_3)  # -> Geometry, Transform; disabled
move_7 = Move(Geometry=move_6.Geometry, Motion=Z_3)  # -> flatten(Geometry), Transform; disabled

panel_45 = Panel(move_6.Geometry)  # disabled
geometry_2 = Geometry(move_7.Geometry)  # disabled
panel_46 = Panel(move_7.Geometry)  # disabled

# ----
# FABRICAITON
button_3 = Button()  # disabled
python_12 = GhPythonScript(brick_planes=move_7.Geometry, fabricate=button_3)  # -> script, vis_planes, pick_up_plane; inputs brick_planes: list of Plane, fabricate: Boolean; disabled; same code as python_7
pln_13 = Plane(python_12.vis_planes)  # disabled
