# Grasshopper definition 20221111_MAIN_GenericWalls_khara.gh (Grasshopper 1.0.7)
# plug-ins: Bifocals

# ---- group: Design Part / BRICK DIMENSIONS / length
panel = Panel("31.5")

# ---- group: Design Part / BRICK DIMENSIONS / height
panel_2 = Panel("10")

# ---- group: Design Part / BRICK DIMENSIONS / width
panel_3 = Panel("15")

# ---- group: FROM Su / problem still !!
number_slider = Slider(2.35, range=0.01..10)

# ---- group: Throwing Paths
panel_4 = Panel("15")

# ---- group: Design Part / problem still !!
number_slider_2 = Slider(1.6, range=0.01..10)

# ---- group: not used / BRICK DIMENSIONS / length
panel_7 = Panel("31.5")  # disabled

# ---- group: not used / BRICK DIMENSIONS / height
panel_8 = Panel("10")  # disabled

# ---- group: not used / BRICK DIMENSIONS / width
panel_9 = Panel("15")  # disabled

# ---- group: Design Part
outer_curve = Curve(<curve referenced from the Rhino model>)

# ---- group: not used
outer_curve_2 = Curve(<curve referenced from the Rhino model>)  # disabled
inner_curve = Curve(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)  # disabled

# ---- group: parse lists in Json !!! ONLY once before starting the performcance !!!!
button = Button()

# ---- group: % removal from main design
number_slider_3 = Slider(0.12, range=0..1)

# ---- group: threshold change direction from 1 to 0
number_slider_4 = Slider(1, range=0..1)

# ---- group: threshold throw away
keep_threshold = Slider(0, range=0..1)

# ---- group: 1
_1_refresh_json_input = Button()

# ---- group: 2
_2_execute = Button()

# ---- group: 3 (ONLY IF IT MANAGES TO SUCK THE BRICK)
update_json = Button()

# ---- group: P3 TO S / BRICK DIMENSIONS / width
panel_10 = Panel("15")

# ---- group: P3 TO S / BRICK DIMENSIONS / height
panel_11 = Panel("10")

# ---- group: P1 TO S / BRICK DIMENSIONS / width
panel_12 = Panel("15")

# ---- group: P3 TO S / BRICK DIMENSIONS / length
panel_13 = Panel("30")

# ---- group: P1 TO S / BRICK DIMENSIONS / length
panel_14 = Panel("30")

# ---- group: P3 TO N / BRICK DIMENSIONS / width
panel_15 = Panel("15")

# ---- group: P1 TO S / BRICK DIMENSIONS / height
panel_16 = Panel("10")

# ---- group: P2 TO N / BRICK DIMENSIONS / width
panel_17 = Panel("15")

# ---- group: P3 TO N / BRICK DIMENSIONS / height
panel_18 = Panel("10")

# ---- group: P3 TO N / BRICK DIMENSIONS / length
panel_19 = Panel("30")

# ---- group: P2 TO N / BRICK DIMENSIONS / height
panel_20 = Panel("10")

# ---- group: P2 TO N / BRICK DIMENSIONS / length
panel_21 = Panel("30")

# ---- group: BRICK DIMENSIONS / height
panel_22 = Panel("10")

# ---- group: BRICK DIMENSIONS / width
panel_23 = Panel("15")

# ---- group: BRICK DIMENSIONS / length
panel_24 = Panel("30")

# ---- group: not used / BASICS DICTIONARY
python = GhPythonScript()  # -> out, a, export_d; disabled
# ---------- python: Python ----------
"""
MasDfab 22-23

Python Dictionaries.
Dictionaries are used to store data values in   key:value   pairs.

"""

# initialize a dictionary (use curly brackets)
my_dictionary = {}
# or
my_dictionary = dict()

# check the type
print (type(my_dictionary))

# create a new dictionary with keys and empty lists as a value
my_d =   { "students": [] ,
            "robots": [] ,
            "chairs": [] }
#print my_d


# add a new pair of key:value to a dictionary
# "laptops" is key, True is value
# the values in dicts can be any data type: str, boolean, int, etc.
my_d["laptops"] = True
#print my_d


# if you add a new pair of key:value that already exsists, it will update it with a new value
# because dicts do not allow two values with the same key
my_d["robots"] = True, "abb", 5
my_d["students"] = "XX","YY","ZZ"
#print my_d


# delete a key from a dictionary
del my_d["chairs"]

# remove the key and return the value
print my_d.pop("robots")

print ("final version of my dictionary after changes: its length: {}, its keys: {}, its values: {}".format(len(my_d),my_d.keys(),my_d.values()))

# iterate through the dictionary through the pairs
for key,value in my_d.items():
    print key,value

# iterate through the keys
for key in my_d.keys():
    print key

# iterate through the values
for value in my_d.values():
    print value

# "A dictionary that is passed as output from a component will be seen as enumerable and will be enumerated" (c)
# which means that only the keys will be resolved
a = my_d


# you can hide it in the class if you want pass the data
class D_data:
    pass

export_d = D_data()
export_d.my_d = my_d
# ---------- end python ----------
panel_25 = Panel(python.a)  # disabled
panel_26 = Panel(python.export_d)  # disabled
python_2 = GhPythonScript(import_d=python.export_d)  # disabled
# ---------- python_2: Python ----------
a = import_d.my_d
print a
print type(import_d.my_d)
# ---------- end python_2 ----------

# ---- group: P1 TO S / GET CRV PLANES
crv = Curve(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)
python_3 = GhPythonScript(crv=crv, height=panel_16, length=panel_14, width=panel_12)  # -> planes, brick_meshes; inputs crv: Curve
# ---------- python_3: Python ----------
"""
MasDfab 22-23
Basic example to get planes from crv
"""
import Rhino.Geometry as rg
import copy



gap = 5
params = crv.DivideByLength(length+gap,True)
planes = []

for i in params:
    
    p = crv.PointAt(i)
    t = crv.TangentAt(i)
    
    v = rg.Vector3d.CrossProduct(t, rg.Vector3d.ZAxis)
    
    pn =  rg.Plane(p,v,t)
    
    planes.append(pn)
# ---------- end python_3 ----------
mesh = Mesh(python_3.brick_meshes)
pln = Plane(python_3.planes)

# ---- group: P3 TO S / GET CRV PLANES
crv_2 = Curve(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)
python_4 = GhPythonScript(crv=crv_2, height=panel_11, length=panel_13, width=panel_10)  # -> planes, brick_meshes; inputs crv: Curve; same code as python_3
mesh_2 = Mesh(python_4.brick_meshes)
pln_2 = Plane(python_4.planes)

# ---- group: GET CRV PLANES
crv_3 = Curve(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)
python_5 = GhPythonScript(crv=crv_3, height=panel_22, length=panel_24, width=panel_23)  # -> planes, brick_meshes; inputs crv: Curve; same code as python_3
mesh_3 = Mesh(python_5.brick_meshes)
pln_3 = Plane(python_5.planes)

# ---- group: P2 TO N / GET CRV PLANES
crv_4 = Curve(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)
python_6 = GhPythonScript(crv=crv_4, height=panel_20, length=panel_21, width=panel_17)  # -> planes, brick_meshes; inputs crv: Curve; same code as python_3
pln_4 = Plane(python_6.planes)
mesh_4 = Mesh(python_6.brick_meshes)

# ---- group: P3 TO N / GET CRV PLANES
crv_5 = Curve(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)
python_7 = GhPythonScript(crv=crv_5, height=panel_18, length=panel_19, width=panel_15)  # -> planes, brick_meshes; inputs crv: Curve; same code as python_3
mesh_5 = Mesh(python_7.brick_meshes)
pln_5 = Plane(python_7.planes)

# ----
# PATH - Go through the maze
panel_27 = Panel("15")
Z = UnitZ(Factor=panel_27)
move = Move(Geometry=pln_3, Motion=Z)  # -> Geometry, Transform
rev = ReverseList(List=move.Geometry)

# ---- group: not used / BASICS JSON
python_8 = GhPythonScript()  # -> a, spheres, my_d; disabled
# ---------- python_8: Python ----------
"""
MasDfab 22-23

JSON stands for JavaScript Object Notation
JSON is a lightweight data-interchange format
JSON is plain text written in JavaScript object notation
JSON is used to send data between computers

https://realpython.com/python-json/

"""
import os
import Rhino.Geometry as rg

# to work with json files import the python module json
import json

# in python json files are represented as a string
my_json = '{"student": "Paul", "laptop": "Lenovo", "Tag": ["github", "hiking"]}'
print type(my_json)



########## ===================== JSON is the string representation of the data ================== ##############
# ======= DICTIONARIES are the actual data structures in memory that are created when the program runs ======= #


# 1.0 # how to parse a json string ?
my_json_d = json.loads(my_json)
print type(my_json_d)


# 2.0 #  how to parse a json file ?
# 2.1 #  get the file name (gh_canvas) and get the folder directory (folder)
gh_canvas = ghenv.Component.OnPingDocument()
folder = os.path.dirname(gh_canvas.FilePath)


# 2.3 # "with open()" allows for opening and closing the file after the block inside of statement is exited.
with open(os.path.join(folder,'simple_spheres.json')) as file:
    
    # 2.4 # json.load() converts json string to dictionary 
    my_d = json.load(file)


spheres = []

rr = my_d['radius']
xx = my_d['originX']
yy = my_d['originY']
zz = my_d['originZ']

for r,x,y,z in zip(rr,xx,yy,zz):
    s = rg.Sphere(rg.Point3d(x,y,z), r)
    spheres.append(s)


# 3.0 # how to write a json file?
# 3.1 # create a random dictionary my_d2
my_d2 = {"module": ["mola", "axolotl", "grasshopper"], "robots" : ["abb", "ur5", "ur10"], "numbers": [1,2,3,4,5]}


# 3.2 # 'w' - stands for 'write' - is a specification of the mode when opening the file, it will open a file for writing or create a new one if it does not exist.
with open(os.path.join(folder,'my_first_jfile.json'), 'w') as file:
    
    # 3.3 #  use the method json.dump() - it converts dictionary to a json string
    my_j = json.dump(my_d2, file, indent = 2)
# ---------- end python_8 ----------
panel_28 = Panel(python_8.my_d)  # disabled
brep = Brep(python_8.spheres)  # disabled

# ----
Z_2 = UnitZ(Factor="15")
Z_3 = UnitZ(Factor="15")
Z_4 = UnitZ(Factor="15")
Z_5 = UnitZ(Factor="15")
move_2 = Move(Geometry=pln_4, Motion=Z_4)  # -> Geometry, Transform
move_3 = Move(Geometry=pln, Motion=Z_5)  # -> Geometry, Transform
move_4 = Move(Geometry=pln_2, Motion=Z_3)  # -> Geometry, Transform
move_5 = Move(Geometry=pln_5, Motion=Z_2)  # -> Geometry, Transform

# ---- group: not used / LOAD JSON FILE
button_2 = Button()  # disabled
python_9 = GhPythonScript(load=button_2)  # -> my_d, a; disabled
# ---------- python_9: Python ----------
import os
import sys
import compas

canvas = ghenv.Component.OnPingDocument()
folder = os.path.dirname(canvas.FilePath)

if load:
    my_d = compas.json_load(os.path.join(folder, 'simple_bricks.json'))
    a = my_d["boxes"]
# ---------- end python_9 ----------

# ---- group: not used / BASIC GEO + COMPAS + JSON
number_slider_5 = Slider(9.6, range=0..10)  # disabled
number_slider_6 = Slider(4.1, range=0..10)  # disabled
number_slider_7 = Slider(47, range=0..100)  # disabled
number_slider_8 = Slider(4.7, range=0..10)  # disabled
button_3 = Button()  # disabled
crv_6 = Curve(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)  # disabled
python_10 = GhPythonScript(crv=crv_6, count=number_slider_7, length=number_slider_5, width=number_slider_8, height=number_slider_6, save=button_3)  # -> out, origin_frames, pick_frames, bricks; inputs crv: Curve, length: Int32, width: Int32, height: Int32, save: Boolean; disabled
# ---------- python_10: Python ----------
"""
MasDfab 22-23

Example of basic compas geometry and json 

"""

import os
import sys
import Rhino.Geometry as rg
import compas

from compas_rhino import conversions as c
from compas.geometry import Frame, Vector, Box
from compas.geometry import Translation

# get the gh_file name(gh_canvas) and folder directory(folder) where we will store the file
gh_canvas = ghenv.Component.OnPingDocument()
folder = os.path.dirname(gh_canvas.FilePath)

# dividing the curve by count, return the curve params
params = crv.DivideByCount(count,True)
planes = []


for i in params:
    
    p = crv.PointAt(i)
    t = crv.TangentAt(i)
    
    v = rg.Vector3d.CrossProduct(t, rg.Vector3d(0,0,1))
    
    p =  rg.Plane(p,t,v)

    planes.append(p)



# using compas in-built method to transform rhino planes into compas frames
origin_frames = [c.plane_to_compas_frame(p) for p in planes]

# define translation 
T = Translation.from_vector(Vector(0,0,height/2))

# apply translation to origin frames
pick_frames = [f.transformed(T) for f in origin_frames]

# create a compas mesh (Box)
bricks = [ Box(f,length,width,height) for f in origin_frames]

# creating a dictionary and exporting the json file 
if save:
    compas.json_dump({"p_frames":[ p for p in pick_frames], "boxes": [ b for b in bricks]}, 
                    os.path.join(folder, 'simple_bricks.json'),
                    pretty = True)
# ---------- end python_10 ----------
draw = Draw(cg=python_9.a)  # -> rg; disabled
#   port cg: The COMPAS geometry or datastructure to be drawn.
#   port rg: The Rhino geometry object.
# ---------- draw: Python ----------
"""
Draws COMPAS geometry in Grasshopper.
"""
from ghpythonlib.componentbase import executingcomponent as component

from compas.artists import Artist


class CompasToRhinoGeometry(component):
    def RunScript(self, cg):
        if not cg:
            return None

        return Artist(cg).draw()
# ---------- end draw ----------
panel_29 = Panel(python_9.my_d)  # disabled
panel_30 = Panel(python_9.a)  # disabled
draw_2 = Draw(cg=[python_10.origin_frames, python_10.pick_frames, python_10.bricks])  # -> rg; disabled; same code as draw

# ---- group: LISTEN TO ROBOT
python_11 = GhPythonScript()  # -> out, a; disabled
# ---------- python_11: Python ----------
from imp import reload
import Rhino.Geometry as rg
import simple_ur_script as ur
reload(ur)
import simple_comm as c
reload(c)
import math as m
import random
import copy
# change these values if needed
ROBOT_IP = "192.168.10.10"
SAFE_ROBOT_ACC = 0.4
SAFE_ROBOT_VEL = 0.3
IO = 4

info = ""
a = c.listen_to_robot(ROBOT_IP)

print a
##add a function to check the pose
# if the pose is between +/- (additional slack)
# ---------- end python_11 ----------

# ---- group: FROM Su
dist_tolerance = Slider(17.34, range=0.9..18.5)
st_hbout = Slider(0.4015, range=0.0001..0.45)
st_hbin = Slider(0.4, range=0.0001..0.45)
number_slider_9 = Slider(15, range=1..15)
multiplication = Multiplication(A=panel, B=number_slider_9)

# ---- group: Design Part
number_slider_10 = Slider(15, range=1..15)
number_slider_11 = Slider(5, range=1..15)
dist_tolerance_2 = Slider(1.37, range=0.9..2.1)
dist_tolerance_3 = Slider(1.13, range=0.9..2.1)
multiplication_2 = Multiplication(A=panel, B=number_slider_11)
multiplication_3 = Multiplication(A="31.5", B=number_slider_10)
p1 = Curve(<curve referenced from the Rhino model>)
p3 = Curve(<curve referenced from the Rhino model>)
python_12 = GhPythonScript(
    p1=p1,
    length=panel,
    width=panel_3,
    height=panel_2,
    gap_ratio=Slider(0.13, range=0.01..0.9),
    threshold=number_slider_2,
    reqHeight=multiplication_2,
    st_lb=Slider(0.1, range=0.1..0.45),
    st_hb=Slider(0.224, range=0.1..0.45),
    levels=number_slider_11,
    reductionVal=Slider(0.39, range=0.2..0.8),
    dist_tolerance=dist_tolerance_2)  # -> out, allbricks, bricks_mesh, curves, graft(brick_planes); inputs p1: Curve, levels: Int32
# ---------- python_12: Python ----------
#pendings: add a check that makes sure that the new brick passes a distance equals previous bricks and a distance


import Rhino.Geometry as rg
import copy
from ghpythonlib.components import ColourRGB
import math



class Brick(object):
    
    
    global length 
    global width
    global height
    
    def __init__(self, origin, rotation = 0, color = [240, 255, 255, 255] ):
        
        self.origin = origin 
        self.param = None
        self.plane = None
        #self.curve = curve
        self. rotation = 0
        self.gap = gap_ratio * length
        self.level = 0
        self.group = None
        #means that the plane os
        self.untouchable = False
        self.placed = True
        #number for the code of the brick
        self.id = None
        self.mesh = None
        self.box = None
        self.length = length
        self.width = width
        self.height = height
        if self.rotation != 0:
            RotateBrick() 
        
        self.neighbours = []
        self.color = ColourRGB(255, color[0], color[1], color[2])
        self.att_dist = None
        
    #makes an actual brick mesh from bounding box
    
    def BrickParam(self, param):
        self.param = param
        
    
    def CreateBrickMesh(self):
        self.box = rg.Box(self.plane, rg.Interval(-length/2, length/2),
                                        rg.Interval(-width/2, width/2),
                                        rg.Interval(0, height))
        self.mesh = rg.Mesh.CreateFromBox(self.box, 1, 1, 1)
        return self.mesh
        
    def RotateBrick(self):
        return 0
    
    #checks if the plane could be removed or not 
    def AddPlane(self, plane):
        unit_vect = rg.Vector3d.CrossProduct(plane.XAxis, plane.YAxis)
        if unit_vect * rg.Vector3d.ZAxis < 0: #then flip the plane 180 degrees around the x axis
            rg.Plane.Rotate(plane, math.radians(180), plane.XAxis)
        self.plane = plane


class GenericWall(object):
    
    def __init__(self, curve, st_lb, st_hb, levels = 10, currentLevel = 0):
        self.curve = curve
        self.curves = []
        self.curves.append(curve)
        self.currentLevel = currentLevel
        self.levels = levels
        self.st_lb = st_lb
        self.st_hb = st_hb
        
        #self.isf = CalculateISF()
        
    def CalculateISF(self):
        trel = self.currentLevel/self.levels
        return st_lb * ( 1/self.st_lb * self.st_hb ) ** trel
    
    





class OuterWall(GenericWall):
    
    def __init__(self, curve, st_lb, st_hb, levels, currentLevel):
        GenericWall.__init__(self, curve, st_lb, st_hb, levels, currentLevel)
        
    def NextPointCalculation(self, pt_on_curve, brick_length, gap):
        # we make a circle whose radius is half the brick length
        circle = rg.Circle(pt_on_curve, brick_length/2)
        #get intersection point and move to new point
        circleCurve = rg.ArcCurve(circle)
        events = rg.Intersect.Intersection.CurveCurve(self.curve, circleCurve, 0.001, 0.0)
        index = events.Count
        point1 = events[index-1].PointA
        #we make a new circle with radius = gap + half brick length
        circle = rg.Circle(point1, brick_length/2 + gap)
        circleCurve = rg.ArcCurve(circle)
        events = rg.Intersect.Intersection.CurveCurve(self.curve, circleCurve, 0.001, 0.0)
        index = events.Count
        point2 = events[index-1].PointA
        return point2 
    
    def PopulateLevel(self, threshold, brick_length, level):
        
        bricks = []
        #get the start point of the curve:
        point = self.curve.PointAtStart
        tPt = self.curve.ClosestPoint(point,0.0001)[1]
        tEnd = self.curve.ClosestPoint(self.curve.PointAtEnd,0.0001)[1] 
        i = 0 
        tSegmentLength = self.curve.LengthParameter(threshold * brick_length)[1]
        tSafetyFactor = self.curve.LengthParameter(brick_length)[1] * 0.5 ##hardcoded!!!!
        while tPt < tEnd - tSegmentLength:
            point = self.NextPointCalculation(point, brick_length, gap_ratio * length)
            #print point
            #populate point on curve
            tSuspect = self.curve.ClosestPoint(point,0.0001)[1]
            if tSuspect - tPt > tSafetyFactor: ###Hardcoded!!!
                tPt = tSuspect
                brick = Brick(point)
                brick.origin = self.curve.PointAt(tPt)
                brick.AddPlane(self.curve.FrameAt(tPt)[1])
                brick.level = level
                bricks.append(brick)
                i += 1
            else: 
                break
            
        #print bricks
        return bricks
        #if the level is 0, we start with the first curve 
        
    #changes the value of the indentation based on ISF 
    def ChangeNextLevelPositions(self, bricks, precision = 50):
        points = []
        #Calculatre iSF
        iSF = self.CalculateISF()
        # iterate over all bricks and move them to the right place
        tEnd = self.curve.ClosestPoint(self.curve.PointAtEnd,0.0001)[1] 
        for i in range(precision):
            if i != 0:
                t = (i * tEnd) / precision
                p = self.curve.PointAt(t)
                t1 = self.curve.TangentAt(t)
                v = rg.Vector3d.CrossProduct(t1, rg.Plane.WorldXY.ZAxis * 1)
                movementX = v * iSF * width
                movementZ = rg.Vector3d.ZAxis * height
                points.append(p + movementX + movementZ)
        new_crv = rg.NurbsCurve.Create(False, 3, points)
        new_crv = rg.Curve.CreateInterpolatedCurve(points, 3)
        #print new_crv.NormalizedLengthParameter(1.0)
        #print new_crv.GetLength()
        #print tEnd
        self.curve = new_crv
        self.curves.append(new_crv)

        
    def PopulateWall(self, threshold, brick_length, levels):
        allBricks = []
        for level in range(levels):
            self.currentLevel = level
            bricks = self.PopulateLevel(threshold, brick_length, level)
            self.ChangeNextLevelPositions(bricks)
            allBricks.append(bricks) 
            
        return allBricks

new_wall_khara = OuterWall(crv1,st_lb, st_hb, levels, 0)
allbricks = new_wall_khara.PopulateWall(threshold, length, levels)
bricks_mesh = []
brick_planes = []
#print allbricks
curves = new_wall_khara.curves
#print curves
for brickList in allbricks:
    for brick in brickList:
        bricks_mesh.append(brick.CreateBrickMesh())
        brick_planes.append(brick.plane)
# ---------- end python_12 ----------
not_updated = GhPythonScript(
    p3=p3,
    length="31.5",
    width="15",
    height="10",
    gap_ratio=Slider(0.13, range=0.01..0.9),
    threshold=Slider(1.4, range=0.01..10),
    reqHeight=multiplication_3,
    st_lb=Slider(0.1, range=0.1..0.45),
    st_hb=Slider(0.381, range=0.1..0.45),
    levels=number_slider_10,
    reductionVal=Slider(0.36, range=0.2..0.8),
    dist_tolerance=dist_tolerance_3)  # -> out, allbricks, bricks_mesh, curves; inputs p3: Curve, levels: Int32
# ---------- not_updated: Python ----------
#pendings: add a check that makes sure that the new brick passes a distance equals previous bricks and a distance


import Rhino.Geometry as rg
import copy
from ghpythonlib.components import ColourRGB
import math



class Brick(object):
    
    
    global length 
    global width
    global height
    
    def __init__(self, origin, rotation = 0, color = [240, 255, 255, 255] ):
        
        self.origin = origin 
        self.param = None
        self.plane = None
        #self.curve = curve
        self. rotation = 0
        self.gap = gap_ratio * length
        self.level = 0
        self.group = None
        #means that the plane os
        self.untouchable = False
        self.placed = True
        #number for the code of the brick
        self.id = None
        self.mesh = None
        self.box = None
        self.length = length
        self.width = width
        self.height = height
        if self.rotation != 0:
            RotateBrick() 
        
        self.neighbours = []
        self.color = ColourRGB(255, color[0], color[1], color[2])
        self.att_dist = None
        
    #makes an actual brick mesh from bounding box
    
    def BrickParam(self, param):
        self.param = param
        
    
    def CreateBrickMesh(self):
        self.box = rg.Box(self.plane, rg.Interval(-length/2, length/2),
                                        rg.Interval(-width/2, width/2),
                                        rg.Interval(0, height))
        self.mesh = rg.Mesh.CreateFromBox(self.box, 1, 1, 1)
        return self.mesh
        
    def RotateBrick(self):
        return 0
    
    #checks if the plane could be removed or not 
    def AddPlane(self, plane):
        unit_vect = rg.Vector3d.CrossProduct(plane.XAxis, plane.YAxis)
        if unit_vect * rg.Vector3d.ZAxis < 0: #then flip the plane 180 degrees around the x axis
            rg.Plane.Rotate(plane, math.radians(180), plane.XAxis)
        self.plane = plane


class GenericWall(object):
    
    def __init__(self, curve, st_lb, st_hb, levels = 10, currentLevel = 0):
        self.curve = curve
        self.curves = []
        self.curves.append(curve)
        self.currentLevel = currentLevel
        self.levels = levels
        self.st_lb = st_lb
        self.st_hb = st_hb
        
        #self.isf = CalculateISF()
        
    def CalculateISF(self):
        trel = self.currentLevel/self.levels
        return st_lb * ( 1/self.st_lb * self.st_hb ) ** trel
    
    





class OuterWall(GenericWall):
    
    def __init__(self, curve, st_lb, st_hb, levels, currentLevel):
        GenericWall.__init__(self, curve, st_lb, st_hb, levels, currentLevel)
        
    def NextPointCalculation(self, pt_on_curve, brick_length, gap):
        # we make a circle whose radius is half the brick length
        circle = rg.Circle(pt_on_curve, brick_length/2)
        #get intersection point and move to new point
        circleCurve = rg.ArcCurve(circle)
        events = rg.Intersect.Intersection.CurveCurve(self.curve, circleCurve, 0.001, 0.0)
        index = events.Count
        point1 = events[index-1].PointA
        #we make a new circle with radius = gap + half brick length
        circle = rg.Circle(point1, brick_length/2 + gap)
        circleCurve = rg.ArcCurve(circle)
        events = rg.Intersect.Intersection.CurveCurve(self.curve, circleCurve, 0.001, 0.0)
        index = events.Count
        point2 = events[index-1].PointA
        return point2 
    
    def PopulateLevel(self, threshold, brick_length, level):
        
        bricks = []
        #get the start point of the curve:
        point = self.curve.PointAtStart
        tPt = self.curve.ClosestPoint(point,0.0001)[1]
        tEnd = self.curve.ClosestPoint(self.curve.PointAtEnd,0.0001)[1] 
        i = 0 
        tSegmentLength = self.curve.LengthParameter(threshold * brick_length)[1]
        tSafetyFactor = self.curve.LengthParameter(brick_length)[1] * 0.5 ##hardcoded!!!!
        while tPt < tEnd - tSegmentLength:
            point = self.NextPointCalculation(point, brick_length, gap_ratio * length)
            #print point
            #populate point on curve
            tSuspect = self.curve.ClosestPoint(point,0.0001)[1]
            if tSuspect - tPt > tSafetyFactor: ###Hardcoded!!!
                tPt = tSuspect
                brick = Brick(point)
                brick.origin = self.curve.PointAt(tPt)
                brick.AddPlane(self.curve.FrameAt(tPt)[1])
                brick.level = level
                bricks.append(brick)
                i += 1
            else: 
                break
            
        #print bricks
        return bricks
        #if the level is 0, we start with the first curve 
        
    #changes the value of the indentation based on ISF 
    def ChangeNextLevelPositions(self, bricks, precision = 50):
        points = []
        #Calculatre iSF
        iSF = self.CalculateISF()
        # iterate over all bricks and move them to the right place
        tEnd = self.curve.ClosestPoint(self.curve.PointAtEnd,0.0001)[1] 
        for i in range(precision):
            if i != 0:
                t = (i * tEnd) / precision
                p = self.curve.PointAt(t)
                t1 = self.curve.TangentAt(t)
                v = rg.Vector3d.CrossProduct(t1, rg.Plane.WorldXY.ZAxis * -1)
                movementX = v * iSF * width
                movementZ = rg.Vector3d.ZAxis * height
                points.append(p + movementX + movementZ)
        new_crv = rg.NurbsCurve.Create(False, 3, points)
        new_crv = rg.Curve.CreateInterpolatedCurve(points, 3)
        #print new_crv.NormalizedLengthParameter(1.0)
        #print new_crv.GetLength()
        #print tEnd
        self.curve = new_crv
        self.curves.append(new_crv)

        
    def PopulateWall(self, threshold, brick_length, levels):
        allBricks = []
        for level in range(levels):
            self.currentLevel = level
            bricks = self.PopulateLevel(threshold, brick_length, level)
            self.ChangeNextLevelPositions(bricks)
            allBricks.append(bricks) 
            
        return allBricks

new_wall_khara = OuterWall(crv1,st_lb, st_hb, levels, 0)
allbricks = new_wall_khara.PopulateWall(threshold, length, levels)
bricks_mesh = []
brick_planes = []
#print allbricks
curves = new_wall_khara.curves
#print curves
for brickList in allbricks:
    for brick in brickList:
        bricks_mesh.append(brick.CreateBrickMesh())
        brick_planes.append(brick.plane)
# ---------- end not_updated ----------
data = Data(not_updated.bricks_mesh)
data_2 = Data(not_updated.allbricks)
data_3 = Data(python_12.bricks_mesh)
data_4 = Data(python_12.allbricks)
python_13 = GhPythonScript(x=data_2)  # -> a, b
# ---------- python_13: Python ----------
a = x
b = y
# ---------- end python_13 ----------
data_5 = Data(python_12.brick_planes)
data_6 = Data(python_12.curves)
bricks = Data(flatten(python_13.a))

# ---- group: FROM Su (continued)
python_14 = GhPythonScript(
    crv1=p1,
    length=panel,
    width=panel_3,
    height=panel_2,
    gap_ratio=Slider(0.175, range=0.01..0.9),
    threshold=number_slider,
    reqHeight=multiplication,
    st_lb=Slider(0.1, range=0.1..0.45),
    st_hbOut=st_hbout,
    st_hbIn=st_hbin,
    levels=number_slider_9,
    reductionVal=Slider(0.6, range=0.001..0.8),
    dist_tolerance=dist_tolerance)  # -> out, allbricksOut, allbricksIn, bricksOut_mesh, bricksIn_mesh, curvesOut, curvesIn, brickOut_planes, brickIn_planes; inputs crv1: Curve, crv2: Curve, levels: Int32
# ---------- python_14: Python ----------
#pendings: add a check that makes sure that the new brick passes a distance equals previous bricks and a distance


import Rhino.Geometry as rg
import copy
from ghpythonlib.components import ColourRGB
import math



def remap(value,low1,high1, low2, high2):
    """
    value : original value
    low1 : original value's lower bound
    high1 : original value's upper bound
    low2 : remapped value's lower bound
    high2 : remapped value's upper bound
    """
    remapped_value = low2 + (value - low1) * (high2 - low2) / (high1 - low1)
    return remapped_value



class Brick(object):


    global length 
    global width
    global height


    def __init__(self, origin, rotation = 0, color = [240, 255, 255, 255] ):
        
        self.origin = origin 
        self.param = None
        self.plane = None
        #self.curve = curve
        self. rotation = 0
        self.gap = gap_ratio * length
        self.level = 0
        self.group = None
        #means that the plane os
        self.untouchable = False
        self.placed = True
        #number for the code of the brick
        self.id = None
        self.mesh = None
        self.box = None
        self.length = length
        self.width = width
        self.height = height
        if self.rotation != 0:
            RotateBrick() 
        
        self.neighbours = []
        self.color = ColourRGB(255, color[0], color[1], color[2])
        self.att_dist = None
        
    #makes an actual brick mesh from bounding box


    def BrickParam(self, param):
        self.param = param


    def CreateBrickMesh(self):
        self.box = rg.Box(self.plane, rg.Interval(-length/2, length/2),
                                        rg.Interval(-width/2, width/2),
                                        rg.Interval(0, height))
        self.mesh = rg.Mesh.CreateFromBox(self.box, 1, 1, 1)
        return self.mesh


    def RotateBrick(self):
        return 0


    #checks if the plane could be removed or not 
    def AddPlane(self, plane):
        unit_vect = rg.Vector3d.CrossProduct(plane.XAxis, plane.YAxis)
        if unit_vect * rg.Vector3d.ZAxis < 0: #then flip the plane 180 degrees around the x axis
            rg.Plane.Rotate(plane, math.radians(180), plane.XAxis)
        self.plane = plane



class GenericWall(object):


    def __init__(self, curve, st_lb, st_hb, levels = 10, currentLevel = 0):
        self.curve = curve
        self.curves = []
        self.curves.append(curve)
        self.currentLevel = currentLevel
        self.levels = levels
        self.st_lb = st_lb
        self.st_hb = st_hb
        
        #self.isf = CalculateISF()


    def CalculateISF(self):
        trel = self.currentLevel/self.levels
        return st_lb * ( 1/self.st_lb * self.st_hb ) ** trel



class OuterWall(GenericWall):


    def __init__(self, curve, st_lb, st_hb, levels, currentLevel):
        GenericWall.__init__(self, curve, st_lb, st_hb, levels, currentLevel)


    def NextPointCalculation(self, pt_on_curve, brick_length, gap):
        # we make a circle whose radius is half the brick length
        circle = rg.Circle(pt_on_curve, brick_length/2)
        #get intersection point and move to new point
        circleCurve = rg.ArcCurve(circle)
        events = rg.Intersect.Intersection.CurveCurve(self.curve, circleCurve, 0.001, 0.0)
        index = events.Count
        point1 = events[index-1].PointA
        #we make a new circle with radius = gap + half brick length
        circle = rg.Circle(point1, brick_length/2 + gap)
        circleCurve = rg.ArcCurve(circle)
        events = rg.Intersect.Intersection.CurveCurve(self.curve, circleCurve, 0.001, 0.0)
        index = events.Count
        point2 = events[index-1].PointA
        return point2 


    def PopulateLevel(self, threshold, brick_length, level):
        
        bricks = []

        #get the start point of the curve:
        point = self.curve.PointAtStart
        tPt = self.curve.ClosestPoint(point,0.0001)[1]
        tEnd = self.curve.ClosestPoint(self.curve.PointAtEnd,0.0001)[1] 
        i = 0 
        tSegmentLength = self.curve.LengthParameter(threshold * brick_length)[1]
        tSafetyFactor = self.curve.LengthParameter(brick_length)[1] * 0.5 ##Hardcoded!!!!
        while tPt < tEnd - tSegmentLength:
            fac = i
            max_possible_bricks = self.curve.GetLength()/brick_length
            remapped_fac = remap(fac, 0, max_possible_bricks, 0, 7.5)
            point = self.NextPointCalculation(point, brick_length, gap_ratio * length * 0.2 + (remapped_fac))
            #populate point on curve
            tSuspect = self.curve.ClosestPoint(point,0.0001)[1]
            
            if tSuspect - tPt > tSafetyFactor: ###Hardcoded!!!
                tPt = tSuspect
                brick = Brick(point)
                brick.origin = self.curve.PointAt(tPt)
                brick.AddPlane(self.curve.FrameAt(tPt)[1])
                brick.level = level
                bricks.append(brick)
                i += 1
            else: 
                break
            
        return bricks
        #if the level is 0, we start with the first curve 


    #changes the value of the indentation based on ISF 
    def ChangeNextLevelPositions(self, bricks, precision = 50):
        points = []
        #Calculatre iSF
        iSF = self.CalculateISF()
        # iterate over all bricks and move them to the right place
        tEnd = self.curve.ClosestPoint(self.curve.PointAtEnd,0.0001)[1] 
        for i in range(precision):
            if i != 0:
                t = (i * tEnd) / precision
                p = self.curve.PointAt(t)
                t1 = self.curve.TangentAt(t)
                v = rg.Vector3d.CrossProduct(t1, rg.Plane.WorldXY.ZAxis * -1)
                movementX = v * iSF * width
                movementZ = rg.Vector3d.ZAxis * height
                points.append(p + movementX + movementZ)
        new_crv = rg.NurbsCurve.Create(False, 3, points)
        new_crv = rg.Curve.CreateInterpolatedCurve(points, 3)
        #print new_crv.NormalizedLengthParameter(1.0)
        #print new_crv.GetLength()
        #print tEnd
        self.curve = new_crv
        self.curves.append(new_crv)


    def PopulateWall(self, threshold, brick_length, levels):
        allBricks = []
        for level in range(levels):
            self.currentLevel = level
            bricks = self.PopulateLevel(threshold, brick_length, level)
            self.ChangeNextLevelPositions(bricks)
            allBricks.append(bricks) 
            
        return allBricks



class InnerWall(GenericWall):


    def __init__(self, curve, st_lb, st_hb, levels, currentLevel):
        GenericWall.__init__(self, curve, st_lb, st_hb, levels, currentLevel)


    def NextPointCalculation(self, pt_on_curve, brick_length, gap):
        # we make a circle whose radius is half the brick length
        circle = rg.Circle(pt_on_curve, brick_length/2)
        #get intersection point and move to new point
        circleCurve = rg.ArcCurve(circle)
        events = rg.Intersect.Intersection.CurveCurve(self.curve, circleCurve, 0.001, 0.0)
        index = events.Count
        point1 = events[index-1].PointA
        #we make a new circle with radius = gap + half brick length
        circle = rg.Circle(point1, brick_length/2 + gap)
        circleCurve = rg.ArcCurve(circle)
        events = rg.Intersect.Intersection.CurveCurve(self.curve, circleCurve, 0.001, 0.0)
        index = events.Count
        point2 = events[index-1].PointA
        return point2 


    def PopulateLevel(self, threshold, brick_length, level):
        
        bricks = []
        #get the start point of the curve:
        point = self.curve.PointAtStart
        tPt = self.curve.ClosestPoint(point,0.0001)[1]
        tEnd = self.curve.ClosestPoint(self.curve.PointAtEnd,0.0001)[1] 
        i = 0 
        tSegmentLength = self.curve.LengthParameter(threshold * brick_length)[1]
        tSafetyFactor = self.curve.LengthParameter(brick_length)[1] * 0.5 ##hardcoded!!!!
        while tPt < tEnd - tSegmentLength:
            point = self.NextPointCalculation(point, brick_length, gap_ratio * length * 0.75)
            #print point
            #populate point on curve
            tSuspect = self.curve.ClosestPoint(point,0.0001)[1]
            if tSuspect - tPt > tSafetyFactor: ###Hardcoded!!!
                tPt = tSuspect
                brick = Brick(point)
                brick.origin = self.curve.PointAt(tPt)
                brick.AddPlane(self.curve.FrameAt(tPt)[1])
                brick.level = level
                bricks.append(brick)
                i += 1
            else: 
                break
            
        #print bricks
        return bricks
        #if the level is 0, we start with the first curve 


    #changes the value of the indentation based on ISF 
    def ChangeNextLevelPositions(self, bricks, precision = 50):
        points = []
        #Calculatre iSF
        iSF = self.CalculateISF()
        # iterate over all bricks and move them to the right place
        tEnd = self.curve.ClosestPoint(self.curve.PointAtEnd,0.0001)[1] 
        for i in range(precision):
            if i != 0:
                t = (i * tEnd) / precision
                p = self.curve.PointAt(t)
                t1 = self.curve.TangentAt(t)
                v = rg.Vector3d.CrossProduct(t1, rg.Plane.WorldXY.ZAxis * 1)
                movementX = v * iSF * width
                movementX *= reductionVal
                movementZ = rg.Vector3d.ZAxis * height
                points.append(p + movementX + movementZ)
        new_crv = rg.NurbsCurve.Create(False, 3, points)
        new_crv = rg.Curve.CreateInterpolatedCurve(points, 3)
        #print new_crv.NormalizedLengthParameter(1.0)
        #print new_crv.GetLength()
        #print tEnd
        self.curve = new_crv
        self.curves.append(new_crv)


    def PopulateWall(self, threshold, brick_length, levels):
        allBricks = []
        for level in range(levels):
            self.currentLevel = level
            bricks = self.PopulateLevel(threshold, brick_length, level)
            self.ChangeNextLevelPositions(bricks)
            allBricks.append(bricks) 
            
        return allBricks



def CheckIntersectionCrv(pt, curve_out):
    return curve_out.ClosestPoint(pt, dist_tolerance)[0]
#rg.Curve.ClosestPoint() : ClosestPoint(self: Curve, testPoint: Point3d, maximumDistance: float) 




newOut_wall_khara = OuterWall(crv2,st_lb,st_hbOut,levels, 0)
allbricksOut = newOut_wall_khara.PopulateWall(threshold, length, levels)

curvesOut = newOut_wall_khara.curves
bricksOut_mesh = []
brickOut_planes = []

for brickListOut in allbricksOut:
    for brickOut in brickListOut:
        bricksOut_mesh.append(brickOut.CreateBrickMesh())
        m = rg.Transform.Translation(rg.Vector3d(0,0,9.5))
        brickOut.plane.Transform(m)
        brickOut_planes.append(brickOut.plane)


newIn_wall_khara = InnerWall(crv1,st_lb,st_hbIn,levels, 0)
allbricksIn = newIn_wall_khara.PopulateWall(threshold, length, levels)
bricksIn_mesh = []
brickIn_planes = []
#print allbricks
curvesIn = newIn_wall_khara.curves
#print curves

for index1,brickListIn in enumerate(allbricksIn):
    #for i in range(len(allbricksIn)):
    print len(allbricksIn)
    for index2,brickIn in enumerate(brickListIn):
        curvesOut_current_layer = curvesOut[index1]
        
        current_pt = brickIn.origin
        if not CheckIntersectionCrv(current_pt, curvesOut_current_layer):
            bricksIn_mesh.append(brickIn.CreateBrickMesh())
            m = rg.Transform.Translation(rg.Vector3d(0,0,9.5))
            brickIn.plane.Transform(m)
            brickIn_planes.append(brickIn.plane)
        else:
            print 'intersects'
# ---------- end python_14 ----------

# ---- group: Design Part / BRICK PLANES
python_15 = GhPythonScript()  # -> a, b; same code as python_13
python_16 = GhPythonScript(x=data_4)  # -> a, b; same code as python_13
pln_6 = Plane(python_15.b)

# ---- group: Design Part (continued)
bricks_2 = Data(flatten(python_16.a))
python_17 = GhPythonScript(p1=bricks_2, p3=bricks, percent_incomplete=number_slider_3, pinge=button)  # -> out, all_bricks; inputs p1: list, p3: list
# ---------- python_17: Python ----------
import Rhino.Geometry as rg
from ghpythonlib import treehelpers 
#from scriptcontext import sticky as st
from copy import deepcopy
import math 
import os
import Rhino.Geometry as rg
import json
from scriptcontext import sticky as st

#if successful (turn sticky on !)
#and if sticky is true execute a command and save the json file 



if "update_main_List" not in st:
    st["update_main_List"] = None


if pinge:
    # change the sticky value to true
    st["update_main_List"] = True
    
    
    

all_bricks = []
p1_bricks = []
brick_id = 0 
a = []
# werid gh way of acessing lists
for brick in p1:
    brick.group = "p1"
    brick.id = brick_id
    brick_id+= 1
    #print brick.id

for brick in p3:
    brick.group = "p3"
    #print brick.group
    brick.id = brick_id
    brick_id+= 1
    #print brick.id

all_bricks.extend(p1)
all_bricks.extend(p3)

#reverse list to get the last mounted bricks
p1_reverse = deepcopy(p1)
p1_reverse.reverse()

p3_reverse = deepcopy(p3)
p3_reverse.reverse()
print len(p3_reverse)
print len(p1_reverse)

#declare remaining list 
unplaced_p1 = []
unplaced_p3 = []

#get percentage of bricks and apply it to all bricks 
total_p1 = len(p1_reverse)
deleted_perc_p1 = total_p1 * percent_incomplete

total_p3 = len(p3_reverse)
deleted_perc_p3 = total_p3 * percent_incomplete

for i in range(int(deleted_perc_p1)):
    brick = p1_reverse.pop(0)
    brick.placed = False
    unplaced_p1.append(brick)
    a.append(brick.mesh)

for i in range(int(deleted_perc_p3)):
    brick = p3_reverse.pop(0)
    brick.placed = False
    print brick.id
    unplaced_p3.append(brick)
    a.append(brick.mesh)
    
    
    
if st["update_main_List"] == True:
    st["update_main_List"] = False
    #### copy the data to json file
    # get the file name (gh_canvas) and get the folder directory (folder)
    gh_canvas = ghenv.Component.OnPingDocument()
    folder = os.path.dirname(gh_canvas.FilePath)
    
    #create a dictionary containing all the list numbers
    bricks_id_dict = {}
    bricks_id_dict =   { "p1": [brick.id for brick in p1_reverse] ,
                "p3" : [brick.id for brick in p3_reverse] ,
                "p1_unplaced": [brick.id for brick in unplaced_p1],
                "p3_unplaced": [brick.id for brick in unplaced_p3]}
                
    
    
    with open(os.path.join(folder,'bricks.json'), 'w') as file:
        # use the method json.dump() - it converts dictionary to a json string
        my_j = json.dump(bricks_id_dict, file, indent = 2)
# ---------- end python_17 ----------

# ---- group: !!!!!!! Link it to all_bricks in case you want to start from scratch
python_18 = GhPythonScript(x=python_17.all_bricks)  # -> out, a
# ---------- python_18: Python ----------
a = x
# ---------- end python_18 ----------

# ---- group: Selects the appropriate brick and the counter part on the other side
python_19 = GhPythonScript(all_bricks=python_18.a, direction_prob=number_slider_4, pinge=_1_refresh_json_input)  # -> p1_bricks, p3_bricks, p1_unplaced, p3_unplaced, out, bricks, studied_brick, result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; inputs all_bricks: list
# ---------- python_19: Python ----------
###This is the start of the decaying part in which we start 

import os
import Rhino.Geometry as rg
# to work with json files import the python module json
import json
reload(json)
from copy import deepcopy
import math
from ghpythonlib.components import ColourRGB
import random

#####################Functions############################################################
# Check if Naked brick !!!!

#function that measures the inclusion of a point within an area
def IsIncluded(point, origin, maxDistance):
    vector = point - origin
    vector2d = rg.Vector2d(vector.X, vector.Y)
    if vector2d.Length < maxDistance:
        return True
    else:
        return False

#this funcitons checks if there is a brick thatis a candidate to be picked up by the robot and taken elsewhere
def CheckNakedBrickUp(studied_brick, brickList):
    bricks = []
    studied_box = None
    #until proven otherwise
    isNaked = True
    #print studied_brick.level
    for brick in brickList:
        if brick.level == studied_brick.level +1:
            if brick.origin.DistanceTo(studied_brick.origin) < 2 * brick.length:
                #get a deep copy of the studied box
                studied_box = deepcopy(studied_brick.box)
                furthest_pt = studied_box.PointAt(1,1,0)
                xMax = abs(furthest_pt.X - studied_brick.origin.X)
                yMax = abs(furthest_pt.Y - studied_brick.origin.Y)
                maxDistance = rg.Point2d.DistanceTo(rg.Point2d(xMax,yMax), rg.Point2d.Origin)
                corners = brick.box.GetCorners()
                for corner in corners:
                    bool = IsIncluded(corner, studied_brick.origin, maxDistance)
                    if bool:
                        isNaked = False
                        break
        if isNaked == False:
            break
    return isNaked

#builds on the previous function and generates the list of bricks
def CollectNakedBricks(brickList):
    nakedBricks = []
    for brick in brickList:
        if CheckNakedBrickUp(brick, brickList):
            nakedBricks.append(brick)
    return nakedBricks

###Not right should be checked in a more accurate way !!!!!!!!
#this funcitons checks if there is a brick thatis a candidate to be picked up by the robot and taken elsewhere
def CheckPlacedBrickDown(studied_brick, brickList):
    bricks = []
    studied_box = None
    #until proven otherwise
    isSafe = False
    #print studied_brick.level
    for brick in brickList:
        if brick.level == studied_brick.level - 1: ### !!!
            if brick.origin.DistanceTo(studied_brick.origin) < 2 * brick.length:
                #get a deep copy of the studied box
                studied_box = deepcopy(studied_brick.box)
                furthest_pt = studied_box.PointAt(1,1,0)
                xMax = abs(furthest_pt.X - studied_brick.origin.X)
                yMax = abs(furthest_pt.Y - studied_brick.origin.Y)
                maxDistance = rg.Point2d.DistanceTo(rg.Point2d(xMax,yMax), rg.Point2d.Origin)
                corners = brick.box.GetCorners()
                for corner in corners:
                    bool = IsIncluded(corner, studied_brick.origin, maxDistance)
                    if bool:
                        isSafe = True
                        break
        if isSafe == True:
            break
    return isSafe

#builds on the previous function and generates the list of bricks
def CollectSupportedPositions(placed_brickList, empty_positions):
    supp_UnplacedBricks = [] #supported unplaced bricks
    for brick in empty_positions:
        if CheckPlacedBrickDown(brick, placed_brickList):
            supp_UnplacedBricks.append(brick)
    return supp_UnplacedBricks

#check all both placed brick lists for possibility of game finish:
def CheckGameScenarioFinishorPickBricks(p1_bricks, p3_bricks):
    isP1_untouchable = True
    isP3_untouchable = True
    for brick in p1_bricks: 
        if brick.untouchable == False:
            isP1_untouchable = False
            break
            
    for brick in p3_bricks: 
        if brick.untouchable == False:
            isP3_untouchable = False
            break

    if not isP1_untouchable and isP3_untouchable:
        return 0
        
    elif isP1_untouchable and not isP3_untouchable:
        return 1
    elif not isP1_untouchable and not isP3_untouchable:
        if random.random() < direction_prob:
            
            return 0
        else:
            return 1
    else: 
        #game is terminated
        return None

#####################Procedurul Code############################################################
# how to parse a json file ?
# get the file name (gh_canvas) and get the folder directory (folder)
gh_canvas = ghenv.Component.OnPingDocument()
folder = os.path.dirname(gh_canvas.FilePath)

#"with open()" allows for opening and closing the file after the block inside of statement is exited.
with open(os.path.join(folder,'bricks.json')) as file:
    # 2.4 # json.load() converts json string to dictionary 
    bricks_dict = json.load(file)



###get the placed bricks, and the unplaced bricks for p1 and p3 
p1_bricks = []
p3_bricks = []
p1_unplaced = []
p3_unplaced = []


for brick in all_bricks:
    if brick.id in bricks_dict["p1"]:
        p1_bricks.append(brick)
        #a.append(brick.mesh)
    elif brick.id in bricks_dict["p3"]:
        p3_bricks.append(brick)
        #b.append(brick.mesh)
    elif brick.id in bricks_dict["p1_unplaced"]:
        p1_unplaced.append(brick)
        #c.append(brick.mesh)
    else:
        p3_unplaced.append(brick)
        #d.append(brick.mesh)
        

###Check for game termination
 
result = CheckGameScenarioFinishorPickBricks(p1_bricks, p3_bricks)
taken_brick = None
placing_place = None

if result is None:
     pass
elif result == 0: #from right to left
    #check p3 and pick a brick from it and select the potential place from p1
    #side1:
    eligible_bricks = CollectNakedBricks(p3_bricks)
    selected_brick_index = random.randint(0,len(eligible_bricks)-1)
    taken_brick = eligible_bricks[selected_brick_index]
    #side 2:
    eligible_places = CollectSupportedPositions(p1_bricks, p1_unplaced)
    print len(eligible_places)
    placing_place_Index = random.randint(0,len(eligible_places)-1)

    placing_place = eligible_places[placing_place_Index]
    
elif result == 1:
    #check p1 and pick a brick from it and select the potential place from p3
    #side 1:
    eligible_bricks = CollectNakedBricks(p1_bricks) 
    selected_brick_index = random.randint(0,len(eligible_bricks)-1)
    taken_brick = eligible_bricks[selected_brick_index]
    #side2:
    eligible_places = CollectSupportedPositions(p3_bricks, p3_unplaced) 
    placing_place_Index = random.randint(0,len(eligible_places)-1)
    placing_place = eligible_places[placing_place_Index]
# ---------- end python_19 ----------
_1_from_p1_top3 = Panel(python_19.result)

# ----
python_20 = GhPythonScript(x=python_19.placing_place, y=python_19.taken_brick)  # -> out, a, b
# ---------- python_20: Python ----------
a = x.mesh
b = y.mesh
# ---------- end python_20 ----------

# ---- group: EXECTURE ROBOTIC MOVE AND PERFORMANCE
pt = Point(Point(599.1339257, 247.8592711, 0))
xy = XYPlane(Origin=pt)
Z_6 = UnitZ(Factor="30")
move_6 = Move(Geometry=xy, Motion=Z_6)  # -> Geometry, Transform
python_21 = GhPythonScript(
    safe_position=move_6.Geometry,
    placing_place=python_19.placing_place,
    taken_brick=python_19.taken_brick,
    t_path_P1_2_S=move_3.Geometry,
    t_path_P1_2_N=move_2.Geometry,
    t_path_P3_2_S=move_4.Geometry,
    t_path_P3_2_N=move_5.Geometry,
    path_planes=move.Geometry,
    path_planes_rev=rev,
    direction=python_19.result,
    throw_away_threshold=keep_threshold,
    execute=_2_execute)  # -> script, vis_planes, maze_planes, result, direction; inputs safe_position: Plane, t_path_P1_2_S: list of Plane, t_path_P1_2_N: list of Plane, t_path_P3_2_S: list of Plane, t_path_P3_2_N: list of Plane, path_planes: list of Plane, path_planes_rev: list of Plane, direction: Int32, execute: Boolean
# ---------- python_21: Python ----------
from imp import reload
import Rhino.Geometry as rg
import simple_ur_script as ur
reload(ur)
import simple_comm as c
reload(c)
import math as m
import random
import copy

# change these values if needed
ROBOT_IP = "192.168.10.10"
SAFE_ROBOT_ACC = 0.4
SAFE_ROBOT_VEL = 0.3
IO = 4




def tcp(script):
    script += ur.set_tcp_by_angles(0.0, 0.0, 80.0, m.radians(0.0), m.radians(180.0),m.radians(0.0))
    
    return script


def set_robot_base():
    pt_0 = rg.Point3d(-282.1,-581.13,-15.4) # base plane origin
    pt_1 = rg.Point3d(-279,562.75,-16.75) # point on positive x axis
    pt_2 = rg.Point3d(-691.65,-580.75,-13.83) # point on positive xy plane
    robot_base = rg.Plane(pt_0,pt_1-pt_0,pt_2-pt_0)
    return robot_base


def rhino_to_robot_space(rhino_plane):
    plane = rhino_plane.Clone()
    robot_base_plane = set_robot_base()
    rhino_matrix = rg.Transform.PlaneToPlane(rg.Plane.WorldXY,robot_base_plane)
    plane.Transform(rhino_matrix)
    return plane


def pickup_brick(script, pick_up_plane):
    planes = []
    #change the distance if needed
    SAFE_DIST = 200
    
    safe_plane = pick_up_plane.Clone()
    safe_plane.Translate(safe_plane.ZAxis*SAFE_DIST)
    
    ## add to the path: go to the safe plane
    script += ur.move_l(safe_plane, SAFE_ROBOT_ACC, SAFE_ROBOT_VEL)
    planes.append(safe_plane)
    
    ## add to the path: go to the pick up plane
    script += ur.move_l(pick_up_plane, SAFE_ROBOT_ACC, SAFE_ROBOT_VEL)
    planes.append(pick_up_plane)
    
    ## add to the path: turn on the vacuum and wait 1 sec.
    script += ur.set_digital_out(IO,True)
    script += ur.sleep(1)

    # add to the path: go back to the safe_plane
    script += ur.move_l(safe_plane, SAFE_ROBOT_ACC, SAFE_ROBOT_VEL)
    planes.append(safe_plane)
    
    
    return script, planes


def path_brick(script, place_plane):
    
    planes = []
    
    SAFE_DIST = 200
    safe_plane = place_plane.Clone()
    safe_plane.Translate(rg.Vector3d.ZAxis*SAFE_DIST)
    
    # add to the path: go to the safe plane
    #script += ur.move_l(safe_plane, SAFE_ROBOT_ACC, SAFE_ROBOT_VEL)
    #planes.append(safe_plane)
    
    # add to the path: go to the place plane
    # !!!try ur.move_l_blend() on the robot!!! 
    script += ur.move_l(place_plane, SAFE_ROBOT_ACC, SAFE_ROBOT_VEL)
    planes.append(place_plane)
    
    ## add to the path: turn off the vacuum and wait 1 second (hold the brick)
    #script += ur.set_digital_out(IO,False)
    #script += ur.sleep(1)
    
    # add to the path: go back to the safe plane
    #script += ur.move_l(safe_plane, SAFE_ROBOT_ACC, SAFE_ROBOT_VEL)
    #planes.append(safe_plane)
    
    return script,planes
    
    
def safe_height(script, place_plane):
    
    planes = []
    
    SAFE_DISTANCE = 200
    safe_plane = place_plane.Clone()
    safe_plane.Translate(rg.Vector3d.ZAxis*SAFE_DISTANCE)
    
    # add to the path: go to the safe plane
    script += ur.move_l(safe_plane, SAFE_ROBOT_ACC, SAFE_ROBOT_VEL)
    planes.append(safe_plane)
    
    return script,planes


def safe_height_lower(script, place_plane):
    
    planes = []
    
    SAFE_DISTANCE = 120
    safe_plane = place_plane.Clone()
    safe_plane.Translate(rg.Vector3d.ZAxis*SAFE_DISTANCE)
    
    # add to the path: go to the safe plane
    script += ur.move_l(safe_plane, SAFE_ROBOT_ACC, SAFE_ROBOT_VEL)
    planes.append(safe_plane)
    
    return script,planes


def throw_brick(script, place_plane):
    
    planes = []
    
    SAFE_DIST = 200
    safe_plane = place_plane.Clone()
    safe_plane.Translate(rg.Vector3d.ZAxis*SAFE_DIST)
    
    # add to the path: go to the safe plane
    script += ur.move_l(safe_plane, SAFE_ROBOT_ACC, SAFE_ROBOT_VEL)
    planes.append(safe_plane)
    

    ## add to the path: turn off the vacuum and wait 1 second (hold the brick)
    script += ur.set_digital_out(IO,False)
    script += ur.sleep(1)
    

    return script,planes



def send(script):
    script = c.concatenate_script(script)
    c.send_script(script, ROBOT_IP)
    return script 



# translate from rhino to robot_space and iterate through all planes

"""
# Choose1: Path though the maze 
"""
def go_path(script,v_planes, path_planes, plane_1, plane_2):
    
    robot_planes = []

    for p in path_planes:
        r_plane = rhino_to_robot_space(p)
        robot_planes.append(r_plane)
        
    
    # !!!You can change the pick_station to which bricks you want to pick!!!
    script, p = pickup_brick(script,plane_1)
    v_planes.extend(p) #only to visualize the planes
    

    # !!!This go to the safe height in the beginning
    script, p = safe_height(script,plane_1)
    v_planes.extend(p) #only to visualize the planes

    # !!!This go to the safe height in the beginning
    script, p = safe_height(script,robot_planes[0])
    v_planes.extend(p) #only to visualize the planes
    
    for b_plane in robot_planes:
        script, p = path_brick(script,b_plane)
        v_planes.extend(p)
        
    # !!!This go to the safe height in the end
    index = len(robot_planes)
    script, p = safe_height(script,robot_planes[index-1])
    v_planes.extend(p) #only to visualize the planes
    
    
    # !!!You can change where to pick!!!
    script, p = safe_height_lower(script,plane_2)
    v_planes.extend(p) #only to visualize the planes
    
    # go to place the brick
    script, p = path_brick(script,plane_2)
    v_planes.extend(p)
    
    # put it down
    script += ur.set_digital_out(IO,False)
    script += ur.sleep(1)
    
    # go to save height again
    script, p = safe_height_lower(script, plane_2)
    v_planes.extend(p) #only to visualize the planes
    
    return script,v_planes





"""
Choose2: Path and throw 
"""
def throw_away(script,v_planes,throw_path_1, pick_station):
    throw_planes = []
    
    
    for pl in throw_path_1:
        rr_plane = rhino_to_robot_space(pl)
        throw_planes.append(rr_plane)
        
    # !!!You can change the pick_station to which bricks you want to pick
    script, p = pickup_brick(script,pick_station)
    v_planes.extend(p) #only to visualize the planes
    
    # !!!This go to the safe height in the beginning
    script, p = safe_height(script,throw_planes[0])
    v_planes.extend(p) #only to visualize the planes
    
    for b_plane in throw_planes:
        script, p = path_brick(script,b_plane)
        v_planes.extend(p)
    
        
    script, p = throw_brick(script,b_plane)
    v_planes.extend(p)
    
    return script,v_planes


"""
Choose3: Path and throw on another side
"""
def throw_another(script,v_planes,throw_path_2, pick_station):
    throw_planes_2 = []
    
    for pl in throw_path_2:
        rr_plane = rhino_to_robot_space(pl)
        throw_planes_2.append(rr_plane)
        
    # !!!You can change the pick_station to which bricks you want to pick
    script, p = pickup_brick(script,pick_station)
    v_planes.extend(p) #only to visualize the planes
    
    # !!!This go to the safe height in the beginning
    script, p = safe_height(script,throw_planes_2[0])
    v_planes.extend(p) #only to visualize the planes
    
    for b_plane in throw_planes_2:
        script, p = path_brick(script,b_plane)
        v_planes.extend(p)
    
        
    script, p = throw_brick(script,b_plane)
    v_planes.extend(p)
    
    return script,v_planes


##location of a pick up station
#pick_station = rg.Plane(rg.Point3d(-10.9, 441.9, 16), rg.Vector3d.XAxis, rg.Vector3d.YAxis)
#pick_station.Rotate(m.radians(-50), pick_station.YAxis, pick_station.Origin)


script = ""
script = tcp(script)
vis_planes = []



pick_from_plane = rhino_to_robot_space(taken_brick.plane)
placing_plane = rhino_to_robot_space(placing_place.plane)
safe_pos_plane = rhino_to_robot_space(safe_position)

throw_path_1 = None
throw_path_2 = None
maze_planes = None


#direction from p1 to p3
if direction == 1:
    maze_planes = path_planes
    throw_path_1 = t_path_P3_2_S
    throw_path_2 = t_path_P3_2_N
#direction from p3 to p1
else:
    maze_planes = path_planes_rev
    throw_path_1 = t_path_P1_2_S
    throw_path_2 = t_path_P1_2_N

#instantiates the value of results to be direction :

## throw away threshold
#close to 0 --> throw away
#close to 1 --> move to other side 
if random.random() < throw_away_threshold:
    result = direction
    script,vis_planes = go_path(script, vis_planes, maze_planes, pick_from_plane, placing_plane)
else:
    result = 2
    if random.random() < 0.5:
        script,vis_planes = throw_away(script,vis_planes,throw_path_1, pick_from_plane)
    else:
        script,vis_planes = throw_another(script,vis_planes,throw_path_2, pick_from_plane )
    
script, p = safe_height(script, safe_pos_plane)
vis_planes.extend(p) #only to visualize the planes


if execute:
    send(script)
# ---------- end python_21 ----------
pln_7 = Plane(python_21.vis_planes)

# ---- group: Debug
python_22 = GhPythonScript(x=python_19.p1_bricks, y=python_19.p3_bricks, z=python_19.p1_unplaced, u=python_19.p3_unplaced)  # -> out, a, b, c, d, c_1, c_2, c_3, c_4; inputs x: list, y: list, z: list, u: list
# ---------- python_22: Python ----------
from ghpythonlib.components import ColourRGB


def AddColor(list, color):
    colors_list = []
    for brick in list:
        colors_list.append(brick.color)
        
        
def AddMesh(list):
    mesh_list = []
    for brick in list:
        mesh_list.append(brick.mesh)
    return mesh_list

a = AddMesh(x)
b = AddMesh(y)
c = AddMesh(z)
d = AddMesh(u)
# ---------- end python_22 ----------
preview = CustomPreview(Geometry=python_22.a, Material=ColourSwatch(SwatchColor=RGBA(255, 255, 255, 23)))
preview_2 = CustomPreview(Geometry=python_22.b, Material=ColourSwatch(SwatchColor=RGBA(130, 52, 52, 41)))
preview_3 = CustomPreview(Geometry=python_22.c, Material=ColourSwatch(SwatchColor=RGBA(0, 183, 224, 49)))
preview_4 = CustomPreview(Geometry=python_22.d, Material=ColourSwatch(SwatchColor=RGBA(190, 10, 255, 39)))

# ----
knob = ControlKnob(Decimals=0, Limit=True, Maximum=100, Minimum=0, Range=21, Value=0)
item = ListItem(List=pln_7, Index=knob, Wrap=True)

panel_31 = Panel(python_21.result)

# ---- group: to update Json File
python_23 = GhPythonScript(
    placing_place=python_19.placing_place,
    taken_brick=python_19.taken_brick,
    pinge=update_json,
    p1_bricks=python_19.p1_bricks,
    p3_bricks=python_19.p3_bricks,
    p1_unplaced=python_19.p1_unplaced,
    p3_unplaced=python_19.p3_unplaced,
    result=python_21.result,
    direction=python_21.direction)  # -> out, a; inputs p1_bricks: list, p3_bricks: list, p1_unplaced: list, p3_unplaced: list
# ---------- python_23: Python ----------
import os
import Rhino.Geometry as rg
# to work with json files import the python module json
import json
from copy import deepcopy
from scriptcontext import sticky as st

#if successful (turn sticky on !)
#and if sticky is true execute a command and save the json file 



if "update_bool" not in st:
    st["update_bool"] = None


if pinge:
    # change the sticky value to true
    st["update_bool"] = True

if st["update_bool"] == True:
    st["update_bool"] = False
    #update the json file
    if result == 2:
        #just remove the brick from the designated list
        if direction == 1: #remove the brick from p1 
            #update p1 and p1 unplaced
            p1_bricks.remove(taken_brick)
            p1_unplaced.append(taken_brick)
        elif direction == 0: #remove the brick from p3
            p3_bricks.remove(taken_brick)
            p3_unplaced.append(taken_brick)
        taken_brick.placed = False
    
    elif result == 1:
        #from p1 to p3
        #remove the brick from p1 
        p1_bricks.remove(taken_brick)
        #add the brick to p1_unplaced
        p1_unplaced.append(taken_brick)
        #turn taken_brick placed into false
        taken_brick.placed = False
        #add placed brick to p3 
        p3_bricks.append(placing_place)
        #remove placed brick from p3 unplaced
        p3_unplaced.remove(placing_place)
        #turn placing_brick placed into true
        placing_place.placed = True

    #remove brick from p1 and add it to p3
    elif result == 0:
        #from p3 to p1
        #remove the brick from p1 
        p3_bricks.remove(taken_brick)
        #add the brick to p1_unplaced
        p3_unplaced.append(taken_brick)
        #turn taken_brick placed into false
        taken_brick.placed = False
        #add placed brick to p3 
        p1_bricks.append(placing_place)
        #remove placed brick from p3 unplaced
        p1_unplaced.remove(placing_place)
        #turn placing_brick placed into true
        placing_place.placed = True
    
    #### copy the data to json file
    # get the file name (gh_canvas) and get the folder directory (folder)
    gh_canvas = ghenv.Component.OnPingDocument()
    folder = os.path.dirname(gh_canvas.FilePath)
    
#
    #create a dictionary containing all the list numbers
    bricks_id_dict = {}
    bricks_id_dict =   { "p1": [brick.id for brick in p1_bricks] ,
                "p3" : [brick.id for brick in p3_bricks] ,
                "p1_unplaced": [brick.id for brick in p1_unplaced],
                "p3_unplaced": [brick.id for brick in p3_unplaced]}

                
                
    with open(os.path.join(folder,'bricks.json'), 'w') as file:
        # use the method json.dump() - it converts dictionary to a json string
        my_j = json.dump(bricks_id_dict, file, indent = 2)


print st["update_bool"]
# ---------- end python_23 ----------

# ---- group: not used
number_slider_12 = Slider(10, range=1..15)  # disabled
dist_tolerance_4 = Slider(1.15, range=0.9..2.1)  # disabled
number_slider_13 = Slider(0.6, range=0.2..0.8)  # disabled
number_slider_14 = Slider(0.194, range=0.1..0.45)  # disabled
number_slider_15 = Slider(0.422, range=0.1..0.45)  # disabled
number_slider_16 = Slider(0.01, range=0.01..0.9)  # disabled
multiplication_4 = Multiplication(A=panel_7, B=number_slider_12)  # disabled
python_24 = GhPythonScript(
    crv1=inner_curve,
    crv2=outer_curve_2,
    x=panel_7,
    y=panel_9,
    z=panel_8,
    gap_ratio=number_slider_16,
    reqHeight=multiplication_4,
    st_lb=number_slider_14,
    st_hb=number_slider_15,
    levels=number_slider_12,
    reductionVal=number_slider_13,
    dist_tolerance=dist_tolerance_4)  # -> out, planes_in, points_in, planes_out, points_out, crvs, ready_pts_out, ready_planes_out, ready_pts_in, ready_planes_in; inputs crv1: Curve, crv2: Curve, levels: Int32; disabled
# ---------- python_24: Python ----------
import Rhino.Geometry as rg
import copy
from ghpythonlib.components import ColourRGB



class Brick(object):
    
    
    global length
    global width
    global height
    global initialGap
    
    def __init__(self, origin, rotation = 0, color = [240, 255, 255, 255] ):
        
        self.origin = origin 
        self.param = None
        self.plane = rg.Plane.WorldXY
        #self.curve = curve
        self. rotation = 0
        self.gap = initialGap
        self.level = 0
        if self.rotation != 0:
            RotateBrick() 
        
        self.gap = 0
        self.neighbours = []
        self.color = ColourRGB(255, color[0], color[1], color[2])
        self.att_dist = None
        
    #makes an actual brick mesh from bounding box
    
    def BrickParam(self, param):
        self.param = param
        
    def BrickPlane(self, plane):
        self.plane = plane
        
    def BrickRotation(self, rotation):
        self.rotation = rotation 
        RotateBrick()
        
    def BrickGap(self, gap):
        self.gap = gap
    
    def BrickLevel(self, level):
        self.level = level
    
    def CreateBrickMesh(self):
        return rg.Mesh.CreateFromBox(rg.Box(self.plane, length, width, height), 1, 1)
        
    def RotateBrick(self):
        return 0
        


class GenericWall(object):
    
    def __init__(self, curve, st_lb, st_hb, levels = 10, currentLevel = 0):
        self.curve = curve
        self.currentLevel = currentLevel
        self.levels = levels
        self.st_lb = st_lb
        self.st_hb = st_hb
        
        self.isf = CalculateISF()
        
    def CalculateISF(self):
        trel = self.currentLevel/self.levels
        return st_lb * ( 1/self.st_lb * self.st_hb ) ** trel
    
    def NextPointCalculation(self, pt_on_curve, brick_length, gap):
        # we make a circle whose radius is half the brick length
        circle = rg.Circle(pt_on_curve, brick_length/2)
        #get intersection point and move to new point
        circleCurve = rg.ArcCurve(circle)
        events = rg.Intersect.Intersection.CurveCurve(self.curve, circleCurve, 0.001, 0.0)
        point1 = None
        if len(events) == 1:
            point1 = events[0].PointA
        else:
            point1 = events[1].PointA
        #we make a new circle with radius = gap + half brick length
        circle = rg.Circle(point1, brick_length/2 + gap)
        circleCurve = rg.ArcCurve(circle)
        events = rg.Intersect.Intersection.CurveCurve(self.curve, circleCurve, 0.001, 0.0)
        point2 = None
        if len(events) == 1:
            point2 = events[0].PointA
        else:
            point2 = events[1].PointA
        point2 = events[1].PointA
        print point2
        #we get the new point and send it back 
        return point2



class OuterWall(GenericWall):
    
    def __init__(self, curve, st_lb, st_hb, levels, currentLevel):
        GenericWall.__init__(self, curve, st_lb, st_hb, levels, currentLevel)
        
    
    def PopulateWall(self, threshold, brickLength):
        
        points = []
        #get the start point of the curve:
        point = self.curve.PointAtStart;
        points.append(points)
        while point.DistanceTo(self.curve.PointAtEnd) > threshold * brick_length:
            point = GenericWall.NextPointCalculation(point, brick_length, gap)
            points.append(point)
            
        return points
        #if the level is 0, we start with the first curve 





gap = 5
#currentLevel = 0
#for each crv divide equidistannt
#add a gap in the beginning?? (later)

#distance that triggers the combination of two curves into one
dist_tolerance *= y

crvs = []
crvs.append(crv1)
crvs.append(crv2)

current_in_crv = crv1
current_out_crv = crv2

def CalculateISF(st_lb, st_hb,levels, currentLevel):
    trel = currentLevel/levels
    return st_lb * ( 1/st_lb * st_hb ) ** trel


#function that provides the new points 
# list of points extruded 
def CreatePointsOnDome(prev_points, prev_planes, curve, st_lb, st_hb, levels, currentLevel, width, isInside):
    #we take the points, tangent and planes from prev height
    #Declare ISF for this level:
    iSF = CalculateISF(st_lb, st_hb,levels, currentLevel)
    iSF *= width
    #move based on the tangents
    i = 0
    new_points = []
    adj_new_pts = []
    new_planes = []
    new_params = []
    
    for i in range(len(prev_points)):
        #get the right direction vector
        unitizedDir = prev_planes[i].XAxis * -1
        actualDir = unitizedDir * iSF
        if isInside:
            actualDir *= reductionVal
        new_point = actualDir + prev_points[i]
        new_point.Z += z
        new_points.append(new_point)
        
    #create the Curve
    new_crv = rg.Curve.CreateInterpolatedCurve(new_points, 3)
    #get the tangents and create the new planes
    #redundant but check !!!
    adj_new_pts = new_crv.DivideEquidistant(x/2+gap/2)
    for pt in adj_new_pts:
        output = new_crv.ClosestPoint(pt,0.0001)
        if not None:
            new_params.append(output[1])
        
    for i in new_params:
        p = new_crv.PointAt(i)
        t = new_crv.TangentAt(i)
        v = rg.Vector3d.CrossProduct(t, rg.Vector3d.ZAxis)
        pn =  rg.Plane(p,v,t)
        new_planes.append(pn)
    
    return adj_new_pts, new_params, new_planes, new_crv

#def CheckIntersection(points_in_lvl, points_out_lvl, curve_in, curve_out, st_lb, st_hb, levels, currentLevel, width, dist_tolerance isInside):
#    checked_pts_in = []
#    checked_pts_out = []
#    
#    for pt in points_in_lvl
#        if curve_out.ClosestPoint(pt, dist_tolerance):
#            checked_pts_in.append(pt)

def CheckIntersection(pt, curve_out):
    print curve_out.ClosestPoint(pt, dist_tolerance)[0]
    return curve_out.ClosestPoint(pt, dist_tolerance)[0]


planes_out = []
params_out = []
points_out = []
curves_out = []

planes_in = []
params_in = []
points_in = []
curves_in = []

for crv in crvs:
    params = []
    planes = []
    points = crv.DivideEquidistant(x/2+gap/2)
    for pt in points:
        output = crv.ClosestPoint(pt,0.0001)
        if not None:
            params.append(output[1])
        
    for i in params:
        p = crv.PointAt(i)
        t = crv.TangentAt(i)

        v = rg.Vector3d.CrossProduct(t, rg.Vector3d.ZAxis)
        
        pn =  rg.Plane(p,v,t)

        planes.append(pn)
    
    if crvs.index(crv) == 0:
        planes_in.append(planes)
        params_in.append(params)
        points_in.append(points)
        curves_in.append(crv)
    
    else:
        planes_out.append(planes)
        params_out.append(params)
        points_out.append(points)
        curves_out.append(crv)

#increment the current height
#currentLevel +=1

#take each curve
#iterate of height 



#for outside Curve:
for level in range(levels-1):
    new_pts, new_params, new_planes, new_crv = CreatePointsOnDome(points_out[-1], planes_out[-1], current_out_crv, st_lb, st_hb, levels, level+1,y, False)
    points_out.append(new_pts)
    params_out.append(new_params)
    planes_out.append(new_planes)
    current_out_crv = new_crv
    curves_out.append(new_crv)
    
#for inside Curve:
for level in range(levels-1):
    new_pts, new_params, new_planes, new_crv = CreatePointsOnDome(points_in[-1], planes_in[-1], current_in_crv, st_lb, st_hb, levels, level+1,y ,True)
    points_in.append(new_pts)
    params_in.append(new_params)
    planes_in.append(new_planes)
    current_in_crv = new_crv
    curves_in.append(new_crv)


ready_pts_out = []
ready_params_out = []
ready_planes_out = []
#ready_curves_out = []


#for outer curve 
for i in range(len(points_out)):
    #get a list of point based on i
    pts = [pt for pt in points_out[i][i%2::2]]
    #get a list of params based on i
    params = [param for param in params_out[i][i%2::2]]
    #get a list of planes based on i 
    planes = [plane for plane in planes_out[i][i%2::2]]
    
    ready_pts_out.append(pts)
    ready_params_out.append(params)
    ready_planes_out.append(planes)


ready_pts_in = []
ready_params_in = []
ready_planes_in = []
#ready_curves_in = []

#for inner curve 
for i in range(len(points_in)):
    pts = []
    planes = []
    params = []
    
    #get a list of point based on i
    #print points_in[i]
    points_in[i] = [pt for pt in points_in[i][i%2::2]]
    params_in[i] = [param for param in params_in[i][i%2::2]]
    planes_in[i] = [plane for plane in planes_in[i][i%2::2]]

    for j in range(len(points_in[i])):
        if not CheckIntersection(points_in[i][j], curves_out[i]):
            pts.append(points_in[i][j])
            params.append(params_in[i][j])
            planes.append(planes_in[i][j])
            print "we are here"
            
    ready_pts_in.append(pts)
    ready_params_in.append(params)
    ready_planes_in.append(planes)
# ---------- end python_24 ----------
panel_32 = Panel("90")  # disabled
python_25 = GhPythonScript()  # -> a, spheres, my_d; disabled; same code as python_8

# ---- group: not used / BRICK PLANES
python_26 = GhPythonScript(x=python_24.ready_pts_in, y=python_24.ready_planes_in)  # -> a, b; disabled; same code as python_13
python_27 = GhPythonScript(x=python_24.ready_pts_out, y=python_24.ready_planes_out)  # -> a, b; disabled; same code as python_13
pln_8 = Plane(python_27.b)  # disabled
pln_9 = Plane(python_26.b)  # disabled

# ---- group: not used (continued)
merge = Merge(Data1=pln_8, Data2=pln_9)  # disabled
prot = RotatePlane(Plane=merge, Angle=degrees(panel_32))  # disabled

# BRICKS PREVIEW
panel_33 = Panel("2")  # disabled
division = Division(A=panel_7, B=panel_33)  # disabled
division_2 = Division(A=panel_8, B=panel_33)  # disabled
division_3 = Division(A=panel_9, B=panel_33)  # disabled
y = Panel(division_3)  # disabled
x = Panel(division)  # disabled
z = Panel(division_2)  # disabled
panel_34 = Panel("0,0,0")  # disabled
vec = VectorXYZ(XComponent=x, YComponent=y, ZComponent=z)  # -> Vector, Length; disabled
box = DomainBox(Base=panel_34, X=panel_7, Y=panel_9, Z=panel_8)  # disabled
orient = Orient(Geometry=box, Source=vec.Vector, Target=prot)  # -> Geometry, Transform; disabled
swatch = ColourSwatch(SwatchColor=RGB(73, 200, 235))  # disabled
preview_5 = CustomPreview(Geometry=orient.Geometry, Material=swatch)  # disabled

# ---- group: not used / FINAL PLANES
pln_10 = Plane(prot)  # disabled

# ---- group: not used
crv_7 = Curve(<curve referenced from the Rhino model>)  # disabled
# PLANE EDITOR
end = EndPoints(Curve=crv_7)  # -> Start, End; disabled
ln = Line(StartPoint=end.Start, EndPoint=end.End)  # disabled
vec_2 = Vector(ln)  # disabled
panel_35 = Panel("-90")  # disabled
number_slider_17 = Slider(10, range=0..10)  # disabled
prot_2 = RotatePlane(Plane=pln_10, Angle=degrees(panel_35))  # disabled
move_7 = Move(Geometry=prot_2, Motion=vec_2)  # -> Geometry, Transform; disabled
Z_7 = UnitZ(Factor=number_slider_17)  # disabled
move_8 = Move(Geometry=move_7.Geometry, Motion=Z_7)  # -> flatten(Geometry), Transform; disabled

# ---- group: not used / FABRICATION WORKFLOW
button_4 = Button()  # disabled
python_28 = GhPythonScript(brick_planes=move_8.Geometry, fabricate=button_4)  # -> script, vis_planes, pick_up_plane; inputs brick_planes: list of Plane, fabricate: Boolean; disabled
# ---------- python_28: Python ----------
from imp import reload
import Rhino.Geometry as rg
import simple_ur_script as ur
reload(ur)
import simple_comm as c
reload(c)
import math as m


# change these values if needed
ROBOT_IP = "192.168.10.10"
SAFE_ROBOT_ACC = 0.4
SAFE_ROBOT_VEL = 0.9
IO = 4




def tcp(script):
    script += ur.set_tcp_by_angles(0.0, 0.0, 80.0, m.radians(0.0), m.radians(180.0),m.radians(0.0))
    
    return script


def set_robot_base():
    pt_0 = rg.Point3d(-233.9,-503.5,-11.4) # base plane origin
    pt_1 = rg.Point3d(-272.9,648.2,-23.5) # point on positive x axis
    pt_2 = rg.Point3d(-729.7,-519.9,-10.4) # point on positive xy plane
    robot_base = rg.Plane(pt_0,pt_1-pt_0,pt_2-pt_0)
    return robot_base


def rhino_to_robot_space(rhino_plane):
    plane = rhino_plane.Clone()
    robot_base_plane = set_robot_base()
    rhino_matrix = rg.Transform.PlaneToPlane(rg.Plane.WorldXY,robot_base_plane)
    plane.Transform(rhino_matrix)
    return plane


def pickup_brick(script,pick_up_plane):
    planes = []
    #change the distance if needed
    SAFE_DIST = 150
    
    safe_plane = pick_up_plane.Clone()
    safe_plane.Translate(rg.Vector3d.ZAxis*SAFE_DIST)
    
    ## add to the path: go to the safe plane
    script += ur.move_l(safe_plane, SAFE_ROBOT_ACC, SAFE_ROBOT_VEL)
    planes.append(safe_plane)
    
    ## add to the path: go to the pick up plane
    script += ur.move_l(pick_up_plane, SAFE_ROBOT_ACC, SAFE_ROBOT_VEL)
    planes.append(pick_up_plane)
    
    ## add to the path: turn on the vacuum and wait 1 sec.
    script += ur.set_digital_out(IO,True)
    script += ur.sleep(1)

    # add to the path: go back to the safe_plane
    script += ur.move_l(safe_plane, SAFE_ROBOT_ACC, SAFE_ROBOT_VEL)
    planes.append(safe_plane)
    
    
    return script, planes


def place_brick(script, place_plane):
    
    planes = []
    
    SAFE_DIST = 100
    safe_plane = place_plane.Clone()
    safe_plane.Translate(rg.Vector3d.ZAxis*SAFE_DIST)
    
    # add to the path: go to the safe plane
    script += ur.move_l(safe_plane, SAFE_ROBOT_ACC, SAFE_ROBOT_VEL)
    planes.append(safe_plane)
    
    # add to the path: go to the place plane
    script += ur.move_l(place_plane, SAFE_ROBOT_ACC, SAFE_ROBOT_VEL)
    planes.append(place_plane)
    
    ## add to the path: turn off the vacuum and wait 1 second (hold the brick)
    script += ur.set_digital_out(IO,False)
    script += ur.sleep(1)
    
    # add to the path: go back to the safe plane
    script += ur.move_l(safe_plane, SAFE_ROBOT_ACC, SAFE_ROBOT_VEL)
    planes.append(safe_plane)
    
    return script,planes


def send(script):
    script = c.concatenate_script(script)
    c.send_script(script, ROBOT_IP)
    return script 


#location of a pick up station
pick_station = rg.Plane(rg.Point3d(-344.2, 306.2, -10.2), rg.Vector3d.XAxis, rg.Vector3d.YAxis)


script = ""
script = tcp(script)
vis_planes = []



# translate from rhino to robot_space and iterate through all planes
robot_planes = []

for p in brick_planes:
    r_plane = rhino_to_robot_space(p)
    robot_planes.append(r_plane)


for b_plane in robot_planes:
    
    script, p = pickup_brick(script,pick_station)
    vis_planes.extend(p) #only to visualize the planes
    
    script, p = place_brick(script,b_plane)
    vis_planes.extend(p)


if fabricate:
    send(script)
# ---------- end python_28 ----------
pln_11 = Plane(python_28.vis_planes)  # disabled
