# Grasshopper definition 20221101_class_brickwall_methods.gh (Grasshopper 1.0.7)

# ---- group: BRICK DIMENSIONS / width
panel = Panel("15")  # disabled

# ---- group: BRICK DIMENSIONS / height
panel_2 = Panel("10")  # disabled

# ---- group: BRICK DIMENSIONS / length
panel_3 = Panel("30")  # disabled

# ----
number_slider = Slider(14, range=0..100)  # disabled
number_slider_2 = Slider(6, range=0..100)  # disabled
angle = Slider(0, range=-90..90)  # disabled
crv = Curve(<curve referenced from the Rhino model>)  # disabled
python = GhPythonScript(crv=crv, layer_num=number_slider_2, bricks_num=number_slider, bricks_angle=angle)  # -> out, a, pt_bricks, crvs, bricks; inputs crv: Curve, layer_num: Int32, bricks_num: Int32, bricks_angle: Int32; disabled
# ---------- python: Python ----------
import rhinoscriptsyntax as rs
import Rhino.Geometry as rg
import math
import copy
import System
import ghpythonlib.treehelpers as th

length = 30
width = 15
height = 10



class Brickwall(object):
    
    """
    this is a class to create a wall from a input curve and get the origin for its bricks
    
    """
    
    # this varible was defined outside of the class
    # we need to declare it as global so it will be shared by all instances of the class
    global height
    
    
    # this method gets calles as soon as the object of a class is initiated
    # here we define instance variables = attributes of the object
    def __init__(self,curve,layer_cnt, brick_cnt):
        
        self.curve = curve
        self.layer_cnt = layer_cnt
        self.brick_cnt = brick_cnt
        
        self.crvs = self.get_layers()
        self.bpts,self.bpts_tan = self.get_bricks()
        
    # this method will be called in the __init__ function
    # it returns a list of curves 
    def get_layers(self):
        
        crvs = []
        for i in range(self.layer_cnt):
            T = rg.Transform.Translation(rg.Vector3d(0,0,i*height))
            c = copy.copy(self.curve)
            c.Transform(T)
            crvs.append(c)
        return crvs
    
    # this method will be called in the __init__ function as well
    # it divides the curves into points and returns the list of points and its tangents
    def get_bricks(self):
        
        bricks = []
        bricks_tan = []
        
        for i, c in enumerate(self.crvs):
            params = c.DivideByCount(self.brick_cnt*2,True)
            pts = []
            tngts = []
            # list comprehension
            pts = [ c.PointAt(p) for p in params[i%2::2]]
            tngts = [ c.TangentAt(p) for p in params[i%2::2]]
                
            bricks.append(pts)
            bricks_tan.append(tngts)
            
        return bricks,bricks_tan


class Brick(object):
    
    """
    this is a class to make a brick
    """
    
    global length
    global width
    global height

    # this method gets calles as soon as the object of a class is initiated
    # here we define instance variables = attributes of the object
    def __init__(self, origin, vec):
        
        
        self.origin = origin 
        self.vec = vec # point's tangent vector

        
        self.pts = self.brick_pts()
        
        self.start_plane = self.get_start_plane()
        self.target_plane = self.get_target_plane()
        
        self.mesh = self.brick_mesh()
        
        
    # this method will be called in the __init__ function
    # it returns a list of 8 points of the bounding box 
    def brick_pts(self):
        
        pt_0 = rg.Point3d(self.origin.X-length/2, self.origin.Y-width/2, self.origin.Z)
        pt_1 = rg.Point3d(pt_0.X + length, pt_0.Y, self.origin.Z)
        pt_2 = rg.Point3d(pt_1.X, pt_1.Y + width, self.origin.Z)
        pt_3 = rg.Point3d(pt_2.X - length, pt_2.Y, self.origin.Z)

        pt_4 = rg.Point3d(pt_0.X, pt_0.Y, pt_0.Z + height)
        pt_5 = rg.Point3d(pt_1.X, pt_1.Y, pt_1.Z + height)
        pt_6 = rg.Point3d(pt_2.X, pt_2.Y, pt_2.Z + height)
        pt_7 = rg.Point3d(pt_3.X, pt_3.Y, pt_3.Z + height)

        b_pts = [pt_0, pt_1, pt_2, pt_3, pt_4, pt_5, pt_6, pt_7]

        return b_pts
    
    # this method is called in the __init__ function
    # it returns the start_plane of the brick accodring to boolean input
    def get_start_plane(self):
        
        yvec = rg.Vector3d.CrossProduct(rg.Vector3d(0,0,1), self.vec)
        start_plane = rg.Plane(self.origin, self.vec, yvec)
            
        return start_plane
    
    # this method is called in the __init__ function
    # it returns the rotated start plabe plane according to input value 
    def get_target_plane(self):
        c = copy.copy(self.start_plane)
        c.Rotate(math.radians(bricks_angle), rg.Vector3d.ZAxis, self.origin)
        return c
    
    # this method is called in the __init__ funciton
    # it creates the mesh from 8 points, transforms its plane and returns the mesh 
    def brick_mesh(self):
        br = rg.Mesh.CreateFromBox(self.pts,1,1,1)
        P = rg.Plane(self.origin, rg.Vector3d.XAxis, rg.Vector3d.YAxis)
        T1 = rg.Transform.PlaneToPlane(P, self.start_plane)
        T2 = rg.Transform.PlaneToPlane(self.start_plane, self.target_plane)
        br.Transform(T1)
        br.Transform(T2)
        
        return br

# calling the object
wall = Brickwall(crv,layer_num,bricks_num)
# assigning its attribute to a variable crvs
crvs = wall.crvs
# to visualize the bricks in gh we transform it to a tree
pt_bricks = th.list_to_tree(wall.bpts)


bricks = []


for _pt,_t in zip(wall.bpts, wall.bpts_tan):
    for pt,t, in zip(_pt,_t):
        b = Brick(pt,t)
        bricks.append(b.mesh)
# ---------- end python ----------
number_slider_3 = Slider(10, range=10..15)  # disabled
angle_2 = Slider(-11, range=-90..90)
swatch = ColourSwatch(SwatchColor=RGB(255, 0, 255))  # disabled
pt = Point(flatten(python.pt_bricks))  # disabled
crv_2 = Curve(python.crvs)  # disabled
mesh = Mesh(python.bricks)  # disabled
geometry = Geometry(<brep referenced from the Rhino model>)
srf = Surface()
crv_3 = Curve(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)
number_slider_4 = Slider(0.1, range=0.1..0.45)  # disabled
preview = CustomPreview(Geometry=mesh, Material=swatch)  # disabled
curve = Curve(<curve referenced from the Rhino model>)
curve_2 = Curve(<curve referenced from the Rhino model>)
number_slider_5 = Slider(0.1, range=0.1..0.45)  # disabled
multiplication = Multiplication(A=panel_2, B=number_slider_3)  # disabled
ghpython_script = GhPythonScript(crv_1=curve_2, crv_2=curve)  # -> out, segements; inputs crv_1: Curve, crv_2: Curve
# ---------- ghpython_script: Python ----------
import Rhino.Geometry as rg
import Rhino
import math
import copy

length = 30
width = 15
height = 10

curve_1 = crv_1
curve_2 = crv_2

segements = curve_1.DivideByCount(10,True)
# ---------- end ghpython_script ----------
python_2 = GhPythonScript(srf=srf, layer_num=Slider(22, range=0..100), bricks_angle=angle_2)  # -> out, a, pt_bricks, crvs, bricks; inputs crv: Curve, srf: Surface, layer_num: Int32, bricks_angle: Int32
# ---------- python_2: Python ----------
import rhinoscriptsyntax as rs
import Rhino.Geometry as rg
import Rhino
import math
import copy
import System
import ghpythonlib.treehelpers as th

tolerance = Rhino.RhinoDoc.ActiveDoc.ModelAbsoluteTolerance

length = 30
width = 15
height = 10



class Brickwall(object):
    
    """
    this is a class to create a wall from a input curve and get the origin for its bricks
    
    """
    
    # this varible was defined outside of the class
    # we need to declare it as global so it will be shared by all instances of the class
    global height
    
    
    # this method gets calles as soon as the object of a class is initiated
    # here we define instance variables = attributes of the object
    def __init__(self, crv = None, srf = None , layer_cnt = None):
        
        self.layer_cnt = layer_cnt
        self.brick_cnt = None
        
        self.crv = crv
        self.srf = srf
        
        self.crvs = []
        self.bricks = []
        
        if self.crv is not None:
            self.wall_from_curve(self.crv)
        elif self.srf is not None:
            self.wall_from_surface(srf)
        
    def get_layers(self, curve):
        
        crvs = []
        for i in range(self.layer_cnt):
            T = rg.Transform.Translation(rg.Vector3d(0,0,i*height))
            c = copy.copy(curve)
            c.Transform(T)
            crvs.append(c)
        return crvs
    
    def get_bricks(self):
        for i, c in enumerate(self.crvs):
            self.brick_cnt = math.floor(c.GetLength()/(length+5))
            params = c.DivideByCount(self.brick_cnt*2,True)
            pts = []
            tngts = []
            # list comprehension
            bricks = [Brick(c.PointAt(p),c.TangentAt(p)) for p in params[i%2::2]]  #Creating objects of type Brick class
            self.bricks.append(bricks)
    
    def create_contours(self, srf, height):
        bounding_box = rg.Brep.GetBoundingBox(srf, rg.Plane.WorldXY)
        num_layers =  int(math.ceil(bounding_box.Max.Z/height))
        inter_crvs = []
        for i in range(num_layers):
            origin = rg.Point3d(0,0,i*height)
            brep = srf.ToBrep()
            plane = rg.Plane(origin, rg.Vector3d.XAxis, rg.Vector3d.YAxis)
            
            intersection_event = rg.Intersect.Intersection.BrepPlane(brep,plane,tolerance)
            inter_crvs.append(intersection_event[1][0])
        return inter_crvs
    
    def wall_from_curve(self, curve):
        self.crvs = self.get_layers(curve)
        self.get_bricks()
    
    def wall_from_surface(self,srf):
        self.crvs = self.create_contours(srf, height)
        self.get_bricks()


class Brick(object):
    
    """
    this is a class to make a brick
    """
    
    global length
    global width
    global height

    # this method gets calles as soon as the object of a class is initiated
    # here we define instance variables = attributes of the object
    def __init__(self, origin, vec):
        
        
        self.origin = origin 
        self.vec = vec # point's tangent vector

        
        self.pts = self.brick_pts()
        
        self.start_plane = self.get_start_plane()
        self.target_plane = self.get_target_plane()
        
        self.mesh = self.brick_mesh()
        self.neighbors= []
        self.color = []
        
        
        
    # this method will be called in the __init__ function
    # it returns a list of 8 points of the bounding box 
    def brick_pts(self):
        
        pt_0 = rg.Point3d(self.origin.X-length/2, self.origin.Y-width/2, self.origin.Z)
        pt_1 = rg.Point3d(pt_0.X + length, pt_0.Y, self.origin.Z)
        pt_2 = rg.Point3d(pt_1.X, pt_1.Y + width, self.origin.Z)
        pt_3 = rg.Point3d(pt_2.X - length, pt_2.Y, self.origin.Z)

        pt_4 = rg.Point3d(pt_0.X, pt_0.Y, pt_0.Z + height)
        pt_5 = rg.Point3d(pt_1.X, pt_1.Y, pt_1.Z + height)
        pt_6 = rg.Point3d(pt_2.X, pt_2.Y, pt_2.Z + height)
        pt_7 = rg.Point3d(pt_3.X, pt_3.Y, pt_3.Z + height)

        b_pts = [pt_0, pt_1, pt_2, pt_3, pt_4, pt_5, pt_6, pt_7]

        return b_pts
    
    # this method is called in the __init__ function
    # it returns the start_plane of the brick accodring to boolean input
    def get_start_plane(self):
        
        yvec = rg.Vector3d.CrossProduct(rg.Vector3d(0,0,1), self.vec)
        start_plane = rg.Plane(self.origin, self.vec, yvec)
            
        return start_plane
    
    # this method is called in the __init__ function
    # it returns the rotated start plabe plane according to input value 
    def get_target_plane(self):
        c = copy.copy(self.start_plane)
        c.Rotate(math.radians(bricks_angle), rg.Vector3d.ZAxis, self.origin)
        return c
    
    # this method is called in the __init__ funciton
    # it creates the mesh from 8 points, transforms its plane and returns the mesh 
    def brick_mesh(self):
        br = rg.Mesh.CreateFromBox(self.pts,1,1,1)
        P = rg.Plane(self.origin, rg.Vector3d.XAxis, rg.Vector3d.YAxis)
        T1 = rg.Transform.PlaneToPlane(P, self.start_plane)
        T2 = rg.Transform.PlaneToPlane(self.start_plane, self.target_plane)
        br.Transform(T1)
        br.Transform(T2)
        
        return br

# calling the object
wall = Brickwall(crv = crv, srf = srf ,layer_cnt = layer_num)

bricks = [brick.brick_mesh() for brick_list in wall.bricks for brick in brick_list]
# ---------- end python_2 ----------
crv_4 = Curve(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)  # disabled
crv_5 = Curve(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)  # disabled
number_slider_6 = Slider(12, range=1..20)  # disabled
python_3 = GhPythonScript(
    crv1=crv_4,
    crv2=crv_5,
    x=panel_3,
    y=panel,
    z=panel_2,
    reqHeight=multiplication,
    st_lb=number_slider_4,
    st_hb=number_slider_5)  # -> out, planes_in, params_in, points_in, planes_out, params_out, points_out; inputs crv1: Curve, crv2: Curve; disabled
# ---------- python_3: Python ----------
import Rhino.Geometry as rg
import copy

gap = 5

#for each crv divide equidistannt
#add a gap in the beginning?? (later)

crvs = []
crvs.append(crv1)
crvs.append(crv2)



planes_out = []
params_out = []
points_out = []
all_planes_out = []
all_params_out = []
all_points_out = []

planes_in = []
params_in = []
points_in = []
all_planes_in = []
all_params_in = []
all_points_in = []

for crv in crvs:
    params = []
    planes = []
    points = crv.DivideEquidistant(x+gap)
    for pt in points:
        output = crv.ClosestPoint(pt,0.0001)
        if not None:
            params.append(output[1])
        
    for i in params:
        p = crv.PointAt(i)
        t = crv.TangentAt(i)
        print p
        v = rg.Vector3d.CrossProduct(t, rg.Vector3d.ZAxis)
        
        pn =  rg.Plane(p,v,t)
        print pn
        planes.append(pn)
    
    if crvs.index(crv) == 0:
        planes_in.append(points)
        params_in.append(params)
        points_in.append(planes)
    
    else:
        planes_out.append(points)
        params_out.append(params)
        points_out.append(planes)

#take each curve
#iterate of height 
#for each height take each point on the previous level and move it up by 1 step
#calculate the required instep factor
#then get the direction vector of movement (-x)
#unitize just for safety
# ---------- end python_3 ----------
panel_4 = Panel(ghpython_script.segements)
pt_2 = Point(flatten(python_2.pt_bricks))
crv_6 = Curve(python_2.crvs)
mesh_2 = Mesh(python_2.bricks)
preview_2 = CustomPreview(Geometry=mesh_2, Material=ColourSwatch(SwatchColor=RGB(99, 107, 255)))
python_4 = GhPythonScript(x=python_3.planes_in, y=python_3.params_in, z=python_3.points_in)  # -> out, a, b, c; disabled
# ---------- python_4: Python ----------
a = x
b = y
c = z
# ---------- end python_4 ----------
python_5 = GhPythonScript(x=python_3.planes_out, y=python_3.params_out, z=python_3.points_out)  # -> out, a, b, c; disabled; same code as python_4

number_slider_7 = Slider(10, range=1..15)

# ---- group: BRICK DIMENSIONS / height
panel_5 = Panel("10")

# ---- group: BRICK DIMENSIONS / length
panel_6 = Panel("30")

# ---- group: BRICK DIMENSIONS / width
panel_7 = Panel("15")

# ----
crv_7 = Curve(<curve referenced from the Rhino model>)  # disabled
python_6 = GhPythonScript(crv=crv_7, height=panel_2, length=panel_3, width=panel, gap=number_slider_6)  # -> planes, brick_meshes; inputs crv: Curve; disabled
# ---------- python_6: Python ----------
"""
MasDfab 22-23

Basic example to get planes from crv

"""

import Rhino.Geometry as rg
import copy



def brick(pln):
    """ List of rg.Points definding the corners of the brick 
    
    Returns
    ----------
    [pt0 : bottom point at negative x and negative y,
    pt1 : bottom point at negative x and positive y,
    pt2 : bottom point at positive x and positive y,
    pt3 : bottom point at positive x and negative y,
    pt4 : pt0 + height,
    pt5 : pt1 + height,
    pt6 : pt2 + height,
    pt7 : pt3 + height]
    """
    

    
    origin = pln.Origin
    
    x_vec = pln.XAxis 
    y_vec = pln.YAxis 
    z_vec = pln.ZAxis
    
    pt_0 = origin - (x_vec *width/2) - (y_vec *length/2)
    pt_1 = origin + (x_vec *width/2) - (y_vec *length/2)
    pt_2 = origin + (x_vec *width/2) + (y_vec *length/2)
    pt_3 = origin - (x_vec *width/2) + (y_vec *length/2)
    
    pt_4 = pt_0 + (z_vec*height)
    pt_5 = pt_1 + (z_vec*height)
    pt_6 = pt_2 + (z_vec*height)
    pt_7 = pt_3 + (z_vec*height)
    
    pts = [pt_0, pt_1, pt_2, pt_3, pt_4, pt_5, pt_6, pt_7]
    
    
    return pts

def mesh(pts):
    """Mesh  depicting the brick:

    Returns
    ----------
    mesh_brick : Mesh
    """
    mesh_brick = rg.Mesh.CreateFromBox(pts, 1,1,1)
    return mesh_brick

def pick_plane(plane):
    """offsets the plane of the brick with its height. 
    Returns
    ----------
    pick_plane : rg.Plane
    """
    
    offset_vec = plane.ZAxis * height
    pick_plane = copy.copy(plane)
    pick_plane.Translate(offset_vec) 
    
    return pick_plane


#gap = 5
points = crv.DivideEquidistant(length+gap)
#params = crv.DivideByLength(length+gap, True)
params = []
planes = []
for pt in points:
    output = crv.ClosestPoint(pt,0.0001)
    if not None:
        params.append(output[1])
        #print output[1]


for i in params:
    
    p = crv.PointAt(i)
    t = crv.TangentAt(i)
    print p
    v = rg.Vector3d.CrossProduct(t, rg.Vector3d.ZAxis)
    
    pn =  rg.Plane(p,v,t)
    print pn
    planes.append(pn)



brick_pts = [brick(p) for p in planes]
brick_meshes = [mesh(m) for m in brick_pts]
brick_planes = [pick_plane(p) for p in planes]
# ---------- end python_6 ----------
pln = Plane(python_6.planes)  # disabled
mesh_3 = Mesh(python_6.brick_meshes)  # disabled

dist_tolerance = Slider(1.1, range=1.1..2.1)
multiplication_2 = Multiplication(A=panel_5, B=number_slider_7)
crv_8 = Curve(<curve referenced from the Rhino model>)
crv_9 = Curve(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)
python_7 = GhPythonScript(
    crv1=crv_9,
    crv2=crv_8,
    x=panel_6,
    y=panel_7,
    z=panel_5,
    reqHeight=multiplication_2,
    st_lb=Slider(0.1, range=0.1..0.45),
    st_hb=Slider(0.422, range=0.1..0.45),
    levels=number_slider_7,
    reductionVal=Slider(0.6, range=0.2..0.8),
    dist_tolerance=dist_tolerance)  # -> out, planes_in, points_in, planes_out, points_out, crvs, ready_pts_out, ready_planes_out, ready_pts_in, ready_planes_in; inputs crv1: Curve, crv2: Curve, levels: Int32
# ---------- python_7: Python ----------
import Rhino.Geometry as rg
import copy

gap = 5
#currentLevel = 0
#for each crv divide equidistannt
#add a gap in the beginning?? (later)

#distance that triggers the combination of two curves into one
dist_tolerance *= y

crvs = []
crvs.append(crv1)
crvs.append(crv2)

current_in_crv = crv1
current_out_crv = crv2

def CalculateISF(st_lb, st_hb,levels, currentLevel):
    trel = currentLevel/levels
    return st_lb * ( 1/st_lb * st_hb ) ** trel


#function that provides the new points 
# list of points extruded 
def CreatePointsOnDome(prev_points, prev_planes, curve, st_lb, st_hb, levels, currentLevel, width, isInside):
    #we take the points, tangent and planes from prev height
    #Declare ISF for this level:
    iSF = CalculateISF(st_lb, st_hb,levels, currentLevel)
    iSF *= width
    #move based on the tangents
    i = 0
    new_points = []
    adj_new_pts = []
    new_planes = []
    new_params = []
    
    for i in range(len(prev_points)):
        #get the right direction vector
        unitizedDir = prev_planes[i].XAxis * -1
        actualDir = unitizedDir * iSF
        if isInside:
            actualDir *= reductionVal
        new_point = actualDir + prev_points[i]
        new_point.Z += z
        new_points.append(new_point)
        
    #create the Curve
    new_crv = rg.Curve.CreateInterpolatedCurve(new_points, 3)
    #get the tangents and create the new planes
    #redundant but check !!!
    adj_new_pts = new_crv.DivideEquidistant(x/2+gap/2)
    for pt in adj_new_pts:
        output = new_crv.ClosestPoint(pt,0.0001)
        if not None:
            new_params.append(output[1])
        
    for i in new_params:
        p = new_crv.PointAt(i)
        t = new_crv.TangentAt(i)
        v = rg.Vector3d.CrossProduct(t, rg.Vector3d.ZAxis)
        pn =  rg.Plane(p,v,t)
        new_planes.append(pn)
    
    return adj_new_pts, new_params, new_planes, new_crv

#def CheckIntersection(points_in_lvl, points_out_lvl, curve_in, curve_out, st_lb, st_hb, levels, currentLevel, width, dist_tolerance isInside):
#    checked_pts_in = []
#    checked_pts_out = []
#    
#    for pt in points_in_lvl
#        if curve_out.ClosestPoint(pt, dist_tolerance):
#            checked_pts_in.append(pt)

def CheckIntersection(pt, curve_out):
    print curve_out.ClosestPoint(pt, dist_tolerance)[0]
    return curve_out.ClosestPoint(pt, dist_tolerance)[0]


planes_out = []
params_out = []
points_out = []
curves_out = []

planes_in = []
params_in = []
points_in = []
curves_in = []

for crv in crvs:
    params = []
    planes = []
    points = crv.DivideEquidistant(x/2+gap/2)
    for pt in points:
        output = crv.ClosestPoint(pt,0.0001)
        if not None:
            params.append(output[1])
        
    for i in params:
        p = crv.PointAt(i)
        t = crv.TangentAt(i)

        v = rg.Vector3d.CrossProduct(t, rg.Vector3d.ZAxis)
        
        pn =  rg.Plane(p,v,t)

        planes.append(pn)
    
    if crvs.index(crv) == 0:
        planes_in.append(planes)
        params_in.append(params)
        points_in.append(points)
        curves_in.append(crv)
    
    else:
        planes_out.append(planes)
        params_out.append(params)
        points_out.append(points)
        curves_out.append(crv)

#increment the current height
#currentLevel +=1

#take each curve
#iterate of height 



#for outside Curve:
for level in range(levels-1):
    new_pts, new_params, new_planes, new_crv = CreatePointsOnDome(points_out[-1], planes_out[-1], current_out_crv, st_lb, st_hb, levels, level+1,y, False)
    points_out.append(new_pts)
    params_out.append(new_params)
    planes_out.append(new_planes)
    current_out_crv = new_crv
    curves_out.append(new_crv)
    
#for inside Curve:
for level in range(levels-1):
    new_pts, new_params, new_planes, new_crv = CreatePointsOnDome(points_in[-1], planes_in[-1], current_in_crv, st_lb, st_hb, levels, level+1,y ,True)
    points_in.append(new_pts)
    params_in.append(new_params)
    planes_in.append(new_planes)
    current_in_crv = new_crv
    curves_in.append(new_crv)


ready_pts_out = []
ready_params_out = []
ready_planes_out = []
#ready_curves_out = []


#for outer curve 
for i in range(len(points_out)):
    #get a list of point based on i
    pts = [pt for pt in points_out[i][i%2::2]]
    #get a list of params based on i
    params = [param for param in params_out[i][i%2::2]]
    #get a list of planes based on i 
    planes = [plane for plane in planes_out[i][i%2::2]]
    
    ready_pts_out.append(pts)
    ready_params_out.append(params)
    ready_planes_out.append(planes)


ready_pts_in = []
ready_params_in = []
ready_planes_in = []
#ready_curves_in = []

#for inner curve 
for i in range(len(points_in)):
    pts = []
    planes = []
    params = []
    
    #get a list of point based on i
    #print points_in[i]
    points_in[i] = [pt for pt in points_in[i][i%2::2]]
    params_in[i] = [param for param in params_in[i][i%2::2]]
    planes_in[i] = [plane for plane in planes_in[i][i%2::2]]

    for j in range(len(points_in[i])):
        if not CheckIntersection(points_in[i][j], curves_out[i]):
            pts.append(points_in[i][j])
            params.append(params_in[i][j])
            planes.append(planes_in[i][j])
            print "we are here"
            
    ready_pts_in.append(pts)
    ready_params_in.append(params)
    ready_planes_in.append(planes)
# ---------- end python_7 ----------

# ---- group: Not used now!!!
button = Button()  # disabled
python_8 = GhPythonScript(brick_planes=pln, fabricate=button)  # -> script, vis_planes, pick_up_plane; inputs brick_planes: list of Plane, fabricate: Boolean; disabled
# ---------- python_8: Python ----------
from imp import reload
import Rhino.Geometry as rg
import simple_ur_script as ur
reload(ur)
import simple_comm as c
reload(c)
import math as m


# change these values if needed
ROBOT_IP = "192.168.10.10"
SAFE_ROBOT_ACC = 0.1
SAFE_ROBOT_VEL = 0.1
IO = 4




def tcp(script):
    script += ur.set_tcp_by_angles(0.0, 0.0, 80.0, m.radians(0.0), m.radians(180.0),m.radians(0.0))
    
    return script


def set_robot_base():
    pt_0 = rg.Point3d(327,230,-10) # base plane origin
    pt_1 = rg.Point3d(499,230,-10) # point on positive x axis
    pt_2 = rg.Point3d(499,499,-10) # point on positive xy plane
    robot_base = rg.Plane(pt_0,pt_1-pt_0,pt_2-pt_0)
    return robot_base


def rhino_to_robot_space(rhino_plane):
    plane = rhino_plane.Clone()
    robot_base_plane = set_robot_base()
    rhino_matrix = rg.Transform.PlaneToPlane(rg.Plane.WorldXY,robot_base_plane)
    plane.Transform(rhino_matrix)
    return plane


def pickup_brick(script,pick_up_plane):
    planes = []
    #change the distance if needed
    SAFE_DIST = 150
    
    safe_plane = pick_up_plane.Clone()
    safe_plane.Translate(rg.Vector3d.ZAxis*SAFE_DIST)
    
    ## add to the path: go to the safe plane
    script += ur.move_l(safe_plane, SAFE_ROBOT_ACC, SAFE_ROBOT_VEL)
    planes.append(safe_plane)
    
    ## add to the path: go to the pick up plane
    script += ur.move_l(pick_up_plane, SAFE_ROBOT_ACC, SAFE_ROBOT_VEL)
    planes.append(pick_up_plane)
    
    ## add to the path: turn on the vacuum and wait 1 sec.
    script += ur.set_digital_out(IO,True)
    script += ur.sleep(1)

    # add to the path: go back to the safe_plane
    script += ur.move_l(safe_plane, SAFE_ROBOT_ACC, SAFE_ROBOT_VEL)
    planes.append(safe_plane)
    
    
    return script, planes


def place_brick(script, place_plane):
    
    planes = []
    
    SAFE_DIST = 100
    safe_plane = place_plane.Clone()
    safe_plane.Translate(rg.Vector3d.ZAxis*SAFE_DIST)
    
    # add to the path: go to the safe plane
    script += ur.move_l(safe_plane, SAFE_ROBOT_ACC, SAFE_ROBOT_VEL)
    planes.append(safe_plane)
    
    # add to the path: go to the place plane
    script += ur.move_l(place_plane, SAFE_ROBOT_ACC, SAFE_ROBOT_VEL)
    planes.append(place_plane)
    
    ## add to the path: turn off the vacuum and wait 1 second (hold the brick)
    script += ur.set_digital_out(IO,False)
    script += ur.sleep(1)
    
    # add to the path: go back to the safe plane
    script += ur.move_l(safe_plane, SAFE_ROBOT_ACC, SAFE_ROBOT_VEL)
    planes.append(safe_plane)
    
    return script,planes


def send(script):
    script = c.concatenate_script(script)
    c.send_script(script, ROBOT_IP)
    return script 


#location of a pick up station
pick_station = rg.Plane(rg.Point3d(0, 450, -3.5), rg.Vector3d.XAxis, rg.Vector3d.YAxis)


script = ""
script = tcp(script)
vis_planes = []



# translate from rhino to robot_space and iterate through all planes
robot_planes = []

for p in brick_planes:
    r_plane = rhino_to_robot_space(p)
    robot_planes.append(r_plane)


for b_plane in robot_planes:
    
    script, p = pickup_brick(script,pick_station)
    vis_planes.extend(p) #only to visualize the planes
    
    script, p = place_brick(script,b_plane)
    vis_planes.extend(p)


if fabricate:
    send(script)
# ---------- end python_8 ----------
pln_2 = Plane(python_8.vis_planes)  # disabled
panel_8 = Panel(python_8.script)  # disabled

# ----
python_9 = GhPythonScript(x=python_7.planes_in, z=python_7.points_in)  # -> out, a, c; same code as python_4
python_10 = GhPythonScript(x=python_7.planes_out, z=python_7.points_out)  # -> out, a, c; same code as python_4
python_11 = GhPythonScript(x=python_7.ready_pts_out, y=python_7.ready_planes_out)  # -> a, b
# ---------- python_11: Python ----------
a = x
b = y
# ---------- end python_11 ----------
python_12 = GhPythonScript(x=python_7.ready_pts_in, y=python_7.ready_planes_in)  # -> a, b; same code as python_11
geometry_2 = Geometry(python_7.crvs)
data = Data(python_9.a)
data_2 = Data([python_11.b, python_12.b])
pt_3 = Point(flatten(python_9.a))
