# Grasshopper definition 20221103_GenericWalls_khara.gh (Grasshopper 1.0.7)
# plug-ins: Bifocals

# ---- group: BRICK DIMENSIONS / length
panel = Panel("31.5")

# ---- group: BRICK DIMENSIONS / height
panel_2 = Panel("10")

# ---- group: BRICK DIMENSIONS / width
panel_3 = Panel("15")

# ----
number_slider = Slider(10, range=1..15)
dist_tolerance = Slider(1.15, range=0.9..2.1)

outer_curve = Curve(<curve referenced from the Rhino model>)
inner_curve = Curve(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)

multiplication = Multiplication(A=panel, B=number_slider)
python = GhPythonScript(
    crv1=outer_curve,
    crv2=outer_curve,
    length=panel,
    width=panel_3,
    height=panel_2,
    gap_ratio=Slider(0.01, range=0.01..0.9),
    threshold=Slider(6.17, range=0.01..10),
    reqHeight=multiplication,
    st_lb=Slider(0.194, range=0.1..0.45),
    st_hb=Slider(0.422, range=0.1..0.45),
    levels=number_slider,
    reductionVal=Slider(0.6, range=0.2..0.8),
    dist_tolerance=dist_tolerance)  # -> out, points, planes_in, points_in, planes_out, points_out, crvs, ready_pts_out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; inputs crv1: Curve, crv2: Curve, levels: Int32
# ---------- python: Python ----------
import Rhino.Geometry as rg
import copy
from ghpythonlib.components import ColourRGB

gap = gap_ratio * length

class Brick(object):
    
    
    global length 
    global width
    global height
    global initialGap
    
    def __init__(self, origin, rotation = 0, color = [240, 255, 255, 255] ):
        
        self.origin = origin 
        self.param = None
        self.plane = rg.Plane.WorldXY
        #self.curve = curve
        self. rotation = 0
        self.gap = initialGap
        self.level = 0
        if self.rotation != 0:
            RotateBrick() 
        
        self.gap = 0
        self.neighbours = []
        self.color = ColourRGB(255, color[0], color[1], color[2])
        self.att_dist = None
        
    #makes an actual brick mesh from bounding box
    
    def BrickParam(self, param):
        self.param = param
        
    def BrickPlane(self, plane):
        self.plane = plane
        
    def BrickRotation(self, rotation):
        self.rotation = rotation 
        RotateBrick()
        
    def BrickGap(self, gap):
        self.gap = gap
    
    def BrickLevel(self, level):
        self.level = level
    
    def CreateBrickMesh(self):
        return rg.Mesh.CreateFromBox(rg.Box(self.plane, length, width, height), 1, 1)
        
    def RotateBrick(self):
        return 0
        


class GenericWall(object):
    
    def __init__(self, curve, st_lb, st_hb, levels = 10, currentLevel = 0):
        self.curve = curve
        self.currentLevel = currentLevel
        self.levels = levels
        self.st_lb = st_lb
        self.st_hb = st_hb
        
        #self.isf = CalculateISF()
        
    def CalculateISF(self):
        trel = self.currentLevel/self.levels
        return st_lb * ( 1/self.st_lb * self.st_hb ) ** trel
    




class OuterWall(GenericWall):
    
    def __init__(self, curve, st_lb, st_hb, levels, currentLevel):
        GenericWall.__init__(self, curve, st_lb, st_hb, levels, currentLevel)
        
    def NextPointCalculation(self, pt_on_curve, brick_length, gap):
        # we make a circle whose radius is half the brick length
        circle = rg.Circle(pt_on_curve, brick_length/2)
        #get intersection point and move to new point
        circleCurve = rg.ArcCurve(circle)
        events = rg.Intersect.Intersection.CurveCurve(self.curve, circleCurve, 0.001, 0.0)
        point1 = None
        if len(events) == 1:
            point1 = events[0].PointA
        else:
            point1 = events[1].PointA
        #we make a new circle with radius = gap + half brick length
        circle = rg.Circle(point1, brick_length/2 + gap)
        circleCurve = rg.ArcCurve(circle)
        events = rg.Intersect.Intersection.CurveCurve(self.curve, circleCurve, 0.001, 0.0)
        point2 = None
        if len(events) == 1:
            point2 = events[0].PointA
        else:
            point2 = events[1].PointA
        print point2
        #we get the new point and send it back 
        return point2
    
    
    def PopulateWall(self, threshold, brick_length):
        
        points = []
        #get the start point of the curve:
        point = self.curve.PointAtStart;
        points.append(points)
        i = 0 
        while point.DistanceTo(self.curve.PointAtEnd) > threshold * brick_length:
            point = self.NextPointCalculation(point, brick_length, gap)
            points.append(point)
            i += 1
        return points
        #if the level is 0, we start with the first curve 


new_wall_khara = OuterWall(crv1,st_lb, st_hb, levels, 0)
points = new_wall_khara.PopulateWall(threshold, length)


#gap = 5
##currentLevel = 0
##for each crv divide equidistannt
##add a gap in the beginning?? (later)
#
##distance that triggers the combination of two curves into one
#dist_tolerance *= y
#
#crvs = []
#crvs.append(crv1)
#crvs.append(crv2)
#
#current_in_crv = crv1
#current_out_crv = crv2
#
#def CalculateISF(st_lb, st_hb,levels, currentLevel):
#    trel = currentLevel/levels
#    return st_lb * ( 1/st_lb * st_hb ) ** trel
#
#
##function that provides the new points 
## list of points extruded 
#def CreatePointsOnDome(prev_points, prev_planes, curve, st_lb, st_hb, levels, currentLevel, width, isInside):
#    #we take the points, tangent and planes from prev height
#    #Declare ISF for this level:
#    iSF = CalculateISF(st_lb, st_hb,levels, currentLevel)
#    iSF *= width
#    #move based on the tangents
#    i = 0
#    new_points = []
#    adj_new_pts = []
#    new_planes = []
#    new_params = []
#    
#    for i in range(len(prev_points)):
#        #get the right direction vector
#        unitizedDir = prev_planes[i].XAxis * -1
#        actualDir = unitizedDir * iSF
#        if isInside:
#            actualDir *= reductionVal
#        new_point = actualDir + prev_points[i]
#        new_point.Z += z
#        new_points.append(new_point)
#        
#    #create the Curve
#    new_crv = rg.Curve.CreateInterpolatedCurve(new_points, 3)
#    #get the tangents and create the new planes
#    #redundant but check !!!
#    adj_new_pts = new_crv.DivideEquidistant(x/2+gap/2)
#    for pt in adj_new_pts:
#        output = new_crv.ClosestPoint(pt,0.0001)
#        if not None:
#            new_params.append(output[1])
#        
#    for i in new_params:
#        p = new_crv.PointAt(i)
#        t = new_crv.TangentAt(i)
#        v = rg.Vector3d.CrossProduct(t, rg.Vector3d.ZAxis)
#        pn =  rg.Plane(p,v,t)
#        new_planes.append(pn)
#    
#    return adj_new_pts, new_params, new_planes, new_crv
#
##def CheckIntersection(points_in_lvl, points_out_lvl, curve_in, curve_out, st_lb, st_hb, levels, currentLevel, width, dist_tolerance isInside):
##    checked_pts_in = []
##    checked_pts_out = []
##    
##    for pt in points_in_lvl
##        if curve_out.ClosestPoint(pt, dist_tolerance):
##            checked_pts_in.append(pt)
#
#def CheckIntersection(pt, curve_out):
#    print curve_out.ClosestPoint(pt, dist_tolerance)[0]
#    return curve_out.ClosestPoint(pt, dist_tolerance)[0]
#
#
#planes_out = []
#params_out = []
#points_out = []
#curves_out = []
#
#planes_in = []
#params_in = []
#points_in = []
#curves_in = []
#
#for crv in crvs:
#    params = []
#    planes = []
#    points = crv.DivideEquidistant(x/2+gap/2)
#    for pt in points:
#        output = crv.ClosestPoint(pt,0.0001)
#        if not None:
#            params.append(output[1])
#        
#    for i in params:
#        p = crv.PointAt(i)
#        t = crv.TangentAt(i)
#
#        v = rg.Vector3d.CrossProduct(t, rg.Vector3d.ZAxis)
#        
#        pn =  rg.Plane(p,v,t)
#
#        planes.append(pn)
#    
#    if crvs.index(crv) == 0:
#        planes_in.append(planes)
#        params_in.append(params)
#        points_in.append(points)
#        curves_in.append(crv)
#    
#    else:
#        planes_out.append(planes)
#        params_out.append(params)
#        points_out.append(points)
#        curves_out.append(crv)
#
##increment the current height
##currentLevel +=1
#
##take each curve
##iterate of height 
#
#
#
##for outside Curve:
#for level in range(levels-1):
#    new_pts, new_params, new_planes, new_crv = CreatePointsOnDome(points_out[-1], planes_out[-1], current_out_crv, st_lb, st_hb, levels, level+1,y, False)
#    points_out.append(new_pts)
#    params_out.append(new_params)
#    planes_out.append(new_planes)
#    current_out_crv = new_crv
#    curves_out.append(new_crv)
#    
##for inside Curve:
#for level in range(levels-1):
#    new_pts, new_params, new_planes, new_crv = CreatePointsOnDome(points_in[-1], planes_in[-1], current_in_crv, st_lb, st_hb, levels, level+1,y ,True)
#    points_in.append(new_pts)
#    params_in.append(new_params)
#    planes_in.append(new_planes)
#    current_in_crv = new_crv
#    curves_in.append(new_crv)
#
#
#ready_pts_out = []
#ready_params_out = []
#ready_planes_out = []
##ready_curves_out = []
#
#
##for outer curve 
#for i in range(len(points_out)):
#    #get a list of point based on i
#    pts = [pt for pt in points_out[i][i%2::2]]
#    #get a list of params based on i
#    params = [param for param in params_out[i][i%2::2]]
#    #get a list of planes based on i 
#    planes = [plane for plane in planes_out[i][i%2::2]]
#    
#    ready_pts_out.append(pts)
#    ready_params_out.append(params)
#    ready_planes_out.append(planes)
#
#
#ready_pts_in = []
#ready_params_in = []
#ready_planes_in = []
##ready_curves_in = []
#
##for inner curve 
#for i in range(len(points_in)):
#    pts = []
#    planes = []
#    params = []
#    
#    #get a list of point based on i
#    #print points_in[i]
#    points_in[i] = [pt for pt in points_in[i][i%2::2]]
#    params_in[i] = [param for param in params_in[i][i%2::2]]
#    planes_in[i] = [plane for plane in planes_in[i][i%2::2]]
#
#    for j in range(len(points_in[i])):
#        if not CheckIntersection(points_in[i][j], curves_out[i]):
#            pts.append(points_in[i][j])
#            params.append(params_in[i][j])
#            planes.append(planes_in[i][j])
#            print "we are here"
#            
#    ready_pts_in.append(pts)
#    ready_params_in.append(params)
#    ready_planes_in.append(planes)
#
#
#
#
# ---------- end python ----------

# ---- group: BRICK DIMENSIONS / length
panel_4 = Panel("31.5")  # disabled

# ---- group: BRICK DIMENSIONS / height
panel_5 = Panel("10")  # disabled

# ---- group: BRICK DIMENSIONS / width
panel_6 = Panel("15")  # disabled

# ----
number_slider_2 = Slider(10, range=1..15)  # disabled

# ---- group: BRICK PLANES
python_2 = GhPythonScript(x=python.ready_pts_in, y=python.ready_planes_in)  # -> a, b
# ---------- python_2: Python ----------
a = x
b = y
# ---------- end python_2 ----------
python_3 = GhPythonScript(x=python.ready_pts_out, y=python.ready_planes_out)  # -> a, b; same code as python_2
pln = Plane(python_3.b)
pln_2 = Plane(python_2.b)

# ----
data = Data(python.points)
dist_tolerance_2 = Slider(1.15, range=0.9..2.1)  # disabled
number_slider_3 = Slider(0.6, range=0.2..0.8)  # disabled
number_slider_4 = Slider(0.194, range=0.1..0.45)  # disabled
number_slider_5 = Slider(0.422, range=0.1..0.45)  # disabled

outer_curve_2 = Curve(<curve referenced from the Rhino model>)  # disabled
inner_curve_2 = Curve(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)  # disabled

number_slider_6 = Slider(0.01, range=0.01..0.9)  # disabled
multiplication_2 = Multiplication(A=panel_4, B=number_slider_2)  # disabled
python_4 = GhPythonScript(
    crv1=inner_curve_2,
    crv2=outer_curve_2,
    x=panel_4,
    y=panel_6,
    z=panel_5,
    gap_ratio=number_slider_6,
    reqHeight=multiplication_2,
    st_lb=number_slider_4,
    st_hb=number_slider_5,
    levels=number_slider_2,
    reductionVal=number_slider_3,
    dist_tolerance=dist_tolerance_2)  # -> out, planes_in, points_in, planes_out, points_out, crvs, ready_pts_out, ready_planes_out, ready_pts_in, ready_planes_in; inputs crv1: Curve, crv2: Curve, levels: Int32; disabled
# ---------- python_4: Python ----------
import Rhino.Geometry as rg
import copy
from ghpythonlib.components import ColourRGB



class Brick(object):
    
    
    global length
    global width
    global height
    global initialGap
    
    def __init__(self, origin, rotation = 0, color = [240, 255, 255, 255] ):
        
        self.origin = origin 
        self.param = None
        self.plane = rg.Plane.WorldXY
        #self.curve = curve
        self. rotation = 0
        self.gap = initialGap
        self.level = 0
        if self.rotation != 0:
            RotateBrick() 
        
        self.gap = 0
        self.neighbours = []
        self.color = ColourRGB(255, color[0], color[1], color[2])
        self.att_dist = None
        
    #makes an actual brick mesh from bounding box
    
    def BrickParam(self, param):
        self.param = param
        
    def BrickPlane(self, plane):
        self.plane = plane
        
    def BrickRotation(self, rotation):
        self.rotation = rotation 
        RotateBrick()
        
    def BrickGap(self, gap):
        self.gap = gap
    
    def BrickLevel(self, level):
        self.level = level
    
    def CreateBrickMesh(self):
        return rg.Mesh.CreateFromBox(rg.Box(self.plane, length, width, height), 1, 1)
        
    def RotateBrick(self):
        return 0
        


class GenericWall(object):
    
    def __init__(self, curve, st_lb, st_hb, levels = 10, currentLevel = 0):
        self.curve = curve
        self.currentLevel = currentLevel
        self.levels = levels
        self.st_lb = st_lb
        self.st_hb = st_hb
        
        self.isf = CalculateISF()
        
    def CalculateISF(self):
        trel = self.currentLevel/self.levels
        return st_lb * ( 1/self.st_lb * self.st_hb ) ** trel
    
    def NextPointCalculation(self, pt_on_curve, brick_length, gap):
        # we make a circle whose radius is half the brick length
        circle = rg.Circle(pt_on_curve, brick_length/2)
        #get intersection point and move to new point
        circleCurve = rg.ArcCurve(circle)
        events = rg.Intersect.Intersection.CurveCurve(self.curve, circleCurve, 0.001, 0.0)
        point1 = None
        if len(events) == 1:
            point1 = events[0].PointA
        else:
            point1 = events[1].PointA
        #we make a new circle with radius = gap + half brick length
        circle = rg.Circle(point1, brick_length/2 + gap)
        circleCurve = rg.ArcCurve(circle)
        events = rg.Intersect.Intersection.CurveCurve(self.curve, circleCurve, 0.001, 0.0)
        point2 = None
        if len(events) == 1:
            point2 = events[0].PointA
        else:
            point2 = events[1].PointA
        point2 = events[1].PointA
        print point2
        #we get the new point and send it back 
        return point2



class OuterWall(GenericWall):
    
    def __init__(self, curve, st_lb, st_hb, levels, currentLevel):
        GenericWall.__init__(self, curve, st_lb, st_hb, levels, currentLevel)
        
    
    def PopulateWall(self, threshold, brickLength):
        
        points = []
        #get the start point of the curve:
        point = self.curve.PointAtStart;
        points.append(points)
        while point.DistanceTo(self.curve.PointAtEnd) > threshold * brick_length:
            point = GenericWall.NextPointCalculation(point, brick_length, gap)
            points.append(point)
            
        return points
        #if the level is 0, we start with the first curve 





gap = 5
#currentLevel = 0
#for each crv divide equidistannt
#add a gap in the beginning?? (later)

#distance that triggers the combination of two curves into one
dist_tolerance *= y

crvs = []
crvs.append(crv1)
crvs.append(crv2)

current_in_crv = crv1
current_out_crv = crv2

def CalculateISF(st_lb, st_hb,levels, currentLevel):
    trel = currentLevel/levels
    return st_lb * ( 1/st_lb * st_hb ) ** trel


#function that provides the new points 
# list of points extruded 
def CreatePointsOnDome(prev_points, prev_planes, curve, st_lb, st_hb, levels, currentLevel, width, isInside):
    #we take the points, tangent and planes from prev height
    #Declare ISF for this level:
    iSF = CalculateISF(st_lb, st_hb,levels, currentLevel)
    iSF *= width
    #move based on the tangents
    i = 0
    new_points = []
    adj_new_pts = []
    new_planes = []
    new_params = []
    
    for i in range(len(prev_points)):
        #get the right direction vector
        unitizedDir = prev_planes[i].XAxis * -1
        actualDir = unitizedDir * iSF
        if isInside:
            actualDir *= reductionVal
        new_point = actualDir + prev_points[i]
        new_point.Z += z
        new_points.append(new_point)
        
    #create the Curve
    new_crv = rg.Curve.CreateInterpolatedCurve(new_points, 3)
    #get the tangents and create the new planes
    #redundant but check !!!
    adj_new_pts = new_crv.DivideEquidistant(x/2+gap/2)
    for pt in adj_new_pts:
        output = new_crv.ClosestPoint(pt,0.0001)
        if not None:
            new_params.append(output[1])
        
    for i in new_params:
        p = new_crv.PointAt(i)
        t = new_crv.TangentAt(i)
        v = rg.Vector3d.CrossProduct(t, rg.Vector3d.ZAxis)
        pn =  rg.Plane(p,v,t)
        new_planes.append(pn)
    
    return adj_new_pts, new_params, new_planes, new_crv

#def CheckIntersection(points_in_lvl, points_out_lvl, curve_in, curve_out, st_lb, st_hb, levels, currentLevel, width, dist_tolerance isInside):
#    checked_pts_in = []
#    checked_pts_out = []
#    
#    for pt in points_in_lvl
#        if curve_out.ClosestPoint(pt, dist_tolerance):
#            checked_pts_in.append(pt)

def CheckIntersection(pt, curve_out):
    print curve_out.ClosestPoint(pt, dist_tolerance)[0]
    return curve_out.ClosestPoint(pt, dist_tolerance)[0]


planes_out = []
params_out = []
points_out = []
curves_out = []

planes_in = []
params_in = []
points_in = []
curves_in = []

for crv in crvs:
    params = []
    planes = []
    points = crv.DivideEquidistant(x/2+gap/2)
    for pt in points:
        output = crv.ClosestPoint(pt,0.0001)
        if not None:
            params.append(output[1])
        
    for i in params:
        p = crv.PointAt(i)
        t = crv.TangentAt(i)

        v = rg.Vector3d.CrossProduct(t, rg.Vector3d.ZAxis)
        
        pn =  rg.Plane(p,v,t)

        planes.append(pn)
    
    if crvs.index(crv) == 0:
        planes_in.append(planes)
        params_in.append(params)
        points_in.append(points)
        curves_in.append(crv)
    
    else:
        planes_out.append(planes)
        params_out.append(params)
        points_out.append(points)
        curves_out.append(crv)

#increment the current height
#currentLevel +=1

#take each curve
#iterate of height 



#for outside Curve:
for level in range(levels-1):
    new_pts, new_params, new_planes, new_crv = CreatePointsOnDome(points_out[-1], planes_out[-1], current_out_crv, st_lb, st_hb, levels, level+1,y, False)
    points_out.append(new_pts)
    params_out.append(new_params)
    planes_out.append(new_planes)
    current_out_crv = new_crv
    curves_out.append(new_crv)
    
#for inside Curve:
for level in range(levels-1):
    new_pts, new_params, new_planes, new_crv = CreatePointsOnDome(points_in[-1], planes_in[-1], current_in_crv, st_lb, st_hb, levels, level+1,y ,True)
    points_in.append(new_pts)
    params_in.append(new_params)
    planes_in.append(new_planes)
    current_in_crv = new_crv
    curves_in.append(new_crv)


ready_pts_out = []
ready_params_out = []
ready_planes_out = []
#ready_curves_out = []


#for outer curve 
for i in range(len(points_out)):
    #get a list of point based on i
    pts = [pt for pt in points_out[i][i%2::2]]
    #get a list of params based on i
    params = [param for param in params_out[i][i%2::2]]
    #get a list of planes based on i 
    planes = [plane for plane in planes_out[i][i%2::2]]
    
    ready_pts_out.append(pts)
    ready_params_out.append(params)
    ready_planes_out.append(planes)


ready_pts_in = []
ready_params_in = []
ready_planes_in = []
#ready_curves_in = []

#for inner curve 
for i in range(len(points_in)):
    pts = []
    planes = []
    params = []
    
    #get a list of point based on i
    #print points_in[i]
    points_in[i] = [pt for pt in points_in[i][i%2::2]]
    params_in[i] = [param for param in params_in[i][i%2::2]]
    planes_in[i] = [plane for plane in planes_in[i][i%2::2]]

    for j in range(len(points_in[i])):
        if not CheckIntersection(points_in[i][j], curves_out[i]):
            pts.append(points_in[i][j])
            params.append(params_in[i][j])
            planes.append(planes_in[i][j])
            print "we are here"
            
    ready_pts_in.append(pts)
    ready_params_in.append(params)
    ready_planes_in.append(planes)
# ---------- end python_4 ----------
crv = Curve(<curve referenced from the Rhino model>)
crv_2 = Curve(<curve referenced from the Rhino model>)

# ---- group: BRICK PLANES
python_5 = GhPythonScript(x=python_4.ready_pts_in, y=python_4.ready_planes_in)  # -> a, b; disabled; same code as python_2
python_6 = GhPythonScript(x=python_4.ready_pts_out, y=python_4.ready_planes_out)  # -> a, b; disabled; same code as python_2
pln_3 = Plane(python_6.b)  # disabled
pln_4 = Plane(python_5.b)  # disabled

# ----
python_7 = GhPythonScript(curve=crv, circle=crv_2)  # -> out, a; inputs curve: Curve
# ---------- python_7: Python ----------
__author__ = "ahmed"
__version__ = "2022.11.03"

import Rhino.Geometry as rg

curve2 = rg.ArcCurve(circle)

events = rg.Intersect.Intersection.CurveCurve(curve, curve2, 0.001, 0.0)
print events[1].PointA
a = events[1].PointA
# ---------- end python_7 ----------
data_2 = Data(python_7.a)
merge = Merge(Data1=pln_3, Data2=pln_4)
prot = RotatePlane(Plane=merge, Angle=degrees("90"))

# ----
# BRICKS PREVIEW
panel_7 = Panel("2")
division = Division(A=panel_4, B=panel_7)
division_2 = Division(A=panel_5, B=panel_7)
division_3 = Division(A=panel_6, B=panel_7)
x = Panel(division)
y = Panel(division_3)
z = Panel(division_2)
vector_xyz = VectorXYZ(XComponent=x, YComponent=y, ZComponent=z)  # -> Vector, Length
box = DomainBox(Base="0,0,0", X=panel_4, Y=panel_6, Z=panel_5)
orient = Orient(Geometry=box, Source=vector_xyz.Vector, Target=prot)  # -> Geometry, Transform
preview = CustomPreview(Geometry=orient.Geometry, Material=ColourSwatch(SwatchColor=RGB(73, 200, 235)))

# ---- group: FINAL PLANES
pln_5 = Plane(prot)

# ----
crv_3 = Curve(<curve referenced from the Rhino model>)
# PLANE EDITOR
end = EndPoints(Curve=crv_3)  # -> Start, End
ln = Line(StartPoint=end.Start, EndPoint=end.End)
vec = Vector(ln)
prot_2 = RotatePlane(Plane=pln_5, Angle=degrees("-90"))
move = Move(Geometry=prot_2, Motion=vec)  # -> Geometry, Transform
Z = UnitZ(Factor=Slider(10, range=0..10))
move_2 = Move(Geometry=move.Geometry, Motion=Z)  # -> flatten(Geometry), Transform

# ---- group: FABRICATION WORKFLOW
python_8 = GhPythonScript(brick_planes=move_2.Geometry, fabricate=Button())  # -> script, vis_planes, pick_up_plane; inputs brick_planes: list of Plane, fabricate: Boolean
# ---------- python_8: Python ----------
from imp import reload
import Rhino.Geometry as rg
import simple_ur_script as ur
reload(ur)
import simple_comm as c
reload(c)
import math as m


# change these values if needed
ROBOT_IP = "192.168.10.10"
SAFE_ROBOT_ACC = 0.4
SAFE_ROBOT_VEL = 0.9
IO = 4




def tcp(script):
    script += ur.set_tcp_by_angles(0.0, 0.0, 80.0, m.radians(0.0), m.radians(180.0),m.radians(0.0))
    
    return script


def set_robot_base():
    pt_0 = rg.Point3d(-233.9,-503.5,-11.4) # base plane origin
    pt_1 = rg.Point3d(-272.9,648.2,-23.5) # point on positive x axis
    pt_2 = rg.Point3d(-729.7,-519.9,-10.4) # point on positive xy plane
    robot_base = rg.Plane(pt_0,pt_1-pt_0,pt_2-pt_0)
    return robot_base


def rhino_to_robot_space(rhino_plane):
    plane = rhino_plane.Clone()
    robot_base_plane = set_robot_base()
    rhino_matrix = rg.Transform.PlaneToPlane(rg.Plane.WorldXY,robot_base_plane)
    plane.Transform(rhino_matrix)
    return plane


def pickup_brick(script,pick_up_plane):
    planes = []
    #change the distance if needed
    SAFE_DIST = 150
    
    safe_plane = pick_up_plane.Clone()
    safe_plane.Translate(rg.Vector3d.ZAxis*SAFE_DIST)
    
    ## add to the path: go to the safe plane
    script += ur.move_l(safe_plane, SAFE_ROBOT_ACC, SAFE_ROBOT_VEL)
    planes.append(safe_plane)
    
    ## add to the path: go to the pick up plane
    script += ur.move_l(pick_up_plane, SAFE_ROBOT_ACC, SAFE_ROBOT_VEL)
    planes.append(pick_up_plane)
    
    ## add to the path: turn on the vacuum and wait 1 sec.
    script += ur.set_digital_out(IO,True)
    script += ur.sleep(1)

    # add to the path: go back to the safe_plane
    script += ur.move_l(safe_plane, SAFE_ROBOT_ACC, SAFE_ROBOT_VEL)
    planes.append(safe_plane)
    
    
    return script, planes


def place_brick(script, place_plane):
    
    planes = []
    
    SAFE_DIST = 100
    safe_plane = place_plane.Clone()
    safe_plane.Translate(rg.Vector3d.ZAxis*SAFE_DIST)
    
    # add to the path: go to the safe plane
    script += ur.move_l(safe_plane, SAFE_ROBOT_ACC, SAFE_ROBOT_VEL)
    planes.append(safe_plane)
    
    # add to the path: go to the place plane
    script += ur.move_l(place_plane, SAFE_ROBOT_ACC, SAFE_ROBOT_VEL)
    planes.append(place_plane)
    
    ## add to the path: turn off the vacuum and wait 1 second (hold the brick)
    script += ur.set_digital_out(IO,False)
    script += ur.sleep(1)
    
    # add to the path: go back to the safe plane
    script += ur.move_l(safe_plane, SAFE_ROBOT_ACC, SAFE_ROBOT_VEL)
    planes.append(safe_plane)
    
    return script,planes


def send(script):
    script = c.concatenate_script(script)
    c.send_script(script, ROBOT_IP)
    return script 


#location of a pick up station
pick_station = rg.Plane(rg.Point3d(-344.2, 306.2, -10.2), rg.Vector3d.XAxis, rg.Vector3d.YAxis)


script = ""
script = tcp(script)
vis_planes = []



# translate from rhino to robot_space and iterate through all planes
robot_planes = []

for p in brick_planes:
    r_plane = rhino_to_robot_space(p)
    robot_planes.append(r_plane)


for b_plane in robot_planes:
    
    script, p = pickup_brick(script,pick_station)
    vis_planes.extend(p) #only to visualize the planes
    
    script, p = place_brick(script,b_plane)
    vis_planes.extend(p)


if fabricate:
    send(script)
# ---------- end python_8 ----------
pln_6 = Plane(python_8.vis_planes)
