# Grasshopper definition 20221110_GenericWalls_khara.gh (Grasshopper 1.0.7)
# plug-ins: Bifocals

# ---- group: Design Part / BRICK DIMENSIONS / length
panel = Panel("31.5")

# ---- group: Design Part / BRICK DIMENSIONS / height
panel_2 = Panel("10")

# ---- group: Design Part / BRICK DIMENSIONS / width
panel_3 = Panel("15")

# ---- group: Design Part / problem still !!
number_slider = Slider(1.4, range=0.01..10)

# ---- group: Design Part
outer_curve = Curve(<curve referenced from the Rhino model>)

# ----
data = Data()

# ---- group: not used / BRICK DIMENSIONS / length
panel_4 = Panel("31.5")  # disabled

# ---- group: not used / BRICK DIMENSIONS / height
panel_5 = Panel("10")  # disabled

# ---- group: not used / BRICK DIMENSIONS / width
panel_6 = Panel("15")  # disabled

# ---- group: not used
outer_curve_2 = Curve(<curve referenced from the Rhino model>)  # disabled
inner_curve = Curve(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)  # disabled

# ---- group: not used / BASICS DICTIONARY
python = GhPythonScript()  # -> out, a, export_d; disabled
# ---------- python: Python ----------
"""
MasDfab 22-23

Python Dictionaries.
Dictionaries are used to store data values in   key:value   pairs.

"""

# initialize a dictionary (use curly brackets)
my_dictionary = {}
# or
my_dictionary = dict()

# check the type
print (type(my_dictionary))

# create a new dictionary with keys and empty lists as a value
my_d =   { "students": [] ,
            "robots": [] ,
            "chairs": [] }
#print my_d


# add a new pair of key:value to a dictionary
# "laptops" is key, True is value
# the values in dicts can be any data type: str, boolean, int, etc.
my_d["laptops"] = True
#print my_d


# if you add a new pair of key:value that already exsists, it will update it with a new value
# because dicts do not allow two values with the same key
my_d["robots"] = True, "abb", 5
my_d["students"] = "XX","YY","ZZ"
#print my_d


# delete a key from a dictionary
del my_d["chairs"]

# remove the key and return the value
print my_d.pop("robots")

print ("final version of my dictionary after changes: its length: {}, its keys: {}, its values: {}".format(len(my_d),my_d.keys(),my_d.values()))

# iterate through the dictionary through the pairs
for key,value in my_d.items():
    print key,value

# iterate through the keys
for key in my_d.keys():
    print key

# iterate through the values
for value in my_d.values():
    print value

# "A dictionary that is passed as output from a component will be seen as enumerable and will be enumerated" (c)
# which means that only the keys will be resolved
a = my_d


# you can hide it in the class if you want pass the data
class D_data:
    pass

export_d = D_data()
export_d.my_d = my_d
# ---------- end python ----------
panel_7 = Panel(python.a)  # disabled
panel_8 = Panel(python.export_d)  # disabled
python_2 = GhPythonScript(import_d=python.export_d)  # disabled
# ---------- python_2: Python ----------
a = import_d.my_d
print a
print type(import_d.my_d)
# ---------- end python_2 ----------

# ---- group: not used / BASICS JSON
python_3 = GhPythonScript()  # -> a, spheres, my_d; disabled
# ---------- python_3: Python ----------
"""
MasDfab 22-23

JSON stands for JavaScript Object Notation
JSON is a lightweight data-interchange format
JSON is plain text written in JavaScript object notation
JSON is used to send data between computers

https://realpython.com/python-json/

"""
import os
import Rhino.Geometry as rg

# to work with json files import the python module json
import json

# in python json files are represented as a string
my_json = '{"student": "Paul", "laptop": "Lenovo", "Tag": ["github", "hiking"]}'
print type(my_json)



########## ===================== JSON is the string representation of the data ================== ##############
# ======= DICTIONARIES are the actual data structures in memory that are created when the program runs ======= #


# 1.0 # how to parse a json string ?
my_json_d = json.loads(my_json)
print type(my_json_d)


# 2.0 #  how to parse a json file ?
# 2.1 #  get the file name (gh_canvas) and get the folder directory (folder)
gh_canvas = ghenv.Component.OnPingDocument()
folder = os.path.dirname(gh_canvas.FilePath)


# 2.3 # "with open()" allows for opening and closing the file after the block inside of statement is exited.
with open(os.path.join(folder,'simple_spheres.json')) as file:
    
    # 2.4 # json.load() converts json string to dictionary 
    my_d = json.load(file)


spheres = []

rr = my_d['radius']
xx = my_d['originX']
yy = my_d['originY']
zz = my_d['originZ']

for r,x,y,z in zip(rr,xx,yy,zz):
    s = rg.Sphere(rg.Point3d(x,y,z), r)
    spheres.append(s)


# 3.0 # how to write a json file?
# 3.1 # create a random dictionary my_d2
my_d2 = {"module": ["mola", "axolotl", "grasshopper"], "robots" : ["abb", "ur5", "ur10"], "numbers": [1,2,3,4,5]}


# 3.2 # 'w' - stands for 'write' - is a specification of the mode when opening the file, it will open a file for writing or create a new one if it does not exist.
with open(os.path.join(folder,'my_first_jfile.json'), 'w') as file:
    
    # 3.3 #  use the method json.dump() - it converts dictionary to a json string
    my_j = json.dump(my_d2, file, indent = 2)
# ---------- end python_3 ----------
panel_9 = Panel(python_3.my_d)  # disabled
brep = Brep(python_3.spheres)  # disabled

# ---- group: not used / LOAD JSON FILE
button = Button()  # disabled
python_4 = GhPythonScript(load=button)  # -> my_d, a; disabled
# ---------- python_4: Python ----------
import os
import sys
import compas

canvas = ghenv.Component.OnPingDocument()
folder = os.path.dirname(canvas.FilePath)

if load:
    my_d = compas.json_load(os.path.join(folder, 'simple_bricks.json'))
    a = my_d["boxes"]
# ---------- end python_4 ----------

# ---- group: not used / BASIC GEO + COMPAS + JSON
number_slider_2 = Slider(9.6, range=0..10)  # disabled
number_slider_3 = Slider(4.1, range=0..10)  # disabled
number_slider_4 = Slider(47, range=0..100)  # disabled
number_slider_5 = Slider(4.7, range=0..10)  # disabled
button_2 = Button()  # disabled
crv = Curve(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)  # disabled
python_5 = GhPythonScript(crv=crv, count=number_slider_4, length=number_slider_2, width=number_slider_5, height=number_slider_3, save=button_2)  # -> out, origin_frames, pick_frames, bricks; inputs crv: Curve, length: Int32, width: Int32, height: Int32, save: Boolean; disabled
# ---------- python_5: Python ----------
"""
MasDfab 22-23

Example of basic compas geometry and json 

"""

import os
import sys
import Rhino.Geometry as rg
import compas

from compas_rhino import conversions as c
from compas.geometry import Frame, Vector, Box
from compas.geometry import Translation

# get the gh_file name(gh_canvas) and folder directory(folder) where we will store the file
gh_canvas = ghenv.Component.OnPingDocument()
folder = os.path.dirname(gh_canvas.FilePath)

# dividing the curve by count, return the curve params
params = crv.DivideByCount(count,True)
planes = []


for i in params:
    
    p = crv.PointAt(i)
    t = crv.TangentAt(i)
    
    v = rg.Vector3d.CrossProduct(t, rg.Vector3d(0,0,1))
    
    p =  rg.Plane(p,t,v)

    planes.append(p)



# using compas in-built method to transform rhino planes into compas frames
origin_frames = [c.plane_to_compas_frame(p) for p in planes]

# define translation 
T = Translation.from_vector(Vector(0,0,height/2))

# apply translation to origin frames
pick_frames = [f.transformed(T) for f in origin_frames]

# create a compas mesh (Box)
bricks = [ Box(f,length,width,height) for f in origin_frames]

# creating a dictionary and exporting the json file 
if save:
    compas.json_dump({"p_frames":[ p for p in pick_frames], "boxes": [ b for b in bricks]}, 
                    os.path.join(folder, 'simple_bricks.json'),
                    pretty = True)
# ---------- end python_5 ----------
draw = Draw(cg=python_4.a)  # -> rg; disabled
#   port cg: The COMPAS geometry or datastructure to be drawn.
#   port rg: The Rhino geometry object.
# ---------- draw: Python ----------
"""
Draws COMPAS geometry in Grasshopper.
"""
from ghpythonlib.componentbase import executingcomponent as component

from compas.artists import Artist


class CompasToRhinoGeometry(component):
    def RunScript(self, cg):
        if not cg:
            return None

        return Artist(cg).draw()
# ---------- end draw ----------
panel_10 = Panel(python_4.my_d)  # disabled
panel_11 = Panel(python_4.a)  # disabled
draw_2 = Draw(cg=[python_5.origin_frames, python_5.pick_frames, python_5.bricks])  # -> rg; disabled; same code as draw

# ---- group: Design Part
number_slider_6 = Slider(15, range=1..15)
number_slider_7 = Slider(15, range=1..15)
dist_tolerance = Slider(1.13, range=0.9..2.1)
dist_tolerance_2 = Slider(1.13, range=0.9..2.1)
multiplication = Multiplication(A=panel, B=number_slider_6)
multiplication_2 = Multiplication(A="31.5", B=number_slider_7)
inner_curve_2 = Curve(<curve referenced from the Rhino model>)
inner_curve_3 = Curve(<curve referenced from the Rhino model>)
python_6 = GhPythonScript(
    crv1=inner_curve_2,
    crv2=outer_curve,
    length=panel,
    width=panel_3,
    height=panel_2,
    gap_ratio=Slider(0.13, range=0.01..0.9),
    threshold=number_slider,
    reqHeight=multiplication,
    st_lb=Slider(0.1, range=0.1..0.45),
    st_hb=Slider(0.381, range=0.1..0.45),
    levels=number_slider_6,
    reductionVal=Slider(0.36, range=0.2..0.8),
    dist_tolerance=dist_tolerance)  # -> out, allbricks, bricks_mesh, curves, graft(brick_planes); inputs crv1: Curve, crv2: Curve, levels: Int32
# ---------- python_6: Python ----------
#pendings: add a check that makes sure that the new brick passes a distance equals previous bricks and a distance


import Rhino.Geometry as rg
import copy
from ghpythonlib.components import ColourRGB
import math



class Brick(object):
    
    
    global length 
    global width
    global height
    
    def __init__(self, origin, rotation = 0, color = [240, 255, 255, 255] ):
        
        self.origin = origin 
        self.param = None
        self.plane = None
        #self.curve = curve
        self. rotation = 0
        self.gap = gap_ratio * length
        self.level = 0
        self.group = None
        #means that the plane os
        self.untouchable = False
        self.placed = True
        #number for the code of the brick
        self.id = None
        self.mesh = None
        self.box = None
        self.length = length
        self.width = width
        self.height = height
        if self.rotation != 0:
            RotateBrick() 
        
        self.neighbours = []
        self.color = ColourRGB(255, color[0], color[1], color[2])
        self.att_dist = None
        
    #makes an actual brick mesh from bounding box
    
    def BrickParam(self, param):
        self.param = param
        
    
    def CreateBrickMesh(self):
        self.box = rg.Box(self.plane, rg.Interval(-length/2, length/2),
                                        rg.Interval(-width/2, width/2),
                                        rg.Interval(0, height))
        self.mesh = rg.Mesh.CreateFromBox(self.box, 1, 1, 1)
        return self.mesh
        
    def RotateBrick(self):
        return 0
    
    #checks if the plane could be removed or not 
    def AddPlane(self, plane):
        unit_vect = rg.Vector3d.CrossProduct(plane.XAxis, plane.YAxis)
        if unit_vect * rg.Vector3d.ZAxis < 0: #then flip the plane 180 degrees around the x axis
            rg.Plane.Rotate(plane, math.radians(180), plane.XAxis)
        self.plane = plane


class GenericWall(object):
    
    def __init__(self, curve, st_lb, st_hb, levels = 10, currentLevel = 0):
        self.curve = curve
        self.curves = []
        self.curves.append(curve)
        self.currentLevel = currentLevel
        self.levels = levels
        self.st_lb = st_lb
        self.st_hb = st_hb
        
        #self.isf = CalculateISF()
        
    def CalculateISF(self):
        trel = self.currentLevel/self.levels
        return st_lb * ( 1/self.st_lb * self.st_hb ) ** trel
    
    





class OuterWall(GenericWall):
    
    def __init__(self, curve, st_lb, st_hb, levels, currentLevel):
        GenericWall.__init__(self, curve, st_lb, st_hb, levels, currentLevel)
        
    def NextPointCalculation(self, pt_on_curve, brick_length, gap):
        # we make a circle whose radius is half the brick length
        circle = rg.Circle(pt_on_curve, brick_length/2)
        #get intersection point and move to new point
        circleCurve = rg.ArcCurve(circle)
        events = rg.Intersect.Intersection.CurveCurve(self.curve, circleCurve, 0.001, 0.0)
        index = events.Count
        point1 = events[index-1].PointA
        #we make a new circle with radius = gap + half brick length
        circle = rg.Circle(point1, brick_length/2 + gap)
        circleCurve = rg.ArcCurve(circle)
        events = rg.Intersect.Intersection.CurveCurve(self.curve, circleCurve, 0.001, 0.0)
        index = events.Count
        point2 = events[index-1].PointA
        return point2 
    
    def PopulateLevel(self, threshold, brick_length, level):
        
        bricks = []
        #get the start point of the curve:
        point = self.curve.PointAtStart
        tPt = self.curve.ClosestPoint(point,0.0001)[1]
        tEnd = self.curve.ClosestPoint(self.curve.PointAtEnd,0.0001)[1] 
        i = 0 
        tSegmentLength = self.curve.LengthParameter(threshold * brick_length)[1]
        tSafetyFactor = self.curve.LengthParameter(brick_length)[1] * 0.5 ##hardcoded!!!!
        while tPt < tEnd - tSegmentLength:
            point = self.NextPointCalculation(point, brick_length, gap_ratio * length)
            #print point
            #populate point on curve
            tSuspect = self.curve.ClosestPoint(point,0.0001)[1]
            if tSuspect - tPt > tSafetyFactor: ###Hardcoded!!!
                tPt = tSuspect
                brick = Brick(point)
                brick.origin = self.curve.PointAt(tPt)
                brick.AddPlane(self.curve.FrameAt(tPt)[1])
                brick.level = level
                bricks.append(brick)
                i += 1
            else: 
                break
            
        #print bricks
        return bricks
        #if the level is 0, we start with the first curve 
        
    #changes the value of the indentation based on ISF 
    def ChangeNextLevelPositions(self, bricks, precision = 50):
        points = []
        #Calculatre iSF
        iSF = self.CalculateISF()
        # iterate over all bricks and move them to the right place
        tEnd = self.curve.ClosestPoint(self.curve.PointAtEnd,0.0001)[1] 
        for i in range(precision):
            if i != 0:
                t = (i * tEnd) / precision
                p = self.curve.PointAt(t)
                t1 = self.curve.TangentAt(t)
                v = rg.Vector3d.CrossProduct(t1, rg.Plane.WorldXY.ZAxis * -1)
                movementX = v * iSF * width
                movementZ = rg.Vector3d.ZAxis * height
                points.append(p + movementX + movementZ)
        new_crv = rg.NurbsCurve.Create(False, 3, points)
        new_crv = rg.Curve.CreateInterpolatedCurve(points, 3)
        #print new_crv.NormalizedLengthParameter(1.0)
        #print new_crv.GetLength()
        #print tEnd
        self.curve = new_crv
        self.curves.append(new_crv)

        
    def PopulateWall(self, threshold, brick_length, levels):
        allBricks = []
        for level in range(levels):
            self.currentLevel = level
            bricks = self.PopulateLevel(threshold, brick_length, level)
            self.ChangeNextLevelPositions(bricks)
            allBricks.append(bricks) 
            
        return allBricks

new_wall_khara = OuterWall(crv1,st_lb, st_hb, levels, 0)
allbricks = new_wall_khara.PopulateWall(threshold, length, levels)
bricks_mesh = []
brick_planes = []
#print allbricks
curves = new_wall_khara.curves
#print curves
for brickList in allbricks:
    for brick in brickList:
        bricks_mesh.append(brick.CreateBrickMesh())
        brick_planes.append(brick.plane)
# ---------- end python_6 ----------
not_updated = GhPythonScript(
    crv1=inner_curve_3,
    length="31.5",
    width="15",
    height="10",
    gap_ratio=Slider(0.13, range=0.01..0.9),
    threshold=Slider(1.4, range=0.01..10),
    reqHeight=multiplication_2,
    st_lb=Slider(0.1, range=0.1..0.45),
    st_hb=Slider(0.381, range=0.1..0.45),
    levels=number_slider_7,
    reductionVal=Slider(0.36, range=0.2..0.8),
    dist_tolerance=dist_tolerance_2)  # -> out, allbricks, bricks_mesh, curves; inputs crv1: Curve, crv2: Curve, levels: Int32; same code as python_6
data_2 = Data(not_updated.bricks_mesh)
data_3 = Data(not_updated.allbricks)
data_4 = Data(python_6.bricks_mesh)
data_5 = Data(python_6.allbricks)
python_7 = GhPythonScript(x=data_3)  # -> a, b
# ---------- python_7: Python ----------
a = x
b = y
# ---------- end python_7 ----------
bricks = Data(flatten(python_7.a))

# ---- group: Design Part / BRICK PLANES
python_8 = GhPythonScript()  # -> a, b; same code as python_7
python_9 = GhPythonScript(x=data_5)  # -> a, b; same code as python_7
pln = Plane(python_8.b)

# ----
data_6 = Data(python_6.brick_planes)
data_7 = Data(python_6.curves)

# ---- group: Design Part (continued)
bricks_2 = Data(flatten(python_9.a))
python_10 = GhPythonScript(p1=bricks_2, p3=bricks, percent_incomplete=Slider(0.02, range=0..1))  # -> out, all_bricks; inputs p1: list, p3: list
# ---------- python_10: Python ----------
import Rhino.Geometry as rg
from ghpythonlib import treehelpers 
#from scriptcontext import sticky as st
from copy import deepcopy
import math 
import os
import Rhino.Geometry as rg
import json

all_bricks = []
p1_bricks = []
brick_id = 0 
a = []
# werid gh way of acessing lists
for brick in p1:
    brick.group = "p1"
    brick.id = brick_id
    brick_id+= 1
    #print brick.id

for brick in p3:
    brick.group = "p3"
    #print brick.group
    brick.id = brick_id
    brick_id+= 1
    #print brick.id

#reverse list to get the last mounted bricks
p1_reverse = deepcopy(p1)
p1_reverse.reverse()

p3_reverse = deepcopy(p3)
p3_reverse.reverse()
print len(p3_reverse)
print len(p1_reverse)

#declare remaining list 
unplaced_p1 = []
unplaced_p3 = []

#get percentage of bricks and apply it to all bricks 
total_p1 = len(p1_reverse)
deleted_perc_p1 = total_p1 * percent_incomplete

total_p3 = len(p3_reverse)
deleted_perc_p3 = total_p3 * percent_incomplete

for i in range(int(deleted_perc_p1)):
    brick = p1_reverse.pop(0)
    brick.placed = False
    unplaced_p1.append(brick)
    a.append(brick.mesh)

for i in range(int(deleted_perc_p3)):
    brick = p3_reverse.pop(0)
    brick.placed = False
    print brick.id
    unplaced_p3.append(brick)
    a.append(brick.mesh)
    
#### copy the data to json file
# get the file name (gh_canvas) and get the folder directory (folder)
gh_canvas = ghenv.Component.OnPingDocument()
folder = os.path.dirname(gh_canvas.FilePath)

#create a dictionary containing all the list numbers
bricks_id_dict = {}
bricks_id_dict =   { "p1": [brick.id for brick in p1_reverse] ,
            "p3" : [brick.id for brick in p3_reverse] ,
            "p1_unplaced": [brick.id for brick in unplaced_p1],
            "p3_unplaced": [brick.id for brick in unplaced_p3]}
            


with open(os.path.join(folder,'bricks.json'), 'w') as file:
    # use the method json.dump() - it converts dictionary to a json string
    my_j = json.dump(bricks_id_dict, file, indent = 2)

all_bricks.extend(p1)
all_bricks.extend(p3)
# ---------- end python_10 ----------

# ----
python_11 = GhPythonScript(x=python_10.all_bricks)  # -> out, a
# ---------- python_11: Python ----------
a = x
# ---------- end python_11 ----------
data_8 = Data(python_11.a)
python_12 = GhPythonScript(
    all_bricks=data_8,
    input=Slider(5, range=0..20),
    direction_prob=Slider(0.26, range=0..1),
    variable=Slider(220, range=144..450))  # -> out, bricks, studied_brick, box, color, result, brick_p1, brick_p3; inputs all_bricks: list, variable: Int32
# ---------- python_12: Python ----------
###This is the start of the decaying part in which we start 

import os
import Rhino.Geometry as rg
# to work with json files import the python module json
import json
from copy import deepcopy
import math
from ghpythonlib.components import ColourRGB
import random

#####################Functions############################################################
# Check if Naked brick !!!!

#function that measures the inclusion of a point within an area
def IsIncluded(point, origin, maxDistance):
    vector = point - origin
    vector2d = rg.Vector2d(vector.X, vector.Y)
    if vector2d.Length < maxDistance:
        return True
    else:
        return False

#this funcitons checks if there is a brick thatis a candidate to be picked up by the robot and taken elsewhere
def CheckNakedBrickUp(studied_brick, brickList):
    bricks = []
    studied_box = None
    #until proven otherwise
    isNaked = True
    #print studied_brick.level
    for brick in brickList:
        if brick.level == studied_brick.level +1:
            if brick.origin.DistanceTo(studied_brick.origin) < 2 * brick.length:
                #get a deep copy of the studied box
                studied_box = deepcopy(studied_brick.box)
                furthest_pt = studied_box.PointAt(1,1,0)
                xMax = abs(furthest_pt.X - studied_brick.origin.X)
                yMax = abs(furthest_pt.Y - studied_brick.origin.Y)
                maxDistance = rg.Point2d.DistanceTo(rg.Point2d(xMax,yMax), rg.Point2d.Origin)
                corners = brick.box.GetCorners()
                for corner in corners:
                    bool = IsIncluded(corner, studied_brick.origin, maxDistance)
                    if bool:
                        isNaked = False
                        break
        if isNaked == False:
            break
    return isNaked

###Not right should be checked in a more accurate way !!!!!!!!
#this funcitons checks if there is a brick thatis a candidate to be picked up by the robot and taken elsewhere
def CheckPlacedBrickDown(studied_brick, brickList):
    bricks = []
    studied_box = None
    #until proven otherwise
    isSafe = False
    #print studied_brick.level
    for brick in brickList:
        if brick.level == studied_brick.level - 1: ### !!!
            if brick.origin.DistanceTo(studied_brick.origin) < 2 * brick.length:
                #get a deep copy of the studied box
                studied_box = deepcopy(studied_brick.box)
                furthest_pt = studied_box.PointAt(1,1,0)
                xMax = abs(furthest_pt.X - studied_brick.origin.X)
                yMax = abs(furthest_pt.Y - studied_brick.origin.Y)
                maxDistance = rg.Point2d.DistanceTo(rg.Point2d(xMax,yMax), rg.Point2d.Origin)
                corners = brick.box.GetCorners()
                for corner in corners:
                    bool = IsIncluded(corner, studied_brick.origin, maxDistance)
                    if bool:
                        isSafe = True
                        break
        if isSafe == True:
            break
    return isSafe

#builds on the previous function and generates the list of bricks
def CollectNakedBricks(brickList):
    nakedBricks = []
    for brick in brickList:
        if CheckNakedBrickUp(brick, brickList):
            nakedBricks.append(brick)

#check all both placed brick lists for possibility of game finish:
def CheckGameScenarioFinishorPickBricks(p1_bricks, p3_bricks):
    isP1_untouchable = True
    isP3_untouchable = True
    for brick in p1_bricks: 
        if brick.untouchable == False:
            isP1_untouchable = False
            break
            
    for brick in p3_bricks: 
        if brick.untouchable == False:
            isP3_untouchable = False
            break

    if not isP1_untouchable and isP3_untouchable:
        return 0
        
    elif isP1_untouchable and not isP3_untouchable:
        return 1
    elif not isP1_untouchable and not isP3_untouchable:
        if random.random() < direction_prob:
            return 0
        else:
            return 1
    else: 
        #game is terminated
        return None

#####################Procedurul Code############################################################
# how to parse a json file ?
# get the file name (gh_canvas) and get the folder directory (folder)
gh_canvas = ghenv.Component.OnPingDocument()
folder = os.path.dirname(gh_canvas.FilePath)

#"with open()" allows for opening and closing the file after the block inside of statement is exited.
with open(os.path.join(folder,'bricks.json')) as file:
    # 2.4 # json.load() converts json string to dictionary 
    bricks_dict = json.load(file)
    
###get the placed bricks, and the unplaced bricks for p1 and p3 
p1_bricks = []
p3_bricks = []
p1_unplaced = []
p3_unplaced = []

for brick in all_bricks:
    if brick.id in bricks_dict["p1"]:
        p1_bricks.append(brick)
        #a.append(brick.mesh)
    elif brick.id in bricks_dict["p3"]:
        p3_bricks.append(brick)
        #b.append(brick.mesh)
    elif brick.id in bricks_dict["p1_unplaced"]:
        p1_unplaced.append(brick)
        #c.append(brick.mesh)
    else:
        p3_unplaced.append(brick)
        #d.append(brick.mesh)
        

###Check for game termination
 
result = CheckGameScenarioFinishorPickBricks(p1_bricks, p3_bricks)


if result is None:
     pass
elif result == 0: #from right to left
    #check p3 and pick a brick from it and select the potential place from p1
    pass
elif result == 1:
    #check p1 and pick a brick from it and select the potential place from p3
    pass

#missing: 
#1. need to iterate over the list of the other side (make a function)
#2. need to test and debug the remaining functions
#3. need to makek a list that makes a list of lists combine together based on level !! (grasshopper!!)
#studied_brick = p1_bricks[variable].mesh
#if boolBrick:
#    color = ColourRGB(255,255,255,255)
#else:
#    color = ColourRGB(255,0,255,0)

#
#p1 = []
#
#for brick in p1_bricks:
#    p1.append(brick.mesh)
#
# ---------- end python_12 ----------
python_13 = GhPythonScript(x=python_12.box)  # -> out, a; same code as python_11
data_9 = Data(python_12.bricks)
data_10 = Data(python_12.studied_brick)
data_11 = Data(python_13.a)
preview = CustomPreview(Geometry=python_12.studied_brick, Material=python_12.color)

# ---- group: not used
number_slider_8 = Slider(10, range=1..15)  # disabled
dist_tolerance_3 = Slider(1.15, range=0.9..2.1)  # disabled
number_slider_9 = Slider(0.6, range=0.2..0.8)  # disabled
number_slider_10 = Slider(0.194, range=0.1..0.45)  # disabled
number_slider_11 = Slider(0.422, range=0.1..0.45)  # disabled
number_slider_12 = Slider(0.01, range=0.01..0.9)  # disabled
multiplication_3 = Multiplication(A=panel_4, B=number_slider_8)  # disabled
python_14 = GhPythonScript(
    crv1=inner_curve,
    crv2=outer_curve_2,
    x=panel_4,
    y=panel_6,
    z=panel_5,
    gap_ratio=number_slider_12,
    reqHeight=multiplication_3,
    st_lb=number_slider_10,
    st_hb=number_slider_11,
    levels=number_slider_8,
    reductionVal=number_slider_9,
    dist_tolerance=dist_tolerance_3)  # -> out, planes_in, points_in, planes_out, points_out, crvs, ready_pts_out, ready_planes_out, ready_pts_in, ready_planes_in; inputs crv1: Curve, crv2: Curve, levels: Int32; disabled
# ---------- python_14: Python ----------
import Rhino.Geometry as rg
import copy
from ghpythonlib.components import ColourRGB



class Brick(object):
    
    
    global length
    global width
    global height
    global initialGap
    
    def __init__(self, origin, rotation = 0, color = [240, 255, 255, 255] ):
        
        self.origin = origin 
        self.param = None
        self.plane = rg.Plane.WorldXY
        #self.curve = curve
        self. rotation = 0
        self.gap = initialGap
        self.level = 0
        if self.rotation != 0:
            RotateBrick() 
        
        self.gap = 0
        self.neighbours = []
        self.color = ColourRGB(255, color[0], color[1], color[2])
        self.att_dist = None
        
    #makes an actual brick mesh from bounding box
    
    def BrickParam(self, param):
        self.param = param
        
    def BrickPlane(self, plane):
        self.plane = plane
        
    def BrickRotation(self, rotation):
        self.rotation = rotation 
        RotateBrick()
        
    def BrickGap(self, gap):
        self.gap = gap
    
    def BrickLevel(self, level):
        self.level = level
    
    def CreateBrickMesh(self):
        return rg.Mesh.CreateFromBox(rg.Box(self.plane, length, width, height), 1, 1)
        
    def RotateBrick(self):
        return 0
        


class GenericWall(object):
    
    def __init__(self, curve, st_lb, st_hb, levels = 10, currentLevel = 0):
        self.curve = curve
        self.currentLevel = currentLevel
        self.levels = levels
        self.st_lb = st_lb
        self.st_hb = st_hb
        
        self.isf = CalculateISF()
        
    def CalculateISF(self):
        trel = self.currentLevel/self.levels
        return st_lb * ( 1/self.st_lb * self.st_hb ) ** trel
    
    def NextPointCalculation(self, pt_on_curve, brick_length, gap):
        # we make a circle whose radius is half the brick length
        circle = rg.Circle(pt_on_curve, brick_length/2)
        #get intersection point and move to new point
        circleCurve = rg.ArcCurve(circle)
        events = rg.Intersect.Intersection.CurveCurve(self.curve, circleCurve, 0.001, 0.0)
        point1 = None
        if len(events) == 1:
            point1 = events[0].PointA
        else:
            point1 = events[1].PointA
        #we make a new circle with radius = gap + half brick length
        circle = rg.Circle(point1, brick_length/2 + gap)
        circleCurve = rg.ArcCurve(circle)
        events = rg.Intersect.Intersection.CurveCurve(self.curve, circleCurve, 0.001, 0.0)
        point2 = None
        if len(events) == 1:
            point2 = events[0].PointA
        else:
            point2 = events[1].PointA
        point2 = events[1].PointA
        print point2
        #we get the new point and send it back 
        return point2



class OuterWall(GenericWall):
    
    def __init__(self, curve, st_lb, st_hb, levels, currentLevel):
        GenericWall.__init__(self, curve, st_lb, st_hb, levels, currentLevel)
        
    
    def PopulateWall(self, threshold, brickLength):
        
        points = []
        #get the start point of the curve:
        point = self.curve.PointAtStart;
        points.append(points)
        while point.DistanceTo(self.curve.PointAtEnd) > threshold * brick_length:
            point = GenericWall.NextPointCalculation(point, brick_length, gap)
            points.append(point)
            
        return points
        #if the level is 0, we start with the first curve 





gap = 5
#currentLevel = 0
#for each crv divide equidistannt
#add a gap in the beginning?? (later)

#distance that triggers the combination of two curves into one
dist_tolerance *= y

crvs = []
crvs.append(crv1)
crvs.append(crv2)

current_in_crv = crv1
current_out_crv = crv2

def CalculateISF(st_lb, st_hb,levels, currentLevel):
    trel = currentLevel/levels
    return st_lb * ( 1/st_lb * st_hb ) ** trel


#function that provides the new points 
# list of points extruded 
def CreatePointsOnDome(prev_points, prev_planes, curve, st_lb, st_hb, levels, currentLevel, width, isInside):
    #we take the points, tangent and planes from prev height
    #Declare ISF for this level:
    iSF = CalculateISF(st_lb, st_hb,levels, currentLevel)
    iSF *= width
    #move based on the tangents
    i = 0
    new_points = []
    adj_new_pts = []
    new_planes = []
    new_params = []
    
    for i in range(len(prev_points)):
        #get the right direction vector
        unitizedDir = prev_planes[i].XAxis * -1
        actualDir = unitizedDir * iSF
        if isInside:
            actualDir *= reductionVal
        new_point = actualDir + prev_points[i]
        new_point.Z += z
        new_points.append(new_point)
        
    #create the Curve
    new_crv = rg.Curve.CreateInterpolatedCurve(new_points, 3)
    #get the tangents and create the new planes
    #redundant but check !!!
    adj_new_pts = new_crv.DivideEquidistant(x/2+gap/2)
    for pt in adj_new_pts:
        output = new_crv.ClosestPoint(pt,0.0001)
        if not None:
            new_params.append(output[1])
        
    for i in new_params:
        p = new_crv.PointAt(i)
        t = new_crv.TangentAt(i)
        v = rg.Vector3d.CrossProduct(t, rg.Vector3d.ZAxis)
        pn =  rg.Plane(p,v,t)
        new_planes.append(pn)
    
    return adj_new_pts, new_params, new_planes, new_crv

#def CheckIntersection(points_in_lvl, points_out_lvl, curve_in, curve_out, st_lb, st_hb, levels, currentLevel, width, dist_tolerance isInside):
#    checked_pts_in = []
#    checked_pts_out = []
#    
#    for pt in points_in_lvl
#        if curve_out.ClosestPoint(pt, dist_tolerance):
#            checked_pts_in.append(pt)

def CheckIntersection(pt, curve_out):
    print curve_out.ClosestPoint(pt, dist_tolerance)[0]
    return curve_out.ClosestPoint(pt, dist_tolerance)[0]


planes_out = []
params_out = []
points_out = []
curves_out = []

planes_in = []
params_in = []
points_in = []
curves_in = []

for crv in crvs:
    params = []
    planes = []
    points = crv.DivideEquidistant(x/2+gap/2)
    for pt in points:
        output = crv.ClosestPoint(pt,0.0001)
        if not None:
            params.append(output[1])
        
    for i in params:
        p = crv.PointAt(i)
        t = crv.TangentAt(i)

        v = rg.Vector3d.CrossProduct(t, rg.Vector3d.ZAxis)
        
        pn =  rg.Plane(p,v,t)

        planes.append(pn)
    
    if crvs.index(crv) == 0:
        planes_in.append(planes)
        params_in.append(params)
        points_in.append(points)
        curves_in.append(crv)
    
    else:
        planes_out.append(planes)
        params_out.append(params)
        points_out.append(points)
        curves_out.append(crv)

#increment the current height
#currentLevel +=1

#take each curve
#iterate of height 



#for outside Curve:
for level in range(levels-1):
    new_pts, new_params, new_planes, new_crv = CreatePointsOnDome(points_out[-1], planes_out[-1], current_out_crv, st_lb, st_hb, levels, level+1,y, False)
    points_out.append(new_pts)
    params_out.append(new_params)
    planes_out.append(new_planes)
    current_out_crv = new_crv
    curves_out.append(new_crv)
    
#for inside Curve:
for level in range(levels-1):
    new_pts, new_params, new_planes, new_crv = CreatePointsOnDome(points_in[-1], planes_in[-1], current_in_crv, st_lb, st_hb, levels, level+1,y ,True)
    points_in.append(new_pts)
    params_in.append(new_params)
    planes_in.append(new_planes)
    current_in_crv = new_crv
    curves_in.append(new_crv)


ready_pts_out = []
ready_params_out = []
ready_planes_out = []
#ready_curves_out = []


#for outer curve 
for i in range(len(points_out)):
    #get a list of point based on i
    pts = [pt for pt in points_out[i][i%2::2]]
    #get a list of params based on i
    params = [param for param in params_out[i][i%2::2]]
    #get a list of planes based on i 
    planes = [plane for plane in planes_out[i][i%2::2]]
    
    ready_pts_out.append(pts)
    ready_params_out.append(params)
    ready_planes_out.append(planes)


ready_pts_in = []
ready_params_in = []
ready_planes_in = []
#ready_curves_in = []

#for inner curve 
for i in range(len(points_in)):
    pts = []
    planes = []
    params = []
    
    #get a list of point based on i
    #print points_in[i]
    points_in[i] = [pt for pt in points_in[i][i%2::2]]
    params_in[i] = [param for param in params_in[i][i%2::2]]
    planes_in[i] = [plane for plane in planes_in[i][i%2::2]]

    for j in range(len(points_in[i])):
        if not CheckIntersection(points_in[i][j], curves_out[i]):
            pts.append(points_in[i][j])
            params.append(params_in[i][j])
            planes.append(planes_in[i][j])
            print "we are here"
            
    ready_pts_in.append(pts)
    ready_params_in.append(params)
    ready_planes_in.append(planes)
# ---------- end python_14 ----------
panel_12 = Panel("90")  # disabled
python_15 = GhPythonScript()  # -> a, spheres, my_d; disabled; same code as python_3

# ---- group: not used / BRICK PLANES
python_16 = GhPythonScript(x=python_14.ready_pts_in, y=python_14.ready_planes_in)  # -> a, b; disabled; same code as python_7
python_17 = GhPythonScript(x=python_14.ready_pts_out, y=python_14.ready_planes_out)  # -> a, b; disabled; same code as python_7
pln_2 = Plane(python_17.b)  # disabled
pln_3 = Plane(python_16.b)  # disabled

# ---- group: not used (continued)
merge = Merge(Data1=pln_2, Data2=pln_3)  # disabled
prot = RotatePlane(Plane=merge, Angle=degrees(panel_12))  # disabled

# BRICKS PREVIEW
panel_13 = Panel("2")  # disabled
division = Division(A=panel_4, B=panel_13)  # disabled
division_2 = Division(A=panel_5, B=panel_13)  # disabled
division_3 = Division(A=panel_6, B=panel_13)  # disabled
x = Panel(division)  # disabled
y = Panel(division_3)  # disabled
z = Panel(division_2)  # disabled
panel_14 = Panel("0,0,0")  # disabled
vector_xyz = VectorXYZ(XComponent=x, YComponent=y, ZComponent=z)  # -> Vector, Length; disabled
box = DomainBox(Base=panel_14, X=panel_4, Y=panel_6, Z=panel_5)  # disabled
orient = Orient(Geometry=box, Source=vector_xyz.Vector, Target=prot)  # -> Geometry, Transform; disabled
swatch = ColourSwatch(SwatchColor=RGB(73, 200, 235))  # disabled
preview_2 = CustomPreview(Geometry=orient.Geometry, Material=swatch)  # disabled

# ---- group: not used / FINAL PLANES
pln_4 = Plane(prot)  # disabled

# ---- group: not used
crv_2 = Curve(<curve referenced from the Rhino model>)  # disabled
# PLANE EDITOR
end = EndPoints(Curve=crv_2)  # -> Start, End; disabled
ln = Line(StartPoint=end.Start, EndPoint=end.End)  # disabled
vec = Vector(ln)  # disabled
panel_15 = Panel("-90")  # disabled
number_slider_13 = Slider(10, range=0..10)  # disabled
prot_2 = RotatePlane(Plane=pln_4, Angle=degrees(panel_15))  # disabled
move = Move(Geometry=prot_2, Motion=vec)  # -> Geometry, Transform; disabled
Z = UnitZ(Factor=number_slider_13)  # disabled
move_2 = Move(Geometry=move.Geometry, Motion=Z)  # -> flatten(Geometry), Transform; disabled

# ---- group: not used / FABRICATION WORKFLOW
button_3 = Button()  # disabled
python_18 = GhPythonScript(brick_planes=move_2.Geometry, fabricate=button_3)  # -> script, vis_planes, pick_up_plane; inputs brick_planes: list of Plane, fabricate: Boolean; disabled
# ---------- python_18: Python ----------
from imp import reload
import Rhino.Geometry as rg
import simple_ur_script as ur
reload(ur)
import simple_comm as c
reload(c)
import math as m


# change these values if needed
ROBOT_IP = "192.168.10.10"
SAFE_ROBOT_ACC = 0.4
SAFE_ROBOT_VEL = 0.9
IO = 4




def tcp(script):
    script += ur.set_tcp_by_angles(0.0, 0.0, 80.0, m.radians(0.0), m.radians(180.0),m.radians(0.0))
    
    return script


def set_robot_base():
    pt_0 = rg.Point3d(-233.9,-503.5,-11.4) # base plane origin
    pt_1 = rg.Point3d(-272.9,648.2,-23.5) # point on positive x axis
    pt_2 = rg.Point3d(-729.7,-519.9,-10.4) # point on positive xy plane
    robot_base = rg.Plane(pt_0,pt_1-pt_0,pt_2-pt_0)
    return robot_base


def rhino_to_robot_space(rhino_plane):
    plane = rhino_plane.Clone()
    robot_base_plane = set_robot_base()
    rhino_matrix = rg.Transform.PlaneToPlane(rg.Plane.WorldXY,robot_base_plane)
    plane.Transform(rhino_matrix)
    return plane


def pickup_brick(script,pick_up_plane):
    planes = []
    #change the distance if needed
    SAFE_DIST = 150
    
    safe_plane = pick_up_plane.Clone()
    safe_plane.Translate(rg.Vector3d.ZAxis*SAFE_DIST)
    
    ## add to the path: go to the safe plane
    script += ur.move_l(safe_plane, SAFE_ROBOT_ACC, SAFE_ROBOT_VEL)
    planes.append(safe_plane)
    
    ## add to the path: go to the pick up plane
    script += ur.move_l(pick_up_plane, SAFE_ROBOT_ACC, SAFE_ROBOT_VEL)
    planes.append(pick_up_plane)
    
    ## add to the path: turn on the vacuum and wait 1 sec.
    script += ur.set_digital_out(IO,True)
    script += ur.sleep(1)

    # add to the path: go back to the safe_plane
    script += ur.move_l(safe_plane, SAFE_ROBOT_ACC, SAFE_ROBOT_VEL)
    planes.append(safe_plane)
    
    
    return script, planes


def place_brick(script, place_plane):
    
    planes = []
    
    SAFE_DIST = 100
    safe_plane = place_plane.Clone()
    safe_plane.Translate(rg.Vector3d.ZAxis*SAFE_DIST)
    
    # add to the path: go to the safe plane
    script += ur.move_l(safe_plane, SAFE_ROBOT_ACC, SAFE_ROBOT_VEL)
    planes.append(safe_plane)
    
    # add to the path: go to the place plane
    script += ur.move_l(place_plane, SAFE_ROBOT_ACC, SAFE_ROBOT_VEL)
    planes.append(place_plane)
    
    ## add to the path: turn off the vacuum and wait 1 second (hold the brick)
    script += ur.set_digital_out(IO,False)
    script += ur.sleep(1)
    
    # add to the path: go back to the safe plane
    script += ur.move_l(safe_plane, SAFE_ROBOT_ACC, SAFE_ROBOT_VEL)
    planes.append(safe_plane)
    
    return script,planes


def send(script):
    script = c.concatenate_script(script)
    c.send_script(script, ROBOT_IP)
    return script 


#location of a pick up station
pick_station = rg.Plane(rg.Point3d(-344.2, 306.2, -10.2), rg.Vector3d.XAxis, rg.Vector3d.YAxis)


script = ""
script = tcp(script)
vis_planes = []



# translate from rhino to robot_space and iterate through all planes
robot_planes = []

for p in brick_planes:
    r_plane = rhino_to_robot_space(p)
    robot_planes.append(r_plane)


for b_plane in robot_planes:
    
    script, p = pickup_brick(script,pick_station)
    vis_planes.extend(p) #only to visualize the planes
    
    script, p = place_brick(script,b_plane)
    vis_planes.extend(p)


if fabricate:
    send(script)
# ---------- end python_18 ----------
pln_5 = Plane(python_18.vis_planes)  # disabled
