# Grasshopper definition 1103_class_brickwall_issue.gh (Grasshopper 1.0.7)

degree = Slider(400, range=0..500)
# Arch
n = Slider(7, range=0..20)
angle = Slider(60, range=0..180)
mult = Slider(0.2, range=0..1)
point = Point(<point referenced from the Rhino model>)
ghpython_script = GhPythonScript(n=n, degree=degree, appPt=point, angle=angle, mult=mult)  # -> out, pt2D_out, CurveList_out; inputs n: Int32, degree: Int32, appPt: Point3d
# ---------- ghpython_script: Python ----------
import Rhino.Geometry as rg
import rhinoscriptsyntax as rs


pt2D = []
curveList = []


for i in range(n):
    for j in range(n):
        pt2D.append(rg.Point3d(180+70*i,100+70*j,0))
        
for k in range(len(pt2D)):
    IPCPts = []
    for m in range(degree):
        
        tmpVector = rs.VectorCreate(appPt,pt2D[k])

        unitVector = rs.VectorUnitize(tmpVector)
        vector = rs.VectorScale(unitVector, mult)
        vector = rs.VectorRotate(vector, angle, [0,0,1])
        newPt = rs.CopyObject(pt2D[k],vector)
        IPCPts.append(newPt)
        pt2D[k] = newPt
        
    curve = rs.AddInterpCurve(IPCPts,3)
    curveList.append(curve)
pt2D_out = pt2D
CurveList_out = curveList
# ---------- end ghpython_script ----------
point_2 = Point(ghpython_script.pt2D_out)
curve = Curve(ghpython_script.CurveList_out)

number_slider = Slider(10, range=1..15)  # disabled
number_slider_2 = Slider(12, range=1..15)  # disabled
number_slider_3 = Slider(12, range=1..15)  # disabled
number_slider_4 = Slider(12, range=1..15)  # disabled

# ---- group: BRICK DIMENSIONS / height
# Double Inner
panel = Panel("10")  # disabled

# ----
curve_2 = Curve(<curve referenced from the Rhino model>)

# ---- group: BRICK DIMENSIONS / length
panel_2 = Panel("30")  # disabled

# ----
curve_3 = Curve(<curve referenced from the Rhino model>)  # disabled
ghpython_script_2 = GhPythonScript()  # -> out, a; disabled
# ---------- ghpython_script_2: Python ----------
import Rhino.Geometry as rg
import copy

def CalculateISF(st_lb, st_hb,levels, currentLevel):
    trel = currentLevel/levels
    return st_lb * ( 1/st_lb * st_hb ) ** trel 
    
def CreatePointsOnDome(prev_points, prev_planes, curve, st_lb, st_hb, levels, currentLevel, width, isInside):
    iSF = CalculateISF(st_lb, st_hb,levels, currentLevel)
    iSF *= width
    
    new_points = []
    new_planes = []
    
    # get the right direction vector and get new point
    for i in range(len(prev_points)):
        unitizedDir = prev_planes[i].XAxis * -1
        actualDir = unitizedDir * iSF
        
        if isInside:
            actualDir *= reductionVal
            
        new_point = actualDir + prev_planes[i]
        new_point.Z += z
        new_points.append(new_point)
        
    # create the new Curve
    new_crv = rg.Curve.CreateInterpolatedCurve(new_points,3)
    # The degree of the curve >=1. Degree must be odd(??????)
    adj_new_pts = new_crv.DivideEquidistant(x/2 + gap/2)
    
    # I do not know what is this part doing(?????)
    for pt in adj_new_pts:
        output = new_crv.ClosestPoint(pt,0.0001)
        if not None:
            new_params.append(output[1])
            
    for i in new_params:
# ---------- end ghpython_script_2 ----------
# Intersection - Curve/Curve
curve_4 = Curve(<curve referenced from the Rhino model>)  # disabled
curve_5 = Curve(<curve referenced from the Rhino model>)

# ---- group: BRICK DIMENSIONS / width
panel_3 = Panel("15")  # disabled

# ---- group: BRICK DIMENSIONS / height
# Double Outer
panel_4 = Panel("10")  # disabled

# ---- group: BRICK DIMENSIONS / length
panel_5 = Panel("30")  # disabled

# ---- group: BRICK DIMENSIONS / height
# Arch
panel_6 = Panel("10")  # disabled

# ---- group: BRICK DIMENSIONS / width
panel_7 = Panel("15")  # disabled

# ---- group: BRICK DIMENSIONS / length
panel_8 = Panel("30")  # disabled

# ---- group: BRICK DIMENSIONS / width
panel_9 = Panel("15")  # disabled

# ---- group: BRICK DIMENSIONS / height
panel_10 = Panel("10")  # disabled

# ---- group: BRICK DIMENSIONS / length
panel_11 = Panel("30")  # disabled

# ---- group: BRICK DIMENSIONS / width
panel_12 = Panel("15")  # disabled

# ----
# Check Point in closed Curve or not
ghpython_script_3 = GhPythonScript(crv1=curve_2)  # -> out, ptOut, ptIn, boolean; inputs crv1: Curve
# ---------- ghpython_script_3: Python ----------
import Rhino.Geometry as rg
import random as r

pts = []

for i in range(100):
    pt = rg.Point3d(r.uniform(0,10), r.uniform(0,10), 0)
    pts.append(pt)
    
boolean = []
ptIn = []
ptOut = []

for j in range(len(pts)):
    
    in_or_out = rg.Curve.Contains(crv1, pts[j], rg.Plane.WorldXY, 0.001)
    boolean.append(in_or_out)
    if boolean[j] == "Inside":
        ptIn.append(pts[j])
    else:
        ptOut.append(pts[j])
    
ptInside = ptIn
ptOutside = ptOut
# ---------- end ghpython_script_3 ----------
# Curve Domain
ghpython_script_4 = GhPythonScript(crv1=curve_5)  # -> out, startDomain, endDomain, domain; inputs crv1: Curve
# ---------- ghpython_script_4: Python ----------
import Rhino.Geometry as rg
import random as r

domain = crv1.Domain
startDomain = domain[0]
endDomain = domain[1]
# ---------- end ghpython_script_4 ----------
ghpython_script_5 = GhPythonScript(crv1=curve_4, crv2=curve_3)  # -> out, curve, inter_pt; inputs crv1: Curve, crv2: Curve; disabled
# ---------- ghpython_script_5: Python ----------
import rhinoscriptsyntax as rs
import Rhino.Geometry as rg
import random

pts = [] 

for i in range(0,100):
    x = random.uniform(0.1,100)
    y = random.uniform(0.1,100)
    z = random.uniform(0.1,100)
    pt = rg.Point3d(x,y,z)
    pts.append(pt)
    

curve = rg.Curve.CreateInterpolatedCurve(pts,3)

inter = rg.Intersect.Intersection.CurveCurve(crv1,crv2, 0.001, 0)
inter_pt = inter[0].PointA
# ---------- end ghpython_script_5 ----------
number_slider_5 = Slider(14, range=0..100)  # disabled
number_slider_6 = Slider(6, range=0..100)  # disabled
angle_2 = Slider(0, range=-90..90)  # disabled
number_slider_7 = Slider(0.1, range=0.1..0.45)  # disabled
number_slider_8 = Slider(0.422, range=0.1..0.45)  # disabled
number_slider_9 = Slider(0.6, range=0.2..0.8)  # disabled
number_slider_10 = Slider(0.8, range=0.2..0.8)  # disabled
dist_tolerance = Slider(1.2, range=1.1..2.1)  # disabled
number_slider_11 = Slider(0.1, range=0.1..0.45)  # disabled
number_slider_12 = Slider(0.8, range=0.2..0.8)  # disabled
number_slider_13 = Slider(0.8, range=0.2..0.8)  # disabled
crv = Curve(<curve referenced from the Rhino model>)  # disabled
number_slider_14 = Slider(0.1, range=0.1..0.45)  # disabled
dist_tolerance_2 = Slider(1.2, range=1.1..2.1)  # disabled
number_slider_15 = Slider(0.1, range=0.1..0.45)  # disabled
number_slider_16 = Slider(0.361, range=0.1..0.45)  # disabled
dist_tolerance_3 = Slider(1.2, range=1.1..2.1)  # disabled
panel_13 = Panel(ghpython_script_5.inter_pt)  # disabled
geometry = Geometry(ghpython_script_5.inter_pt)  # disabled
number_slider_17 = Slider(0.361, range=0.1..0.45)  # disabled
number_slider_18 = Slider(0.361, range=0.1..0.45)  # disabled
multiplication = Multiplication(A=panel_10, B=number_slider)  # disabled
geometry_2 = Geometry(ghpython_script_3.ptOut)
geometry_3 = Geometry(ghpython_script_4.startDomain)
crv_2 = Curve(<curve referenced from the Rhino model>)  # disabled
panel_14 = Panel(ghpython_script_3.boolean)
panel_15 = Panel(ghpython_script_4.domain)
crv_3 = Curve(<curve referenced from the Rhino model>)  # disabled
geometry_4 = Geometry(ghpython_script_3.ptIn)
geometry_5 = Geometry(ghpython_script_4.endDomain)
multiplication_2 = Multiplication(A=panel, B=number_slider_2)  # disabled
multiplication_3 = Multiplication(A=panel_4, B=number_slider_3)  # disabled
crv_4 = Curve(<curve referenced from the Rhino model>)  # disabled
crv_5 = Curve(<curve referenced from the Rhino model>)  # disabled
multiplication_4 = Multiplication(A=panel_6, B=number_slider_4)  # disabled
python = GhPythonScript(crv=crv, layer_num=number_slider_6, bricks_num=number_slider_5, bricks_angle=angle_2)  # -> out, a, pt_bricks, crvs, bricks; inputs crv: Curve, layer_num: Int32, bricks_num: Int32, bricks_angle: Int32; disabled
# ---------- python: Python ----------
import rhinoscriptsyntax as rs
import Rhino.Geometry as rg
import math
import copy
import System
import ghpythonlib.treehelpers as th

length = 30
width = 15
height = 10



class Brickwall(object):
    
    """
    this is a class to create a wall from a input curve and get the origin for its bricks
    
    """
    
    # this varible was defined outside of the class
    # we need to declare it as global so it will be shared by all instances of the class
    global height
    
    
    # this method gets calles as soon as the object of a class is initiated
    # here we define instance variables = attributes of the object
    def __init__(self,curve,layer_cnt, brick_cnt):
        
        self.curve = curve
        self.layer_cnt = layer_cnt
        self.brick_cnt = brick_cnt
        
        self.crvs = self.get_layers()
        self.bpts,self.bpts_tan = self.get_bricks()
        
    # this method will be called in the __init__ function
    # it returns a list of curves 
    def get_layers(self):
        
        crvs = []
        for i in range(self.layer_cnt):
            T = rg.Transform.Translation(rg.Vector3d(0,0,i*height))
            c = copy.copy(self.curve)
            c.Transform(T)
            crvs.append(c)
        return crvs
    
    # this method will be called in the __init__ function as well
    # it divides the curves into points and returns the list of points and its tangents
    def get_bricks(self):
        
        bricks = []
        bricks_tan = []
        
        for i, c in enumerate(self.crvs):
            params = c.DivideByCount(self.brick_cnt*2,True)
            pts = []
            tngts = []
            # list comprehension
            pts = [ c.PointAt(p) for p in params[i%2::2]]
            tngts = [ c.TangentAt(p) for p in params[i%2::2]]
                
            bricks.append(pts)
            bricks_tan.append(tngts)
            
        return bricks,bricks_tan


class Brick(object):
    
    """
    this is a class to make a brick
    """
    
    global length
    global width
    global height

    # this method gets calles as soon as the object of a class is initiated
    # here we define instance variables = attributes of the object
    def __init__(self, origin, vec):
        
        
        self.origin = origin 
        self.vec = vec # point's tangent vector

        
        self.pts = self.brick_pts()
        
        self.start_plane = self.get_start_plane()
        self.target_plane = self.get_target_plane()
        
        self.mesh = self.brick_mesh()
        
        
    # this method will be called in the __init__ function
    # it returns a list of 8 points of the bounding box 
    def brick_pts(self):
        
        pt_0 = rg.Point3d(self.origin.X-length/2, self.origin.Y-width/2, self.origin.Z)
        pt_1 = rg.Point3d(pt_0.X + length, pt_0.Y, self.origin.Z)
        pt_2 = rg.Point3d(pt_1.X, pt_1.Y + width, self.origin.Z)
        pt_3 = rg.Point3d(pt_2.X - length, pt_2.Y, self.origin.Z)

        pt_4 = rg.Point3d(pt_0.X, pt_0.Y, pt_0.Z + height)
        pt_5 = rg.Point3d(pt_1.X, pt_1.Y, pt_1.Z + height)
        pt_6 = rg.Point3d(pt_2.X, pt_2.Y, pt_2.Z + height)
        pt_7 = rg.Point3d(pt_3.X, pt_3.Y, pt_3.Z + height)

        b_pts = [pt_0, pt_1, pt_2, pt_3, pt_4, pt_5, pt_6, pt_7]

        return b_pts
    
    # this method is called in the __init__ function
    # it returns the start_plane of the brick accodring to boolean input
    def get_start_plane(self):
        
        yvec = rg.Vector3d.CrossProduct(rg.Vector3d(0,0,1), self.vec)
        start_plane = rg.Plane(self.origin, self.vec, yvec)
            
        return start_plane
    
    # this method is called in the __init__ function
    # it returns the rotated start plabe plane according to input value 
    def get_target_plane(self):
        c = copy.copy(self.start_plane)
        c.Rotate(math.radians(bricks_angle), rg.Vector3d.ZAxis, self.origin)
        return c
    
    # this method is called in the __init__ funciton
    # it creates the mesh from 8 points, transforms its plane and returns the mesh 
    def brick_mesh(self):
        br = rg.Mesh.CreateFromBox(self.pts,1,1,1)
        P = rg.Plane(self.origin, rg.Vector3d.XAxis, rg.Vector3d.YAxis)
        T1 = rg.Transform.PlaneToPlane(P, self.start_plane)
        T2 = rg.Transform.PlaneToPlane(self.start_plane, self.target_plane)
        br.Transform(T1)
        br.Transform(T2)
        
        return br

# calling the object
wall = Brickwall(crv,layer_num,bricks_num)
# assigning its attribute to a variable crvs
crvs = wall.crvs
# to visualize the bricks in gh we transform it to a tree
pt_bricks = th.list_to_tree(wall.bpts)


bricks = []


for _pt,_t in zip(wall.bpts, wall.bpts_tan):
    for pt,t, in zip(_pt,_t):
        b = Brick(pt,t)
        bricks.append(b.mesh)
# ---------- end python ----------
crv_6 = Curve(<curve referenced from the Rhino model>)  # disabled
crv_7 = Curve(<curve referenced from the Rhino model>)  # disabled
crv_8 = Curve(<curve referenced from the Rhino model>)  # disabled
crv_9 = Curve(<curve referenced from the Rhino model>)  # disabled
python_2 = GhPythonScript(
    crv1=crv_3,
    crv2=crv_2,
    x=panel_11,
    y=panel_12,
    z=panel_10,
    reqHeight=multiplication,
    st_lb=number_slider_7,
    st_hb=number_slider_8,
    levels=number_slider,
    reductionVal=number_slider_9)  # -> out, planes_in, points_in, planes_out, points_out, crvs, ready_pts_out, ready_planes_out, ready_pts_in, ready_planes_in; inputs crv1: Curve, crv2: Curve, levels: Int32; disabled
# ---------- python_2: Python ----------
import Rhino.Geometry as rg
import copy

gap = 5
#currentLevel = 0
#for each crv divide equidistannt
#add a gap in the beginning?? (later)

crvs = []
crvs.append(crv1)
crvs.append(crv2)

current_in_crv = crv1
current_out_crv = crv2

def CalculateISF(st_lb, st_hb,levels, currentLevel):
    trel = currentLevel/levels
    return st_lb * ( 1/st_lb * st_hb ) ** trel


#function that provides the new points 
# list of points extruded 
def CreatePointsOnDome(prev_points, prev_planes, curve, st_lb, st_hb, levels, currentLevel, width, isInside):
    #we take the points, tangent and planes from prev height
    #Declare ISF for this level:
    iSF = CalculateISF(st_lb, st_hb,levels, currentLevel)
    iSF *= width
    #move based on the tangents
    i = 0
    new_points = []
    adj_new_pts = []
    new_planes = []
    new_params = []
    for i in range(len(prev_points)):
        #get the right direction vector
        unitizedDir = prev_planes[i].XAxis * -1
        actualDir = unitizedDir * iSF
        if isInside:
            actualDir *= reductionVal
        new_point = actualDir + prev_points[i]

        new_point.Z += z

        new_points.append(new_point)
        
    #create the Curve
    new_crv = rg.Curve.CreateInterpolatedCurve(new_points, 3)
    #get the tangents and create the new planes
    #redundant but check !!!
    adj_new_pts = new_crv.DivideEquidistant(x/2+gap/2)
    for pt in adj_new_pts:
        output = crv.ClosestPoint(pt,0.0001)
        if not None:
            new_params.append(output[1])
        
    for i in new_params:
        p = crv.PointAt(i)
        t = crv.TangentAt(i)
        v = rg.Vector3d.CrossProduct(t, rg.Vector3d.ZAxis)
        pn =  rg.Plane(p,v,t)
        new_planes.append(pn)
    
    return adj_new_pts, new_params, new_planes, new_crv

#def CheckIntersection(points_in, points_out, curve, st_lb, st_hb, levels, currentLevel, width, isInside):
#    for pts in points_in:
#        
#        
#    for pts in points_out:


planes_out = []
params_out = []
points_out = []


planes_in = []
params_in = []
points_in = []


for crv in crvs:
    params = []
    planes = []
    points = crv.DivideEquidistant(x/2+gap/2)
    for pt in points:
        output = crv.ClosestPoint(pt,0.0001)
        if not None:
            params.append(output[1])
        
    for i in params:
        p = crv.PointAt(i)
        t = crv.TangentAt(i)

        v = rg.Vector3d.CrossProduct(t, rg.Vector3d.ZAxis)
        
        pn =  rg.Plane(p,v,t)

        planes.append(pn)
    
    if crvs.index(crv) == 0:
        planes_in.append(planes)
        params_in.append(params)
        points_in.append(points)
    
    else:
        planes_out.append(planes)
        params_out.append(params)
        points_out.append(points)

#increment the current height
#currentLevel +=1

#take each curve
#iterate of height 

#for i in range(layers):
#    T = rg.Transform.Translation(rg.Vector3d(0,0,i*z))
#    c = copy.copy(crvs[0])
#    c.Transform(T)
#    crvs.append(c)


#for outside Curve:
for level in range(levels-1):
    new_pts, new_params, new_planes, new_crv = CreatePointsOnDome(points_out[-1], planes_out[-1], current_out_crv, st_lb, st_hb, levels, level+1,y, False)
    points_out.append(new_pts)
    params_out.append(new_params)
    planes_out.append(new_planes)
    current_out_crv = new_crv
    crvs.append(new_crv)
    
#for inside Curve:
for level in range(levels-1):
    new_pts, new_params, new_planes, new_crv = CreatePointsOnDome(points_in[-1], planes_in[-1], current_in_crv, st_lb, st_hb, levels, level+1,y ,True)
    points_in.append(new_pts)
    params_in.append(new_params)
    planes_in.append(new_planes)
    current_in_crv = new_crv
    crvs.append(new_crv)
#for each height take each point on the previous level and move it up by 1 step

#ISF = st_lb * ( 1/st_lb * st_hb ) ** trel

#calculate the required instep factor
#then get the direction vector of movement (-x)
#unitize just for safety

ready_pts_out = []
ready_params_out = []
ready_planes_out = []


#for outer curve 
for i in range(len(points_out)):
    #get a list of point based on i
    pts = [pt for pt in points_out[i][i%2::2]]
    #get a list of params based on i
    params = [param for param in params_out[i][i%2::2]]
    #get a list of planes based on i 
    planes = [plane for plane in planes_out[i][i%2::2]]
    
    ready_pts_out.append(pts)
    ready_params_out.append(params)
    ready_planes_out.append(planes)


ready_pts_in = []
ready_params_in = []
ready_planes_in = []


#for inner curve 
for i in range(len(points_in)):
    #get a list of point based on i
    pts = [pt for pt in points_in[i][i%2::2]]
    #get a list of params based on i
    params = [param for param in params_in[i][i%2::2]]
    #get a list of planes based on i 
    planes = [plane for plane in planes_in[i][i%2::2]]
    
    ready_pts_in.append(pts)
    ready_params_in.append(params)
    ready_planes_in.append(planes)
    
    

#for pt_in,pt_out in zip(points_in,points_out):
#    if pt_in.DistanceTo(self,pt_out)<y :
#
# ---------- end python_2 ----------
swatch = ColourSwatch(SwatchColor=RGB(255, 0, 255))  # disabled
python_3 = GhPythonScript(
    crv1=crv_5,
    crv2=crv_4,
    x=panel_2,
    y=panel_3,
    z=panel,
    reqHeight=multiplication_2,
    st_lb=number_slider_11,
    st_hb=number_slider_16,
    levels=number_slider_2,
    reductionVal=number_slider_10,
    dist_tolerance=dist_tolerance)  # -> out, planes_in, points_in, planes_out, points_out, crvs, ready_pts_out, ready_planes_out, ready_pts_in, ready_planes_in; inputs crv1: Curve, crv2: Curve, levels: Int32; disabled
# ---------- python_3: Python ----------
import Rhino.Geometry as rg
import copy

gap = 5
#currentLevel = 0
#for each crv divide equidistannt
#add a gap in the beginning?? (later)

#distance that triggers the combination of two curves into one
dist_tolerance *= y

crvs = []
crvs.append(crv1)
crvs.append(crv2)

current_in_crv = crv1
current_out_crv = crv2

def CalculateISF(st_lb, st_hb,levels, currentLevel):
    trel = currentLevel/levels
    return st_lb * ( 1/st_lb * st_hb ) ** trel


#function that provides the new points 
# list of points extruded 
def CreatePointsOnDome(prev_points, prev_planes, curve, st_lb, st_hb, levels, currentLevel, width, isInside):
    #we take the points, tangent and planes from prev height
    #Declare ISF for this level:
    iSF = CalculateISF(st_lb, st_hb,levels, currentLevel)
    iSF *= width
    #move based on the tangents
    i = 0
    new_points = []
    adj_new_pts = []
    new_planes = []
    new_params = []
    
    for i in range(len(prev_points)):
        #get the right direction vector
        unitizedDir = prev_planes[i].XAxis * -1
        actualDir = unitizedDir * iSF
        if isInside:
            actualDir *= reductionVal
        new_point = actualDir + prev_points[i]
        new_point.Z += z
        new_points.append(new_point)
        
    #create the Curve
    new_crv = rg.Curve.CreateInterpolatedCurve(new_points, 3)
    #get the tangents and create the new planes
    #redundant but check !!!
    adj_new_pts = new_crv.DivideEquidistant(x/2+gap/2)
    for pt in adj_new_pts:
        output = new_crv.ClosestPoint(pt,0.0001)
        if not None:
            new_params.append(output[1])
        
    for i in new_params:
        p = new_crv.PointAt(i)
        t = new_crv.TangentAt(i)
        v = rg.Vector3d.CrossProduct(t, rg.Vector3d.ZAxis)
        pn =  rg.Plane(p,v,t)
        new_planes.append(pn)
    
    return adj_new_pts, new_params, new_planes, new_crv

#def CheckIntersection(points_in_lvl, points_out_lvl, curve_in, curve_out, st_lb, st_hb, levels, currentLevel, width, dist_tolerance isInside):
#    checked_pts_in = []
#    checked_pts_out = []
#    
#    for pt in points_in_lvl
#        if curve_out.ClosestPoint(pt, dist_tolerance):
#            checked_pts_in.append(pt)

def CheckIntersection(pt, curve_out):
    print curve_out.ClosestPoint(pt, dist_tolerance)[0]
    return curve_out.ClosestPoint(pt, dist_tolerance)[0]


planes_out = []
params_out = []
points_out = []
curves_out = []

planes_in = []
params_in = []
points_in = []
curves_in = []

for crv in crvs:
    params = []
    planes = []
    points = crv.DivideEquidistant(x/2+gap/2)
    for pt in points:
        output = crv.ClosestPoint(pt,0.0001)
        if not None:
            params.append(output[1])
        
    for i in params:
        p = crv.PointAt(i)
        t = crv.TangentAt(i)

        v = rg.Vector3d.CrossProduct(t, rg.Vector3d.ZAxis)
        
        pn =  rg.Plane(p,v,t)

        planes.append(pn)
    
    if crvs.index(crv) == 0:
        planes_in.append(planes)
        params_in.append(params)
        points_in.append(points)
        curves_in.append(crv)
    
    else:
        planes_out.append(planes)
        params_out.append(params)
        points_out.append(points)
        curves_out.append(crv)

#increment the current height
#currentLevel +=1

#take each curve
#iterate of height 



#for outside Curve:
for level in range(levels-1):
    new_pts, new_params, new_planes, new_crv = CreatePointsOnDome(points_out[-1], planes_out[-1], current_out_crv, st_lb, st_hb, levels, level+1,y, False)
    points_out.append(new_pts)
    params_out.append(new_params)
    planes_out.append(new_planes)
    current_out_crv = new_crv
    curves_out.append(new_crv)
    
#for inside Curve:
for level in range(levels-1):
    new_pts, new_params, new_planes, new_crv = CreatePointsOnDome(points_in[-1], planes_in[-1], current_in_crv, st_lb, st_hb, levels, level+1,y ,True)
    points_in.append(new_pts)
    params_in.append(new_params)
    planes_in.append(new_planes)
    current_in_crv = new_crv
    curves_in.append(new_crv)


ready_pts_out = []
ready_params_out = []
ready_planes_out = []
#ready_curves_out = []


#for outer curve 
for i in range(len(points_out)):
    #get a list of point based on i
    pts = [pt for pt in points_out[i][i%2::2]]
    #get a list of params based on i
    params = [param for param in params_out[i][i%2::2]]
    #get a list of planes based on i 
    planes = [plane for plane in planes_out[i][i%2::2]]
    
    ready_pts_out.append(pts)
    ready_params_out.append(params)
    ready_planes_out.append(planes)


ready_pts_in = []
ready_params_in = []
ready_planes_in = []
#ready_curves_in = []

#for inner curve 
for i in range(len(points_in)):
    pts = []
    planes = []
    params = []
    
    #get a list of point based on i
    #print points_in[i]
    points_in[i] = [pt for pt in points_in[i][i%2::2]]
    params_in[i] = [param for param in params_in[i][i%2::2]]
    planes_in[i] = [plane for plane in planes_in[i][i%2::2]]

    for j in range(len(points_in[i])):
        if not CheckIntersection(points_in[i][j], curves_out[i]):
            pts.append(points_in[i][j])
            params.append(params_in[i][j])
            planes.append(planes_in[i][j])
            print "we are here"
            
    ready_pts_in.append(pts)
    ready_params_in.append(params)
    ready_planes_in.append(planes)
# ---------- end python_3 ----------
python_4 = GhPythonScript(
    crv1=crv_7,
    crv2=crv_6,
    x=panel_5,
    y=panel_7,
    z=panel_4,
    reqHeight=multiplication_3,
    st_lb=number_slider_14,
    st_hb=number_slider_17,
    levels=number_slider_3,
    reductionVal=number_slider_12,
    dist_tolerance=dist_tolerance_2)  # -> out, planes_in, points_in, planes_out, points_out, crvs, ready_pts_out, ready_planes_out, ready_pts_in, ready_planes_in; inputs crv1: Curve, crv2: Curve, levels: Int32; disabled
# ---------- python_4: Python ----------
import Rhino.Geometry as rg
import copy

gap = 5
#currentLevel = 0
#for each crv divide equidistannt
#add a gap in the beginning?? (later)

#distance that triggers the combination of two curves into one
dist_tolerance *= y

crvs = []
crvs.append(crv1)
crvs.append(crv2)

current_in_crv = crv1
current_out_crv = crv2

def CalculateISF(st_lb, st_hb,levels, currentLevel):
    trel = currentLevel/levels
    return st_lb * ( 1/st_lb * st_hb ) ** trel


#function that provides the new points 
# list of points extruded 
def CreatePointsOnDome(prev_points, prev_planes, curve, st_lb, st_hb, levels, currentLevel, width, isInside):
    #we take the points, tangent and planes from prev height
    #Declare ISF for this level:
    iSF = CalculateISF(st_lb, st_hb,levels, currentLevel)
    iSF *= width
    #move based on the tangents
    i = 0
    new_points = []
    adj_new_pts = []
    new_planes = []
    new_params = []
    
    for i in range(len(prev_points)):
        #get the right direction vector
        unitizedDir = prev_planes[i].XAxis * 1
        actualDir = unitizedDir * iSF
        if isInside:
            actualDir *= reductionVal
        new_point = actualDir + prev_points[i]
        new_point.Z += z
        new_points.append(new_point)
        
    #create the Curve
    new_crv = rg.Curve.CreateInterpolatedCurve(new_points, 3)
    #get the tangents and create the new planes
    #redundant but check !!!
    adj_new_pts = new_crv.DivideEquidistant(x/2+gap/2)
    for pt in adj_new_pts:
        output = new_crv.ClosestPoint(pt,0.0001)
        if not None:
            new_params.append(output[1])
            
        
    for i in new_params:
        p = new_crv.PointAt(i)
        t = new_crv.TangentAt(i)
        v = rg.Vector3d.CrossProduct(t, rg.Vector3d.ZAxis)
        pn =  rg.Plane(p,v,t)
        new_planes.append(pn)
        
        
    
    return adj_new_pts, new_params, new_planes, new_crv

#def CheckIntersection(points_in_lvl, points_out_lvl, curve_in, curve_out, st_lb, st_hb, levels, currentLevel, width, dist_tolerance isInside):
#    checked_pts_in = []
#    checked_pts_out = []
#    
#    for pt in points_in_lvl
#        if curve_out.ClosestPoint(pt, dist_tolerance):
#            checked_pts_in.append(pt)

def CheckIntersection(pt, curve_out):
    print curve_out.ClosestPoint(pt, dist_tolerance)[0]
    return curve_out.ClosestPoint(pt, dist_tolerance)[0]


planes_out = []
params_out = []
points_out = []
curves_out = []

planes_in = []
params_in = []
points_in = []
curves_in = []

for crv in crvs:
    params = []
    planes = []
    points = crv.DivideEquidistant(x/2+gap/2)
    for pt in points:
        output = crv.ClosestPoint(pt,0.0001)
        if not None:
            params.append(output[1])
        
    for i in params:
        p = crv.PointAt(i)
        t = crv.TangentAt(i)

        v = rg.Vector3d.CrossProduct(t, rg.Vector3d.ZAxis)
        
        pn =  rg.Plane(p,v,t)

        planes.append(pn)
    
    if crvs.index(crv) == 0:
        planes_in.append(planes)
        params_in.append(params)
        points_in.append(points)
        curves_in.append(crv)
    
    else:
        planes_out.append(planes)
        params_out.append(params)
        points_out.append(points)
        curves_out.append(crv)

#increment the current height
#currentLevel +=1

#take each curve
#iterate of height 



#for outside Curve:
for level in range(levels-1):
    new_pts, new_params, new_planes, new_crv = CreatePointsOnDome(points_out[-1], planes_out[-1], current_out_crv, st_lb, st_hb, levels, level+1,y, True)
    points_out.append(new_pts)
    params_out.append(new_params)
    planes_out.append(new_planes)
    current_out_crv = new_crv
    curves_out.append(new_crv)
    
#for inside Curve:
for level in range(levels-1):
    new_pts, new_params, new_planes, new_crv = CreatePointsOnDome(points_in[-1], planes_in[-1], current_in_crv, st_lb, st_hb, levels, level+1,y ,False)
    points_in.append(new_pts)
    params_in.append(new_params)
    planes_in.append(new_planes)
    current_in_crv = new_crv
    curves_in.append(new_crv)


ready_pts_out = []
ready_params_out = []
ready_planes_out = []
#ready_curves_out = []


#for outer curve 
for i in range(len(points_out)):
    #get a list of point based on i
    pts = [pt for pt in points_out[i][i%2::2]]
    #get a list of params based on i
    params = [param for param in params_out[i][i%2::2]]
    #get a list of planes based on i 
    planes = [plane for plane in planes_out[i][i%2::2]]
    
    ready_pts_out.append(pts)
    ready_params_out.append(params)
    ready_planes_out.append(planes)


ready_pts_in = []
ready_params_in = []
ready_planes_in = []
#ready_curves_in = []

#for inner curve 
for i in range(len(points_in)):
    pts = []
    planes = []
    params = []
    
    #get a list of point based on i
    #print points_in[i]
    points_in[i] = [pt for pt in points_in[i][i%2::2]]
    params_in[i] = [param for param in params_in[i][i%2::2]]
    planes_in[i] = [plane for plane in planes_in[i][i%2::2]]

    for j in range(len(points_in[i])):
        if not CheckIntersection(points_in[i][j], curves_out[i]):
            pts.append(points_in[i][j])
            params.append(params_in[i][j])
            planes.append(planes_in[i][j])
            
    ready_pts_in.append(pts)
    ready_params_in.append(params)
    ready_planes_in.append(planes)
# ---------- end python_4 ----------
python_5 = GhPythonScript(
    crv1=crv_9,
    crv2=crv_8,
    x=panel_8,
    y=panel_9,
    z=panel_6,
    reqHeight=multiplication_4,
    st_lb=number_slider_15,
    st_hb=number_slider_18,
    levels=number_slider_4,
    reductionVal=number_slider_13,
    dist_tolerance=dist_tolerance_3)  # -> out, planes_in, points_in, planes_out, points_out, crvs, ready_pts_out, ready_planes_out, ready_pts_in, ready_planes_in; inputs crv1: Curve, crv2: Curve, levels: Int32; disabled
# ---------- python_5: Python ----------
import Rhino.Geometry as rg
import copy

gap = 5
#currentLevel = 0
#for each crv divide equidistannt
#add a gap in the beginning?? (later)

#distance that triggers the combination of two curves into one
dist_tolerance *= y

crvs = []
crvs.append(crv1)
crvs.append(crv2)

current_in_crv = crv1
current_out_crv = crv2

def CalculateISF(st_lb, st_hb,levels, currentLevel):
    trel = currentLevel/levels
    return st_lb * ( 1/st_lb * st_hb ) ** trel


#function that provides the new points 
# list of points extruded 
def CreatePointsOnDome(prev_points, prev_planes, curve, st_lb, st_hb, levels, currentLevel, width, isInside):
    #we take the points, tangent and planes from prev height
    #Declare ISF for this level:
    iSF = CalculateISF(st_lb, st_hb,levels, currentLevel)
    iSF *= width
    #move based on the tangents
    i = 0
    new_points = []
    adj_new_pts = []
    new_planes = []
    new_params = []
    
    for i in range(len(prev_points)):
        #get the right direction vector
        unitizedDir = prev_planes[i].XAxis * 1
        actualDir = unitizedDir * iSF
        if isInside:
            actualDir *= reductionVal*-1
        new_point = actualDir + prev_points[i]
        new_point.Z += z
        new_points.append(new_point)
        
    #create the Curve
    new_crv = rg.Curve.CreateInterpolatedCurve(new_points, 3)
    #get the tangents and create the new planes
    #redundant but check !!!
    adj_new_pts = new_crv.DivideEquidistant(x/2+gap/2)
    for pt in adj_new_pts:
        output = new_crv.ClosestPoint(pt,0.0001)
        if not None:
            new_params.append(output[1])
            
        
    for i in new_params:
        p = new_crv.PointAt(i)
        t = new_crv.TangentAt(i)
        v = rg.Vector3d.CrossProduct(t, rg.Vector3d.ZAxis)
        pn =  rg.Plane(p,v,t)
        new_planes.append(pn)
        
        
    
    return adj_new_pts, new_params, new_planes, new_crv

#def CheckIntersection(points_in_lvl, points_out_lvl, curve_in, curve_out, st_lb, st_hb, levels, currentLevel, width, dist_tolerance isInside):
#    checked_pts_in = []
#    checked_pts_out = []
#    
#    for pt in points_in_lvl
#        if curve_out.ClosestPoint(pt, dist_tolerance):
#            checked_pts_in.append(pt)

def CheckIntersection(pt, curve_out):
    print curve_out.ClosestPoint(pt, dist_tolerance)[0]
    return curve_out.ClosestPoint(pt, dist_tolerance)[0]


planes_out = []
params_out = []
points_out = []
curves_out = []

planes_in = []
params_in = []
points_in = []
curves_in = []

for crv in crvs:
    params = []
    planes = []
    points = crv.DivideEquidistant(x/2+gap/2)
    for pt in points:
        output = crv.ClosestPoint(pt,0.0001)
        if not None:
            params.append(output[1])
        
    for i in params:
        p = crv.PointAt(i)
        t = crv.TangentAt(i)

        v = rg.Vector3d.CrossProduct(t, rg.Vector3d.ZAxis)
        
        pn =  rg.Plane(p,v,t)

        planes.append(pn)
    
    if crvs.index(crv) == 0:
        planes_in.append(planes)
        params_in.append(params)
        points_in.append(points)
        curves_in.append(crv)
    
    else:
        planes_out.append(planes)
        params_out.append(params)
        points_out.append(points)
        curves_out.append(crv)

#increment the current height
#currentLevel +=1

#take each curve
#iterate of height 



#for outside Curve:
for level in range(levels-1):
    new_pts, new_params, new_planes, new_crv = CreatePointsOnDome(points_out[-1], planes_out[-1], current_out_crv, st_lb, st_hb, levels, level+1,y, True)
    points_out.append(new_pts)
    params_out.append(new_params)
    planes_out.append(new_planes)
    current_out_crv = new_crv
    curves_out.append(new_crv)
    
#for inside Curve:
for level in range(levels-1):
    new_pts, new_params, new_planes, new_crv = CreatePointsOnDome(points_in[-1], planes_in[-1], current_in_crv, st_lb, st_hb, levels, level+1,y ,False)
    points_in.append(new_pts)
    params_in.append(new_params)
    planes_in.append(new_planes)
    current_in_crv = new_crv
    curves_in.append(new_crv)


ready_pts_out = []
ready_params_out = []
ready_planes_out = []
#ready_curves_out = []


#for outer curve 
for i in range(len(points_out)):
    #get a list of point based on i
    pts = [pt for pt in points_out[i][i%2::2]]
    #get a list of params based on i
    params = [param for param in params_out[i][i%2::2]]
    #get a list of planes based on i 
    planes = [plane for plane in planes_out[i][i%2::2]]
    
    ready_pts_out.append(pts)
    ready_params_out.append(params)
    ready_planes_out.append(planes)


ready_pts_in = []
ready_params_in = []
ready_planes_in = []
#ready_curves_in = []

#for inner curve 
for i in range(len(points_in)):
    pts = []
    planes = []
    params = []
    
    #get a list of point based on i
    #print points_in[i]
    points_in[i] = [pt for pt in points_in[i][i%2::2]]
    params_in[i] = [param for param in params_in[i][i%2::2]]
    planes_in[i] = [plane for plane in planes_in[i][i%2::2]]

    for j in range(len(points_in[i])):
        if not CheckIntersection(points_in[i][j], curves_out[i]):
            pts.append(points_in[i][j])
            params.append(params_in[i][j])
            planes.append(planes_in[i][j])
            
    ready_pts_in.append(pts)
    ready_params_in.append(params)
    ready_planes_in.append(planes)
# ---------- end python_5 ----------
pt = Point(flatten(python.pt_bricks))  # disabled
crv_10 = Curve(python.crvs)  # disabled
mesh = Mesh(python.bricks)  # disabled
partition_list = PartitionList(List=curve, Size=2)
python_6 = GhPythonScript(x=python_2.planes_in, z=python_2.points_in)  # -> out, a, b, c; disabled
# ---------- python_6: Python ----------
a = x
b = y
c = z
# ---------- end python_6 ----------
preview = CustomPreview(Geometry=mesh, Material=swatch)  # disabled
python_7 = GhPythonScript(x=python_2.planes_out, z=python_2.points_out)  # -> out, a, b, c; disabled; same code as python_6
python_8 = GhPythonScript(x=python_2.ready_pts_out, y=python_2.ready_planes_out)  # -> a, b; disabled
# ---------- python_8: Python ----------
a = x
b = y
# ---------- end python_8 ----------
python_9 = GhPythonScript(x=python_2.ready_pts_in, y=python_2.ready_planes_in)  # -> a, b; disabled; same code as python_8
panel_16 = Panel("pi/2")  # disabled
panel_17 = Panel("pi/2")  # disabled
panel_18 = Panel("pi/2")  # disabled
python_10 = GhPythonScript(x=python_3.planes_out, z=python_3.points_out)  # -> out, a, c; disabled; same code as python_6
python_11 = GhPythonScript(x=python_3.ready_pts_out, y=python_3.ready_planes_out)  # -> a, b; disabled; same code as python_8
python_12 = GhPythonScript(x=python_3.ready_pts_in, y=python_3.ready_planes_in)  # -> a, b; disabled; same code as python_8
panel_19 = Panel("pi/2")  # disabled
geometry_6 = Geometry(python_2.crvs)  # disabled
python_13 = GhPythonScript(x=python_3.planes_in, z=python_3.points_in)  # -> out, a, c; disabled; same code as python_6
python_14 = GhPythonScript(x=python_4.planes_out, z=python_4.points_out)  # -> out, a, c; disabled; same code as python_6
python_15 = GhPythonScript(x=python_4.ready_pts_out, y=python_4.ready_planes_out)  # -> a, b; disabled; same code as python_8
python_16 = GhPythonScript(x=python_4.ready_pts_in, y=python_4.ready_planes_in)  # -> a, b; disabled; same code as python_8
python_17 = GhPythonScript(x=python_5.planes_out, z=python_5.points_out)  # -> out, a, c; disabled; same code as python_6
python_18 = GhPythonScript(x=python_5.ready_pts_out, y=python_5.ready_planes_out)  # -> a, b; disabled; same code as python_8
python_19 = GhPythonScript(x=python_5.ready_pts_in, y=python_5.ready_planes_in)  # -> a, b; disabled; same code as python_8
python_20 = GhPythonScript(x=python_4.planes_in, z=python_4.points_in)  # -> out, a, c; disabled; same code as python_6
python_21 = GhPythonScript(x=python_5.planes_in, z=python_5.points_in)  # -> out, a, c; disabled; same code as python_6
data = Data(python_9.a)  # disabled
data_2 = Data(python_7.a)  # disabled
panel_20 = Panel("pi/2")  # disabled
panel_21 = Panel("pi/2")  # disabled
data_3 = Data(python_13.a)  # disabled
rotate = Rotate(Geometry=python_11.b, Angle=panel_16, Plane=python_11.b)  # -> Geometry, Transform; disabled
rotate_2 = Rotate(Geometry=python_12.b, Angle=panel_17, Plane=python_12.b)  # -> Geometry, Transform; disabled
panel_22 = Panel(partition_list)
data_4 = Data(python_20.a)  # disabled
geometry_7 = Geometry(python_3.crvs)  # disabled
list_item = ListItem(List=partition_list, Index=Slider(0, range=0..1), Wrap=True)
list_item_2 = ListItem(List=partition_list, Index=Slider(1, range=0..1), Wrap=True)
data_5 = Data(python_21.a)  # disabled
rotate_3 = Rotate(Geometry=python_18.b, Angle=panel_18, Plane=python_18.b)  # -> Geometry, Transform; disabled
geometry_8 = Geometry(python_4.crvs)  # disabled
rotate_4 = Rotate(Geometry=python_19.b, Angle=panel_19, Plane=python_19.b)  # -> Geometry, Transform; disabled
geometry_9 = Geometry(python_5.crvs)  # disabled
pt_2 = Point(flatten(python_6.a))  # disabled
panel_23 = Panel(python_7.a)  # disabled
pt_3 = Point(flatten(python_13.a))  # disabled
pt_4 = Point(flatten(python_20.a))  # disabled
pt_5 = Point(flatten(python_21.a))  # disabled
data_6 = Data([python_11.b, python_12.b])  # disabled
data_7 = Data([python_15.b, python_16.b])  # disabled
data_8 = Data([python_18.b, python_19.b])  # disabled
rotate_5 = Rotate(Geometry=python_15.b, Angle=panel_20, Plane=python_15.b)  # -> Geometry, Transform; disabled
rotate_6 = Rotate(Geometry=python_16.b, Angle=panel_21, Plane=python_16.b)  # -> Geometry, Transform; disabled

# ---- group: BRICK DIMENSIONS / height
panel_24 = Panel("10")

# ---- group: BRICK DIMENSIONS / length
panel_25 = Panel("31.5")

# ---- group: BRICK DIMENSIONS / width
panel_26 = Panel("15")

# ----
number_slider_19 = Slider(8, range=1..15)
panel_27 = Panel(pt_2)  # disabled

outer_curve = Curve(list_item_2)
inner_curve = Curve(list_item)

domain_box = DomainBox(Base=rotate.Geometry, X=panel_2, Y=panel_3, Z=panel)  # disabled
domain_box_2 = DomainBox(Base=rotate_2.Geometry, X=panel_2, Y=panel_3, Z=panel)  # disabled
domain_box_3 = DomainBox(Base=rotate_3.Geometry, X=panel_8, Y=panel_9, Z=panel_6)  # disabled
domain_box_4 = DomainBox(Base=rotate_4.Geometry, X=panel_8, Y=panel_9, Z=panel_6)  # disabled
dist_tolerance_4 = Slider(1.5, range=0.9..2.1)
domain_box_5 = DomainBox(Base=rotate_5.Geometry, X=panel_5, Y=panel_7, Z=panel_4)  # disabled
domain_box_6 = DomainBox(Base=rotate_6.Geometry, X=panel_5, Y=panel_7, Z=panel_4)  # disabled
multiplication_5 = Multiplication(A=panel_25, B=number_slider_19)
python_22 = GhPythonScript(
    crv1=inner_curve,
    crv2=outer_curve,
    x=panel_25,
    y=panel_26,
    z=panel_24,
    reqHeight=multiplication_5,
    st_lb=Slider(0.194, range=0.1..0.45),
    st_hb=Slider(0.422, range=0.1..0.45),
    levels=number_slider_19,
    reductionVal=Slider(0.56, range=0.2..0.8),
    dist_tolerance=dist_tolerance_4,
    dome_type=Slider(1, range=-1..1))  # -> out, planes_in, points_in, planes_out, points_out, crvs, ready_pts_out, ready_planes_out, ready_pts_in, ready_planes_in; inputs crv1: Curve, crv2: Curve, levels: Int32, dome_type: Int32
# ---------- python_22: Python ----------
import Rhino.Geometry as rg
import copy

gap = 5
#currentLevel = 0
#for each crv divide equidistannt
#add a gap in the beginning?? (later)

#distance that triggers the combination of two curves into one
dist_tolerance *= y

crvs = []
crvs.append(crv1)
crvs.append(crv2)

current_in_crv = crv1
current_out_crv = crv2

def CalculateISF(st_lb, st_hb,levels, currentLevel):
    trel = currentLevel/levels
    return st_lb * ( 1/st_lb * st_hb ) ** trel


#function that provides the new points 
# list of points extruded 
def CreatePointsOnDome(prev_points, prev_planes, curve, st_lb, st_hb, levels, currentLevel, width, isInside):
    #we take the points, tangent and planes from prev height
    #Declare ISF for this level:
    iSF = CalculateISF(st_lb, st_hb, levels, currentLevel)
    iSF *= width
    #move based on the tangents
    i = 0
    new_points = []
    adj_new_pts = []
    new_planes = []
    new_params = []
    
    for i in range(len(prev_points)):
        #get the right direction vector
        unitizedDir = prev_planes[i].XAxis * -1
        actualDir = unitizedDir * iSF
        if isInside:
            actualDir *= reductionVal * dome_type
            # Issue add this "dome_type" to change the how two curve combine together.
        new_point = actualDir + prev_points[i]
        new_point.Z += z
        new_points.append(new_point)
        
    #create the Curve
    new_crv = rg.Curve.CreateInterpolatedCurve(new_points, 3)
    #get the tangents and create the new planes
    #redundant but check !!!
    adj_new_pts = new_crv.DivideEquidistant(x/2+gap/2)
    for pt in adj_new_pts:
        output = new_crv.ClosestPoint(pt,0.0001)
        if not None:
            new_params.append(output[1])
        
    for i in new_params:
        p = new_crv.PointAt(i)
        t = new_crv.TangentAt(i)
        v = rg.Vector3d.CrossProduct(t, rg.Vector3d.ZAxis)
        pn =  rg.Plane(p,v,t)
        new_planes.append(pn)
    
    return adj_new_pts, new_params, new_planes, new_crv


def CheckIntersection(pt, curve_out):
    print curve_out.ClosestPoint(pt, dist_tolerance)[0]
    return curve_out.ClosestPoint(pt, dist_tolerance)[0]


planes_out = []
params_out = []
points_out = []
curves_out = []

planes_in = []
params_in = []
points_in = []
curves_in = []

for crv in crvs:
    params = []
    planes = []
    points = crv.DivideEquidistant(x/2+gap/2)
    for pt in points:
        output = crv.ClosestPoint(pt,0.0001)
        if not None:
            params.append(output[1])
        
    for i in params:
        p = crv.PointAt(i)
        t = crv.TangentAt(i)

        v = rg.Vector3d.CrossProduct(t, rg.Vector3d.ZAxis)
        
        pn =  rg.Plane(p,v,t)

        planes.append(pn)
    
    if crvs.index(crv) == 0:
        planes_in.append(planes)
        params_in.append(params)
        points_in.append(points)
        curves_in.append(crv)
    
    else:
        planes_out.append(planes)
        params_out.append(params)
        points_out.append(points)
        curves_out.append(crv)

#increment the current height
#currentLevel +=1

#take each curve
#iterate of height 



#for outside Curve:
for level in range(levels-1):
    new_pts, new_params, new_planes, new_crv = CreatePointsOnDome(points_out[-1], planes_out[-1], current_out_crv, st_lb, st_hb, levels, level+1,y, False)
    points_out.append(new_pts)
    params_out.append(new_params)
    planes_out.append(new_planes)
    current_out_crv = new_crv
    curves_out.append(new_crv)
    
#for inside Curve:
for level in range(levels-1):
    new_pts, new_params, new_planes, new_crv = CreatePointsOnDome(points_in[-1], planes_in[-1], current_in_crv, st_lb, st_hb, levels, level+1,y ,True)
    points_in.append(new_pts)
    params_in.append(new_params)
    planes_in.append(new_planes)
    current_in_crv = new_crv
    curves_in.append(new_crv)


ready_pts_out = []
ready_params_out = []
ready_planes_out = []
#ready_curves_out = []


#for outer curve 
for i in range(len(points_out)):
    #get a list of point based on i
    pts = [pt for pt in points_out[i][i%2::2]]
    #get a list of params based on i
    params = [param for param in params_out[i][i%2::2]]
    #get a list of planes based on i 
    planes = [plane for plane in planes_out[i][i%2::2]]
    
    ready_pts_out.append(pts)
    ready_params_out.append(params)
    ready_planes_out.append(planes)


ready_pts_in = []
ready_params_in = []
ready_planes_in = []
#ready_curves_in = []

#for inner curve 
for i in range(len(points_in)):
    pts = []
    planes = []
    params = []
    
    #get a list of point based on i
    #print points_in[i]
    points_in[i] = [pt for pt in points_in[i][i%2::2]]
    params_in[i] = [param for param in params_in[i][i%2::2]]
    planes_in[i] = [plane for plane in planes_in[i][i%2::2]]

    for j in range(len(points_in[i])):
        if not CheckIntersection(points_in[i][j], curves_out[i]):
            pts.append(points_in[i][j])
            params.append(params_in[i][j])
            planes.append(planes_in[i][j])

            
    ready_pts_in.append(pts)
    ready_params_in.append(params)
    ready_planes_in.append(planes)
# ---------- end python_22 ----------

# ---- group: BRICK PLANES
python_23 = GhPythonScript(x=python_22.ready_pts_in, y=python_22.ready_planes_in)  # -> a, b; same code as python_8
python_24 = GhPythonScript(x=python_22.ready_pts_out, y=python_22.ready_planes_out)  # -> a, b; same code as python_8
pln = Plane(python_24.b)
pln_2 = Plane(python_23.b)

# ----
merge = Merge(Data1=pln, Data2=pln_2)
distance = Distance(PointA=python_23.a, PointB=python_24.a)
prot = RotatePlane(Plane=merge, Angle=degrees("90"))

# ---- group: FINAL PLANES
pln_3 = Plane(prot)

# ----
# BRICKS PREVIEW
panel_28 = Panel("0,0,0")
division = Division(A=panel_24, B="2")
box = DomainBox(Base=panel_28, X=panel_25, Y=panel_26, Z=panel_24)
division_2 = Division(A=panel_26, B="2")
division_3 = Division(A=panel_25, B="2")
x = Panel(division_3)
y = Panel(division_2)
z = Panel(division)
vector_xyz = VectorXYZ(XComponent=x, YComponent=y, ZComponent=z)  # -> Vector, Length
orient = Orient(Geometry=box, Source=vector_xyz.Vector, Target=prot)  # -> Geometry, Transform
preview_2 = CustomPreview(Geometry=orient.Geometry, Material=ColourSwatch(SwatchColor=RGB(73, 200, 235)))

# ----
# PLANE EDITOR
crv_11 = Curve(<curve referenced from the Rhino model>)
end = EndPoints(Curve=crv_11)  # -> Start, End
ln = Line(StartPoint=end.Start, EndPoint=end.End)
vec = Vector(ln)
prot_2 = RotatePlane(Plane=pln_3, Angle=degrees("-90"))
Z = UnitZ(Factor=Slider(9, range=0..10))
move = Move(Geometry=prot_2, Motion=vec)  # -> Geometry, Transform
move_2 = Move(Geometry=move.Geometry, Motion=Z)  # -> flatten(Geometry), Transform

panel_29 = Panel(move.Geometry)
geometry_10 = Geometry(move_2.Geometry)
panel_30 = Panel(move_2.Geometry)

# ---- group: FABRICATION WORKFLOW
python_25 = GhPythonScript(brick_planes=move_2.Geometry, fabricate=Button())  # -> script, vis_planes, pick_up_plane; inputs brick_planes: list of Plane, fabricate: Boolean
# ---------- python_25: Python ----------
from imp import reload
import Rhino.Geometry as rg
import simple_ur_script as ur
reload(ur)
import simple_comm as c
reload(c)
import math as m


# change these values if needed
ROBOT_IP = "192.168.10.10"
SAFE_ROBOT_ACC = 0.3
SAFE_ROBOT_VEL = 0.3
IO = 4




def tcp(script):
    script += ur.set_tcp_by_angles(0.0, 0.0, 80.0, m.radians(0.0), m.radians(180.0),m.radians(0.0))
    
    return script


def set_robot_base():
    pt_0 = rg.Point3d(-282.1,-581.13,-15.4) # base plane origin
    pt_1 = rg.Point3d(-279,562.75,-16.75) # point on positive x axis
    pt_2 = rg.Point3d(-691.65,-580.75,-13.83) # point on positive xy plane
    robot_base = rg.Plane(pt_0,pt_1-pt_0,pt_2-pt_0)
    return robot_base


def rhino_to_robot_space(rhino_plane):
    plane = rhino_plane.Clone()
    robot_base_plane = set_robot_base()
    rhino_matrix = rg.Transform.PlaneToPlane(rg.Plane.WorldXY,robot_base_plane)
    plane.Transform(rhino_matrix)
    return plane


def pickup_brick(script,pick_up_plane):
    planes = []
    #change the distance if needed
    SAFE_DIST = 150
    
    safe_plane = pick_up_plane.Clone()
    safe_plane.Translate(safe_plane.ZAxis*SAFE_DIST)
    
    ## add to the path: go to the safe plane
    script += ur.move_l(safe_plane, SAFE_ROBOT_ACC, SAFE_ROBOT_VEL)
    planes.append(safe_plane)
    
    ## add to the path: go to the pick up plane
    script += ur.move_l(pick_up_plane, SAFE_ROBOT_ACC, SAFE_ROBOT_VEL)
    planes.append(pick_up_plane)
    
    ## add to the path: turn on the vacuum and wait 1 sec.
    script += ur.set_digital_out(IO,True)
    script += ur.sleep(1)

    # add to the path: go back to the safe_plane
    script += ur.move_l(safe_plane, SAFE_ROBOT_ACC, SAFE_ROBOT_VEL)
    planes.append(safe_plane)
    
    
    return script, planes


def place_brick(script, place_plane):
    
    planes = []
    
    SAFE_DIST = 100
    safe_plane = place_plane.Clone()
    safe_plane.Translate(rg.Vector3d.ZAxis*SAFE_DIST)
    
    # add to the path: go to the safe plane
    script += ur.move_l(safe_plane, SAFE_ROBOT_ACC, SAFE_ROBOT_VEL)
    planes.append(safe_plane)
    
    # add to the path: go to the place plane
    script += ur.move_l(place_plane, SAFE_ROBOT_ACC, SAFE_ROBOT_VEL)
    planes.append(place_plane)
    
    ## add to the path: turn off the vacuum and wait 1 second (hold the brick)
    script += ur.set_digital_out(IO,False)
    script += ur.sleep(1)
    
    # add to the path: go back to the safe plane
    script += ur.move_l(safe_plane, SAFE_ROBOT_ACC, SAFE_ROBOT_VEL)
    planes.append(safe_plane)
    
    return script,planes


def send(script):
    script = c.concatenate_script(script)
    c.send_script(script, ROBOT_IP)
    return script 


#location of a pick up station
pick_station = rg.Plane(rg.Point3d(-10.9, 441.9, 16.5), rg.Vector3d.XAxis, rg.Vector3d.YAxis)
pick_station.Rotate(m.radians(-50), pick_station.YAxis, pick_station.Origin)

script = ""
script = tcp(script)
vis_planes = []



# translate from rhino to robot_space and iterate through all planes
robot_planes = []

for p in brick_planes:
    r_plane = rhino_to_robot_space(p)
    robot_planes.append(r_plane)


for b_plane in robot_planes:
    
    script, p = pickup_brick(script,pick_station)
    vis_planes.extend(p) #only to visualize the planes
    
    script, p = place_brick(script,b_plane)
    vis_planes.extend(p)


if fabricate:
    send(script)
# ---------- end python_25 ----------
pln_4 = Plane(python_25.vis_planes)
