# Grasshopper definition 221110_maze and path.gh (Grasshopper 1.0.7)

curve = Curve([<curve referenced from the Rhino model> x7])
number_slider = Slider(3, range=0..10)
curve_2 = Curve([<curve referenced from the Rhino model> x8])

# ---- group: BRICK DIMENSIONS / length
panel = Panel("33")

# ---- group: BRICK DIMENSIONS / height
panel_2 = Panel("10")

# ---- group: BRICK DIMENSIONS / length
# create maze by vertical and horizontal line
panel_3 = Panel("33")

# ---- group: BRICK DIMENSIONS / height
panel_4 = Panel("10")

# ---- group: BRICK DIMENSIONS / width
panel_5 = Panel("15")

panel_6 = Panel("15")

panel_7 = Panel("15")

# ---- group: BRICK DIMENSIONS / height
# Throw - south side
panel_8 = Panel("10")

# ---- group: BRICK DIMENSIONS / width
panel_9 = Panel("15")

# ---- group: BRICK DIMENSIONS / length
panel_10 = Panel("30")

# ---- group: BRICK DIMENSIONS / height
# Throw - north side
panel_11 = Panel("10")

# ---- group: BRICK DIMENSIONS / length
panel_12 = Panel("30")

# ----
ghpython_script = GhPythonScript()  # -> out, a, b, plane
# ---------- ghpython_script: Python ----------
import Rhino.Geometry as rg
import copy


def go(script, plane):
    script += "ready! "
    vector = rg.Vector3d(0,0,200)
    
    save_plane = rg.Plane.Clone(plane)
    list_plane = []
    for i in range(5):
        rg.Plane.Translate(save_plane,vector*i)
        new_plane = copy.copy(save_plane)
        list_plane.append(new_plane)
        
    print list_plane
    return script,list_plane
    
    
a = " robot code "
b = rg.Plane.WorldXY
print b
script,plane = go(a,b)

print plane
# ---------- end ghpython_script ----------

# ---- group: BRICK DIMENSIONS / width
panel_13 = Panel("15")

# ---- group: BRICK DIMENSIONS / height
# PATH - Go through the maze
panel_14 = Panel("10")

# ---- group: BRICK DIMENSIONS / length
panel_15 = Panel("30")

# ---- group: GET CRV PLANES
crv = Curve(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)
python = GhPythonScript(crv=crv, height=panel_8, length=panel_10, width=panel_7)  # -> planes, brick_meshes; inputs crv: Curve
# ---------- python: Python ----------
"""
MasDfab 22-23
Basic example to get planes from crv
"""
import Rhino.Geometry as rg
import copy



gap = 5
params = crv.DivideByLength(length+gap,True)
planes = []

for i in params:
    
    p = crv.PointAt(i)
    t = crv.TangentAt(i)
    
    v = rg.Vector3d.CrossProduct(t, rg.Vector3d.ZAxis)
    
    pn =  rg.Plane(p,v,t)
    
    planes.append(pn)
# ---------- end python ----------
mesh = Mesh(python.brick_meshes)
pln = Plane(python.planes)

crv_2 = Curve(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)
python_2 = GhPythonScript(crv=crv_2, height=panel_11, length=panel_12, width=panel_9)  # -> planes, brick_meshes; inputs crv: Curve; same code as python
mesh_2 = Mesh(python_2.brick_meshes)
pln_2 = Plane(python_2.planes)

crv_3 = Curve(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)
python_3 = GhPythonScript(crv=crv_3, height=panel_14, length=panel_15, width=panel_13)  # -> planes, brick_meshes; inputs crv: Curve; same code as python
mesh_3 = Mesh(python_3.brick_meshes)
pln_3 = Plane(python_3.planes)

# ----
# vertical
ghpython_script_2 = GhPythonScript(length=panel, width=panel_5, height=panel_2, maze_crv=curve_2, layer_cnt=number_slider)  # -> out, flatten(planes), crvs, bricks; inputs maze_crv: Curve, layer_cnt: Int32
# ---------- ghpython_script_2: Python ----------
import Rhino.Geometry as rg
import copy


radius = 38


def get_layers(curve):
    
    crvs = []
    for i in range(layer_cnt):
        T = rg.Transform.Translation(rg.Vector3d(0,0,i*height))
        c = copy.copy(curve)
        c.Transform(T)
        crvs.append(c)
    return crvs


def get_bricks():
    for i, c in enumerate(crvs):
        brick_cnt = math.floor(c.GetLength()/(length))
        params = c.DivideByCount(brick_cnt*2,True)
        pts = []
        tngts = []
        # list comprehension
        bricks = [Brick(c.PointAt(p),c.TangentAt(p)) for p in params[i%2::2]]  #Creating objects of type Brick class
        self.bricks.append(bricks)
        


class Brick(object):
    
    """
    this is a class to make a brick
    """
    
    global length
    global width
    global height

    # this method gets calles as soon as the object of a class is initiated
    # here we define instance variables = attributes of the object
    def __init__(self, origin, vec):
        
        
        self.origin = origin 
        self.vec = vec # point's tangent vector

        
        self.pts = self.brick_pts()
        
        self.start_plane = self.get_start_plane()
        self.target_plane = self.get_target_plane()
        
        self.mesh = self.brick_mesh()
        self.neighbors= []
        self.color = []
        
        
        
    # this method will be called in the __init__ function
    # it returns a list of 8 points of the bounding box 
    def brick_pts(self):
        
        pt_0 = rg.Point3d(self.origin.X-length/2, self.origin.Y-width/2, self.origin.Z)
        pt_1 = rg.Point3d(pt_0.X + length, pt_0.Y, self.origin.Z)
        pt_2 = rg.Point3d(pt_1.X, pt_1.Y + width, self.origin.Z)
        pt_3 = rg.Point3d(pt_2.X - length, pt_2.Y, self.origin.Z)

        pt_4 = rg.Point3d(pt_0.X, pt_0.Y, pt_0.Z + height)
        pt_5 = rg.Point3d(pt_1.X, pt_1.Y, pt_1.Z + height)
        pt_6 = rg.Point3d(pt_2.X, pt_2.Y, pt_2.Z + height)
        pt_7 = rg.Point3d(pt_3.X, pt_3.Y, pt_3.Z + height)

        b_pts = [pt_0, pt_1, pt_2, pt_3, pt_4, pt_5, pt_6, pt_7]

        return b_pts
    
    # this method is called in the __init__ function
    # it returns the start_plane of the brick accodring to boolean input
    def get_start_plane(self):
        
        yvec = rg.Vector3d.CrossProduct(rg.Vector3d(0,0,1), self.vec)
        start_plane = rg.Plane(self.origin, self.vec, yvec)
            
        return start_plane
    
    # this method is called in the __init__ function
    # it returns the rotated start plabe plane according to input value 
    def get_target_plane(self):
        c = copy.copy(self.start_plane)
        c.Rotate(math.radians(bricks_angle), rg.Vector3d.ZAxis, self.origin)
        return c
    
    # this method is called in the __init__ funciton
    # it creates the mesh from 8 points, transforms its plane and returns the mesh 
    def brick_mesh(self):
        br = rg.Mesh.CreateFromBox(self.pts,1,1,1)
        P = rg.Plane(self.origin, rg.Vector3d.XAxis, rg.Vector3d.YAxis)
        T1 = rg.Transform.PlaneToPlane(P, self.start_plane)
        T2 = rg.Transform.PlaneToPlane(self.start_plane, self.target_plane)
        br.Transform(T1)
        br.Transform(T2)
        
        return br
        
        
pts = []
planes = []
crvs = []
recs = []
bricks = []

for i in range(layer_cnt):
    T = rg.Transform.Translation(rg.Vector3d(0,0,i*height))
    c = copy.copy(maze_crv)
    c.Transform(T)
    crvs.append(c)
    
    
for crv in crvs:
    pts=rg.Curve.DivideEquidistant(crv,length)
    for pt in pts:
        plane = rg.Plane(pt, rg.Vector3d(0,0,1))
        planes.append(plane)
        
for plane in planes:
    brick = rg.Box(plane, rg.Interval(-width/2,width/2), 
                           rg.Interval(-length/2,length/2), 
                           rg.Interval(-height/2,height/2))
    bricks.append(brick)
# ---------- end ghpython_script_2 ----------
# horizontal
ghpython_script_3 = GhPythonScript(length=panel_3, width=panel_6, height=panel_4, maze_crv=curve, layer_cnt=number_slider)  # -> out, flatten(planes), crvs, bricks; inputs maze_crv: Curve, layer_cnt: Int32
# ---------- ghpython_script_3: Python ----------
import Rhino.Geometry as rg
import copy


radius = 38


def get_layers(curve):
    
    crvs = []
    for i in range(layer_cnt):
        T = rg.Transform.Translation(rg.Vector3d(0,0,i*height))
        c = copy.copy(curve)
        c.Transform(T)
        crvs.append(c)
    return crvs


def get_bricks():
    for i, c in enumerate(crvs):
        brick_cnt = math.floor(c.GetLength()/(length))
        params = c.DivideByCount(brick_cnt*2,True)
        pts = []
        tngts = []
        # list comprehension
        bricks = [Brick(c.PointAt(p),c.TangentAt(p)) for p in params[i%2::2]]  #Creating objects of type Brick class
        self.bricks.append(bricks)
        


class Brick(object):
    
    """
    this is a class to make a brick
    """
    
    global length
    global width
    global height

    # this method gets calles as soon as the object of a class is initiated
    # here we define instance variables = attributes of the object
    def __init__(self, origin, vec):
        
        
        self.origin = origin 
        self.vec = vec # point's tangent vector

        
        self.pts = self.brick_pts()
        
        self.start_plane = self.get_start_plane()
        self.target_plane = self.get_target_plane()
        
        self.mesh = self.brick_mesh()
        self.neighbors= []
        self.color = []
        
        
        
    # this method will be called in the __init__ function
    # it returns a list of 8 points of the bounding box 
    def brick_pts(self):
        
        pt_0 = rg.Point3d(self.origin.X-length/2, self.origin.Y-width/2, self.origin.Z)
        pt_1 = rg.Point3d(pt_0.X + length, pt_0.Y, self.origin.Z)
        pt_2 = rg.Point3d(pt_1.X, pt_1.Y + width, self.origin.Z)
        pt_3 = rg.Point3d(pt_2.X - length, pt_2.Y, self.origin.Z)

        pt_4 = rg.Point3d(pt_0.X, pt_0.Y, pt_0.Z + height)
        pt_5 = rg.Point3d(pt_1.X, pt_1.Y, pt_1.Z + height)
        pt_6 = rg.Point3d(pt_2.X, pt_2.Y, pt_2.Z + height)
        pt_7 = rg.Point3d(pt_3.X, pt_3.Y, pt_3.Z + height)

        b_pts = [pt_0, pt_1, pt_2, pt_3, pt_4, pt_5, pt_6, pt_7]

        return b_pts
    
    # this method is called in the __init__ function
    # it returns the start_plane of the brick accodring to boolean input
    def get_start_plane(self):
        
        yvec = rg.Vector3d.CrossProduct(rg.Vector3d(0,0,1), self.vec)
        start_plane = rg.Plane(self.origin, self.vec, yvec)
            
        return start_plane
    
    # this method is called in the __init__ function
    # it returns the rotated start plabe plane according to input value 
    def get_target_plane(self):
        c = copy.copy(self.start_plane)
        c.Rotate(math.radians(bricks_angle), rg.Vector3d.ZAxis, self.origin)
        return c
    
    # this method is called in the __init__ funciton
    # it creates the mesh from 8 points, transforms its plane and returns the mesh 
    def brick_mesh(self):
        br = rg.Mesh.CreateFromBox(self.pts,1,1,1)
        P = rg.Plane(self.origin, rg.Vector3d.XAxis, rg.Vector3d.YAxis)
        T1 = rg.Transform.PlaneToPlane(P, self.start_plane)
        T2 = rg.Transform.PlaneToPlane(self.start_plane, self.target_plane)
        br.Transform(T1)
        br.Transform(T2)
        
        return br
        
        
pts = []
planes = []
crvs = []
recs = []
bricks = []

for i in range(layer_cnt):
    T = rg.Transform.Translation(rg.Vector3d(0,0,i*height))
    c = copy.copy(maze_crv)
    c.Transform(T)
    crvs.append(c)
    
    
for crv in crvs:
    pts=rg.Curve.DivideEquidistant(crv,length)
    for pt in pts:
        plane = rg.Plane(pt, rg.Vector3d(0,0,1))
        planes.append(plane)
        
for plane in planes:
    brick = rg.Box(plane, rg.Interval(-length/2,length/2), 
                           rg.Interval(-width/2,width/2), 
                           rg.Interval(-height/2,height/2))
    bricks.append(brick)
# ---------- end ghpython_script_3 ----------
panel_16 = Panel(ghpython_script.plane)
geometry = Geometry(ghpython_script.plane)
unit_z = UnitZ(Factor="9")
geometry_2 = Geometry(ghpython_script_2.bricks)
geometry_3 = Geometry(ghpython_script_3.bricks)
prot = RotatePlane(Plane=ghpython_script_3.planes, Angle=degrees("-90"))
unit_z_2 = UnitZ(Factor="9")
move = Move(Geometry=ghpython_script_2.planes, Motion=unit_z)  # -> Geometry, Transform
unit_z_3 = UnitZ(Factor="20")
unit_z_4 = UnitZ(Factor="20")
unit_z_5 = UnitZ(Factor="20")
move_2 = Move(Geometry=prot, Motion=unit_z_2)  # -> Geometry, Transform
move_3 = Move(Geometry=pln_3, Motion=unit_z_5)  # -> Geometry, Transform
move_4 = Move(Geometry=pln, Motion=unit_z_3)  # -> Geometry, Transform
move_5 = Move(Geometry=pln_2, Motion=unit_z_4)  # -> Geometry, Transform

# ---- group: FABRICATION WORKFLOW
python_4 = GhPythonScript(fabricate=Button())  # -> script, vis_planes, pick_up_plane; inputs brick_planes: list of Plane, fabricate: Boolean
# ---------- python_4: Python ----------
from imp import reload
import Rhino.Geometry as rg
import simple_ur_script as ur
reload(ur)
import simple_comm as c
reload(c)
import math as m

# change these values if needed
ROBOT_IP = "192.168.10.10"
SAFE_ROBOT_ACC = 0.4
SAFE_ROBOT_VEL = 0.3
IO = 4




def tcp(script):
    script += ur.set_tcp_by_angles(0.0, 0.0, 80.0, m.radians(0.0), m.radians(180.0),m.radians(0.0))
    
    return script


def set_robot_base():
    pt_0 = rg.Point3d(-282.1,-581.13,-15.4) # base plane origin
    pt_1 = rg.Point3d(-279,562.75,-16.75) # point on positive x axis
    pt_2 = rg.Point3d(-691.65,-580.75,-13.83) # point on positive xy plane
    robot_base = rg.Plane(pt_0,pt_1-pt_0,pt_2-pt_0)
    return robot_base


def rhino_to_robot_space(rhino_plane):
    plane = rhino_plane.Clone()
    robot_base_plane = set_robot_base()
    rhino_matrix = rg.Transform.PlaneToPlane(rg.Plane.WorldXY,robot_base_plane)
    plane.Transform(rhino_matrix)
    return plane


def pickup_brick(script,pick_up_plane):
    planes = []
    #change the distance if needed
    SAFE_DIST = 200
    
    safe_plane = pick_up_plane.Clone()
    safe_plane.Translate(safe_plane.ZAxis*SAFE_DIST)
    
    ## add to the path: go to the safe plane
    script += ur.move_l(safe_plane, SAFE_ROBOT_ACC, SAFE_ROBOT_VEL)
    planes.append(safe_plane)
    
    ## add to the path: go to the pick up plane
    script += ur.move_l(pick_up_plane, SAFE_ROBOT_ACC, SAFE_ROBOT_VEL)
    planes.append(pick_up_plane)
    
    ## add to the path: turn on the vacuum and wait 1 sec.
    script += ur.set_digital_out(IO,True)
    script += ur.sleep(1)

    # add to the path: go back to the safe_plane
    script += ur.move_l(safe_plane, SAFE_ROBOT_ACC, SAFE_ROBOT_VEL)
    planes.append(safe_plane)
    
    
    return script, planes


def place_brick(script, place_plane):
    
    planes = []
    
    SAFE_DIST = 200
    safe_plane = place_plane.Clone()
    safe_plane.Translate(rg.Vector3d.ZAxis*SAFE_DIST)
    
    # add to the path: go to the safe plane
    script += ur.move_l(safe_plane, SAFE_ROBOT_ACC, SAFE_ROBOT_VEL)
    planes.append(safe_plane)
    
    # add to the path: go to the place plane
    script += ur.move_l(place_plane, SAFE_ROBOT_ACC, SAFE_ROBOT_VEL)
    planes.append(place_plane)
    
    ## add to the path: turn off the vacuum and wait 1 second (hold the brick)
    script += ur.set_digital_out(IO,False)
    script += ur.sleep(1)
    
    # add to the path: go back to the safe plane
    script += ur.move_l(safe_plane, SAFE_ROBOT_ACC, SAFE_ROBOT_VEL)
    planes.append(safe_plane)
    
    return script,planes


def send(script):
    script = c.concatenate_script(script)
    c.send_script(script, ROBOT_IP)
    return script 


#location of a pick up station
pick_station = rg.Plane(rg.Point3d(-10.9, 441.9, 16), rg.Vector3d.XAxis, rg.Vector3d.YAxis)
pick_station.Rotate(m.radians(-50), pick_station.YAxis, pick_station.Origin)

script = ""
script = tcp(script)
vis_planes = []



# translate from rhino to robot_space and iterate through all planes
robot_planes = []

for p in brick_planes:
    r_plane = rhino_to_robot_space(p)
    robot_planes.append(r_plane)


for b_plane in robot_planes:
    
    script, p = pickup_brick(script,pick_station)
    vis_planes.extend(p) #only to visualize the planes
    
    script, p = place_brick(script,b_plane)
    vis_planes.extend(p)


if fabricate:
    send(script)
# ---------- end python_4 ----------
pln_4 = Plane(python_4.vis_planes)

# Use definition to randomly choose but failed
python_5 = GhPythonScript(
    throw_path_2=move_4.Geometry,
    throw_path_1=move_5.Geometry,
    path_planes=move_3.Geometry,
    choice=Slider(0.95, range=0..1),
    fabricate=Button())  # -> script, vis_planes, pick_up_plane; inputs throw_path_2: list of Plane, throw_path_1: list of Plane, path_planes: list of Plane, fabricate: Boolean
# ---------- python_5: Python ----------
from imp import reload
import Rhino.Geometry as rg
import simple_ur_script as ur
reload(ur)
import simple_comm as c
reload(c)
import math as m
import random

# change these values if needed
ROBOT_IP = "192.168.10.10"
SAFE_ROBOT_ACC = 0.4
SAFE_ROBOT_VEL = 0.3
IO = 4




def tcp(script):
    script += ur.set_tcp_by_angles(0.0, 0.0, 80.0, m.radians(0.0), m.radians(180.0),m.radians(0.0))
    
    return script


def set_robot_base():
    pt_0 = rg.Point3d(-282.1,-581.13,-15.4) # base plane origin
    pt_1 = rg.Point3d(-279,562.75,-16.75) # point on positive x axis
    pt_2 = rg.Point3d(-691.65,-580.75,-13.83) # point on positive xy plane
    robot_base = rg.Plane(pt_0,pt_1-pt_0,pt_2-pt_0)
    return robot_base


def rhino_to_robot_space(rhino_plane):
    plane = rhino_plane.Clone()
    robot_base_plane = set_robot_base()
    rhino_matrix = rg.Transform.PlaneToPlane(rg.Plane.WorldXY,robot_base_plane)
    plane.Transform(rhino_matrix)
    return plane


def pickup_brick(script,pick_up_plane):
    planes = []
    #change the distance if needed
    SAFE_DIST = 200
    
    safe_plane = pick_up_plane.Clone()
    safe_plane.Translate(safe_plane.ZAxis*SAFE_DIST)
    
    ## add to the path: go to the safe plane
    script += ur.move_l(safe_plane, SAFE_ROBOT_ACC, SAFE_ROBOT_VEL)
    planes.append(safe_plane)
    
    ## add to the path: go to the pick up plane
    script += ur.move_l(pick_up_plane, SAFE_ROBOT_ACC, SAFE_ROBOT_VEL)
    planes.append(pick_up_plane)
    
    ## add to the path: turn on the vacuum and wait 1 sec.
    script += ur.set_digital_out(IO,True)
    script += ur.sleep(1)

    # add to the path: go back to the safe_plane
    script += ur.move_l(safe_plane, SAFE_ROBOT_ACC, SAFE_ROBOT_VEL)
    planes.append(safe_plane)
    
    
    return script, planes


def path_brick(script, place_plane):
    
    planes = []
    
    SAFE_DIST = 200
    safe_plane = place_plane.Clone()
    safe_plane.Translate(rg.Vector3d.ZAxis*SAFE_DIST)
    
    # add to the path: go to the safe plane
    #script += ur.move_l(safe_plane, SAFE_ROBOT_ACC, SAFE_ROBOT_VEL)
    #planes.append(safe_plane)
    
    # add to the path: go to the place plane
    script += ur.move_l(place_plane, SAFE_ROBOT_ACC, SAFE_ROBOT_VEL)

    planes.append(place_plane)
    
    ## add to the path: turn off the vacuum and wait 1 second (hold the brick)
    #script += ur.set_digital_out(IO,False)
    #script += ur.sleep(1)
    
    # add to the path: go back to the safe plane
    #script += ur.move_l(safe_plane, SAFE_ROBOT_ACC, SAFE_ROBOT_VEL)
    #planes.append(safe_plane)
    
    return script,planes
    
    
def safe_height(script, place_plane):
    
    planes = []
    
    SAFE_DIST = 200
    safe_plane = place_plane.Clone()
    safe_plane.Translate(rg.Vector3d.ZAxis*SAFE_DIST)
    
    # add to the path: go to the safe plane
    script += ur.move_l(safe_plane, SAFE_ROBOT_ACC, SAFE_ROBOT_VEL)
    planes.append(safe_plane)
    
    return script,planes

def throw_brick(script, place_plane):
    
    planes = []
    
    SAFE_DIST = 200
    safe_plane = place_plane.Clone()
    safe_plane.Translate(rg.Vector3d.ZAxis*SAFE_DIST)
    
    # add to the path: go to the safe plane
    script += ur.move_l(safe_plane, SAFE_ROBOT_ACC, SAFE_ROBOT_VEL)
    planes.append(safe_plane)
    

    ## add to the path: turn off the vacuum and wait 1 second (hold the brick)
    script += ur.set_digital_out(IO,False)
    script += ur.sleep(1)
    

    return script,planes



def send(script):
    script = c.concatenate_script(script)
    c.send_script(script, ROBOT_IP)
    return script 





# translate from rhino to robot_space and iterate through all planes

"""
# Choose1: Path though the maze 
"""
def go_path(script,v_planes):
    
    robot_planes = []

    for p in path_planes:
        r_plane = rhino_to_robot_space(p)
        robot_planes.append(r_plane)
    
    # !!!You can change the pick_station to which bricks you want to pick
    script, p = pickup_brick(script,pick_station)
    v_planes.extend(p) #only to visualize the planes
    
    # !!!This go to the safe height in the beginning
    script, p = safe_height(script,robot_planes[0])
    v_planes.extend(p) #only to visualize the planes
    
    for b_plane in robot_planes:
        script, p = path_brick(script,b_plane)
        v_planes.extend(p)
        
    return script,v_planes





"""
Choose2: Path and throw 
"""
def throw_away(script,v_planes):
    throw_planes = []
    
    
    for pl in throw_path_1:
        rr_plane = rhino_to_robot_space(pl)
        throw_planes.append(rr_plane)
        
    # !!!You can change the pick_station to which bricks you want to pick
    script, p = pickup_brick(script,pick_station)
    v_planes.extend(p) #only to visualize the planes
    
    # !!!This go to the safe height in the beginning
    script, p = safe_height(script,throw_planes[0])
    v_planes.extend(p) #only to visualize the planes
    
    for b_plane in throw_planes:
        script, p = path_brick(script,b_plane)
        v_planes.extend(p)
    
        
    script, p = throw_brick(script,b_plane)
    v_planes.extend(p)
    
    return script,v_planes


"""
Choose3: Path and throw on another side
"""
def throw_another(script,v_planes):
    throw_planes_2 = []
    
    for pl in throw_path_2:
        rr_plane = rhino_to_robot_space(pl)
        throw_planes_2.append(rr_plane)
        
    # !!!You can change the pick_station to which bricks you want to pick
    script, p = pickup_brick(script,pick_station)
    v_planes.extend(p) #only to visualize the planes
    
    # !!!This go to the safe height in the beginning
    script, p = safe_height(script,throw_planes_2[0])
    v_planes.extend(p) #only to visualize the planes
    
    for b_plane in throw_planes_2:
        script, p = path_brick(script,b_plane)
        v_planes.extend(p)
    
        
    script, p = throw_brick(script,b_plane)
    v_planes.extend(p)
    
    return script,v_planes


#location of a pick up station
pick_station = rg.Plane(rg.Point3d(-10.9, 441.9, 16), rg.Vector3d.XAxis, rg.Vector3d.YAxis)
pick_station.Rotate(m.radians(-50), pick_station.YAxis, pick_station.Origin)


script = ""
script = tcp(script)
vis_planes = []



a = random.randint(0,1)

if choice < 0.8:
    script,vis_planes = go_path(script,vis_planes)
    print ("0000")

else:
    if random.random() < 0.5:
        script,vis_planes = throw_away(script,vis_planes)
        print ("1")
    else:
        script,vis_planes = throw_another(script,vis_planes)
        print ("2!!!")




if fabricate:
    send(script)
# ---------- end python_5 ----------
pln_5 = Plane(python_5.vis_planes)

# ----
panel_17 = Panel(python_5.script)
panel_18 = Panel(pln_5)

# ---- group: BRICK DIMENSIONS / length
panel_19 = Panel("33")

# ---- group: BRICK DIMENSIONS / height
panel_20 = Panel("10")

# ---- group: BRICK DIMENSIONS / width
panel_21 = Panel("15")

# ---- group: BRICK DIMENSIONS / length
panel_22 = Panel("33")

# ---- group: BRICK DIMENSIONS / height
panel_23 = Panel("10")

# ---- group: BRICK DIMENSIONS / width
panel_24 = Panel("15")

# ----
# pick from this line
# move to this line
# horizontal
number_slider_2 = Slider(2, range=0..10)
curve_3 = Curve(<curve referenced from the Rhino model>)
curve_4 = Curve(<curve referenced from the Rhino model>)
ghpython_script_4 = GhPythonScript(length=panel_19, width=panel_21, height=panel_20, maze_crv=curve_3, layer_cnt=number_slider_2)  # -> out, flatten(planes), crvs, bricks; inputs maze_crv: Curve, layer_cnt: Int32; same code as ghpython_script_3
ghpython_script_5 = GhPythonScript(length=panel_22, width=panel_24, height=panel_23, maze_crv=curve_4, layer_cnt=number_slider_2)  # -> out, flatten(planes), crvs, bricks; inputs maze_crv: Curve, layer_cnt: Int32; same code as ghpython_script_2
unit_z_6 = UnitZ(Factor="9")
geometry_4 = Geometry(ghpython_script_4.bricks)
geometry_5 = Geometry(ghpython_script_5.bricks)
prot_2 = RotatePlane(Plane=ghpython_script_4.planes, Angle=degrees("-90"))
unit_z_7 = UnitZ(Factor="9")
move_6 = Move(Geometry=prot_2, Motion=unit_z_7)  # -> Geometry, Transform
move_7 = Move(Geometry=ghpython_script_5.planes, Motion=unit_z_6)  # -> Geometry, Transform
panel_25 = Panel(move_7.Geometry)
panel_26 = Panel(move_6.Geometry)
ghpython_script_6 = GhPythonScript(pick_planes=move_7.Geometry, put_planes=move_6.Geometry)  # -> out, picks, puts; inputs pick_planes: list of Plane, put_planes: list of Plane
# ---------- ghpython_script_6: Python ----------
import Rhino.Geometry as rg
import copy
import math

picks = pick_planes[::-1]



puts = put_planes
# ---------- end ghpython_script_6 ----------
unit_z_8 = UnitZ(Factor="-2")
move_8 = Move(Geometry=ghpython_script_6.picks, Motion=unit_z_8)  # -> Geometry, Transform

# ---- group: FABRICATION WORKFLOW
python_6 = GhPythonScript(pick_from=move_8.Geometry, brick_planes=ghpython_script_6.puts, fabricate=Button())  # -> script, vis_planes, pick_up_plane; inputs pick_from: list of Plane, brick_planes: list of Plane, fabricate: Boolean
# ---------- python_6: Python ----------
from imp import reload
import Rhino.Geometry as rg
import simple_ur_script as ur
reload(ur)
import simple_comm as c
reload(c)
import math as m

# change these values if needed
ROBOT_IP = "192.168.10.10"
SAFE_ROBOT_ACC = 0.4
SAFE_ROBOT_VEL = 0.3
IO = 4




def tcp(script):
    script += ur.set_tcp_by_angles(0.0, 0.0, 80.0, m.radians(0.0), m.radians(180.0),m.radians(0.0))
    
    return script


def set_robot_base():
    pt_0 = rg.Point3d(-282.1,-581.13,-15.4) # base plane origin
    pt_1 = rg.Point3d(-279,562.75,-16.75) # point on positive x axis
    pt_2 = rg.Point3d(-691.65,-580.75,-13.83) # point on positive xy plane
    robot_base = rg.Plane(pt_0,pt_1-pt_0,pt_2-pt_0)
    return robot_base


def rhino_to_robot_space(rhino_plane):
    plane = rhino_plane.Clone()
    robot_base_plane = set_robot_base()
    rhino_matrix = rg.Transform.PlaneToPlane(rg.Plane.WorldXY,robot_base_plane)
    plane.Transform(rhino_matrix)
    return plane


def pickup_brick(script,pick_up_plane):
    planes = []
    #change the distance if needed
    SAFE_DIST = 200
    
    safe_plane = pick_up_plane.Clone()
    safe_plane.Translate(safe_plane.ZAxis*SAFE_DIST)
    
    ## add to the path: go to the safe plane
    script += ur.move_l(safe_plane, SAFE_ROBOT_ACC, SAFE_ROBOT_VEL)
    planes.append(safe_plane)
    
    ## add to the path: go to the pick up plane
    script += ur.move_l(pick_up_plane, SAFE_ROBOT_ACC, SAFE_ROBOT_VEL)
    planes.append(pick_up_plane)
    
    ## add to the path: turn on the vacuum and wait 1 sec.
    script += ur.set_digital_out(IO,True)
    script += ur.sleep(1)

    # add to the path: go back to the safe_plane
    script += ur.move_l(safe_plane, SAFE_ROBOT_ACC, SAFE_ROBOT_VEL)
    planes.append(safe_plane)
    
    
    return script, planes


def place_brick(script, place_plane):
    
    planes = []
    
    SAFE_DIST = 200
    safe_plane = place_plane.Clone()
    safe_plane.Translate(rg.Vector3d.ZAxis*SAFE_DIST)
    
    # add to the path: go to the safe plane
    script += ur.move_l(safe_plane, SAFE_ROBOT_ACC, SAFE_ROBOT_VEL)
    planes.append(safe_plane)
    
    # add to the path: go to the place plane
    script += ur.move_l(place_plane, SAFE_ROBOT_ACC, SAFE_ROBOT_VEL)
    planes.append(place_plane)
    
    ## add to the path: turn off the vacuum and wait 1 second (hold the brick)
    script += ur.set_digital_out(IO,False)
    script += ur.sleep(1)
    
    # add to the path: go back to the safe plane
    script += ur.move_l(safe_plane, SAFE_ROBOT_ACC, SAFE_ROBOT_VEL)
    planes.append(safe_plane)
    
    return script,planes


def send(script):
    script = c.concatenate_script(script)
    c.send_script(script, ROBOT_IP)
    return script 


#location of a pick up station
pick_station = rg.Plane(rg.Point3d(-10.9, 441.9, 16), rg.Vector3d.XAxis, rg.Vector3d.YAxis)
pick_station.Rotate(m.radians(-50), pick_station.YAxis, pick_station.Origin)

script = ""
script = tcp(script)
vis_planes = []



# translate from rhino to robot_space and iterate through all planes
robot_planes = []
pick_planes = []

for p in brick_planes:
    r_plane = rhino_to_robot_space(p)
    robot_planes.append(r_plane)



# Add this part to pick! 
for pls in pick_from:
    r_plane = rhino_to_robot_space(pls)
    pick_planes.append(r_plane)
# Switch from one space to another space once
for i in range(len(pick_from)):
    script, p = pickup_brick(script,pick_planes[i])
    script, p = place_brick(script,robot_planes[i])



if fabricate:
    send(script)
# ---------- end python_6 ----------
pln_6 = Plane(python_6.vis_planes)

# ----
panel_27 = Panel(python_6.script)
