# Grasshopper definition 20221108_maze and path.gh (Grasshopper 1.0.7)

curve = Curve([<curve referenced from the Rhino model> x7])
number_slider = Slider(3, range=0..10)
curve_2 = Curve([<curve referenced from the Rhino model> x8])

# ---- group: BRICK DIMENSIONS / width
panel = Panel("15")

# ---- group: BRICK DIMENSIONS / height
# PATH - Go through the maze
panel_2 = Panel("10")

# ---- group: BRICK DIMENSIONS / length
panel_3 = Panel("30")

panel_4 = Panel("33")

# ---- group: BRICK DIMENSIONS / height
panel_5 = Panel("10")

# ---- group: BRICK DIMENSIONS / length
# create maze by vertical and horizontal line
panel_6 = Panel("33")

# ---- group: BRICK DIMENSIONS / height
panel_7 = Panel("10")

# ---- group: BRICK DIMENSIONS / width
panel_8 = Panel("15")

panel_9 = Panel("15")

# ---- group: GET CRV PLANES
crv = Curve(<curve referenced from the Rhino model>)
python = GhPythonScript(crv=crv, height=panel_2, length=panel_3, width=panel)  # -> planes, brick_meshes; inputs crv: Curve
# ---------- python: Python ----------
"""
MasDfab 22-23
Basic example to get planes from crv
"""
import Rhino.Geometry as rg
import copy



gap = 5
params = crv.DivideByLength(length+gap,True)
planes = []

for i in params:
    
    p = crv.PointAt(i)
    t = crv.TangentAt(i)
    
    v = rg.Vector3d.CrossProduct(t, rg.Vector3d.ZAxis)
    
    pn =  rg.Plane(p,v,t)
    
    planes.append(pn)
# ---------- end python ----------
pln = Plane(reverse(python.planes))
mesh = Mesh(python.brick_meshes)

# ----
ghpython_script = GhPythonScript(length=panel_4, width=panel_8, height=panel_5, maze_crv=curve_2, layer_cnt=number_slider)  # -> out, flatten(planes), crvs, bricks; inputs maze_crv: Curve, layer_cnt: Int32
# ---------- ghpython_script: Python ----------
import Rhino.Geometry as rg
import copy


radius = 38


def get_layers(curve):
    
    crvs = []
    for i in range(layer_cnt):
        T = rg.Transform.Translation(rg.Vector3d(0,0,i*height))
        c = copy.copy(curve)
        c.Transform(T)
        crvs.append(c)
    return crvs


def get_bricks():
    for i, c in enumerate(crvs):
        brick_cnt = math.floor(c.GetLength()/(length))
        params = c.DivideByCount(brick_cnt*2,True)
        pts = []
        tngts = []
        # list comprehension
        bricks = [Brick(c.PointAt(p),c.TangentAt(p)) for p in params[i%2::2]]  #Creating objects of type Brick class
        self.bricks.append(bricks)
        


class Brick(object):
    
    """
    this is a class to make a brick
    """
    
    global length
    global width
    global height

    # this method gets calles as soon as the object of a class is initiated
    # here we define instance variables = attributes of the object
    def __init__(self, origin, vec):
        
        
        self.origin = origin 
        self.vec = vec # point's tangent vector

        
        self.pts = self.brick_pts()
        
        self.start_plane = self.get_start_plane()
        self.target_plane = self.get_target_plane()
        
        self.mesh = self.brick_mesh()
        self.neighbors= []
        self.color = []
        
        
        
    # this method will be called in the __init__ function
    # it returns a list of 8 points of the bounding box 
    def brick_pts(self):
        
        pt_0 = rg.Point3d(self.origin.X-length/2, self.origin.Y-width/2, self.origin.Z)
        pt_1 = rg.Point3d(pt_0.X + length, pt_0.Y, self.origin.Z)
        pt_2 = rg.Point3d(pt_1.X, pt_1.Y + width, self.origin.Z)
        pt_3 = rg.Point3d(pt_2.X - length, pt_2.Y, self.origin.Z)

        pt_4 = rg.Point3d(pt_0.X, pt_0.Y, pt_0.Z + height)
        pt_5 = rg.Point3d(pt_1.X, pt_1.Y, pt_1.Z + height)
        pt_6 = rg.Point3d(pt_2.X, pt_2.Y, pt_2.Z + height)
        pt_7 = rg.Point3d(pt_3.X, pt_3.Y, pt_3.Z + height)

        b_pts = [pt_0, pt_1, pt_2, pt_3, pt_4, pt_5, pt_6, pt_7]

        return b_pts
    
    # this method is called in the __init__ function
    # it returns the start_plane of the brick accodring to boolean input
    def get_start_plane(self):
        
        yvec = rg.Vector3d.CrossProduct(rg.Vector3d(0,0,1), self.vec)
        start_plane = rg.Plane(self.origin, self.vec, yvec)
            
        return start_plane
    
    # this method is called in the __init__ function
    # it returns the rotated start plabe plane according to input value 
    def get_target_plane(self):
        c = copy.copy(self.start_plane)
        c.Rotate(math.radians(bricks_angle), rg.Vector3d.ZAxis, self.origin)
        return c
    
    # this method is called in the __init__ funciton
    # it creates the mesh from 8 points, transforms its plane and returns the mesh 
    def brick_mesh(self):
        br = rg.Mesh.CreateFromBox(self.pts,1,1,1)
        P = rg.Plane(self.origin, rg.Vector3d.XAxis, rg.Vector3d.YAxis)
        T1 = rg.Transform.PlaneToPlane(P, self.start_plane)
        T2 = rg.Transform.PlaneToPlane(self.start_plane, self.target_plane)
        br.Transform(T1)
        br.Transform(T2)
        
        return br
        
        
pts = []
planes = []
crvs = []
recs = []
bricks = []

for i in range(layer_cnt):
    T = rg.Transform.Translation(rg.Vector3d(0,0,i*height))
    c = copy.copy(maze_crv)
    c.Transform(T)
    crvs.append(c)
    
    
for crv in crvs:
    pts=rg.Curve.DivideEquidistant(crv,length)
    for pt in pts:
        plane = rg.Plane(pt, rg.Vector3d(0,0,1))
        planes.append(plane)
        
for plane in planes:
    brick = rg.Box(plane, rg.Interval(-width/2,width/2), 
                           rg.Interval(-length/2,length/2), 
                           rg.Interval(-height/2,height/2))
    bricks.append(brick)
# ---------- end ghpython_script ----------
ghpython_script_2 = GhPythonScript(length=panel_6, width=panel_9, height=panel_7, maze_crv=curve, layer_cnt=number_slider)  # -> out, planes, crvs, bricks; inputs maze_crv: Curve, layer_cnt: Int32
# ---------- ghpython_script_2: Python ----------
import Rhino.Geometry as rg
import copy


radius = 38


def get_layers(curve):
    
    crvs = []
    for i in range(layer_cnt):
        T = rg.Transform.Translation(rg.Vector3d(0,0,i*height))
        c = copy.copy(curve)
        c.Transform(T)
        crvs.append(c)
    return crvs


def get_bricks():
    for i, c in enumerate(crvs):
        brick_cnt = math.floor(c.GetLength()/(length))
        params = c.DivideByCount(brick_cnt*2,True)
        pts = []
        tngts = []
        # list comprehension
        bricks = [Brick(c.PointAt(p),c.TangentAt(p)) for p in params[i%2::2]]  #Creating objects of type Brick class
        self.bricks.append(bricks)
        


class Brick(object):
    
    """
    this is a class to make a brick
    """
    
    global length
    global width
    global height

    # this method gets calles as soon as the object of a class is initiated
    # here we define instance variables = attributes of the object
    def __init__(self, origin, vec):
        
        
        self.origin = origin 
        self.vec = vec # point's tangent vector

        
        self.pts = self.brick_pts()
        
        self.start_plane = self.get_start_plane()
        self.target_plane = self.get_target_plane()
        
        self.mesh = self.brick_mesh()
        self.neighbors= []
        self.color = []
        
        
        
    # this method will be called in the __init__ function
    # it returns a list of 8 points of the bounding box 
    def brick_pts(self):
        
        pt_0 = rg.Point3d(self.origin.X-length/2, self.origin.Y-width/2, self.origin.Z)
        pt_1 = rg.Point3d(pt_0.X + length, pt_0.Y, self.origin.Z)
        pt_2 = rg.Point3d(pt_1.X, pt_1.Y + width, self.origin.Z)
        pt_3 = rg.Point3d(pt_2.X - length, pt_2.Y, self.origin.Z)

        pt_4 = rg.Point3d(pt_0.X, pt_0.Y, pt_0.Z + height)
        pt_5 = rg.Point3d(pt_1.X, pt_1.Y, pt_1.Z + height)
        pt_6 = rg.Point3d(pt_2.X, pt_2.Y, pt_2.Z + height)
        pt_7 = rg.Point3d(pt_3.X, pt_3.Y, pt_3.Z + height)

        b_pts = [pt_0, pt_1, pt_2, pt_3, pt_4, pt_5, pt_6, pt_7]

        return b_pts
    
    # this method is called in the __init__ function
    # it returns the start_plane of the brick accodring to boolean input
    def get_start_plane(self):
        
        yvec = rg.Vector3d.CrossProduct(rg.Vector3d(0,0,1), self.vec)
        start_plane = rg.Plane(self.origin, self.vec, yvec)
            
        return start_plane
    
    # this method is called in the __init__ function
    # it returns the rotated start plabe plane according to input value 
    def get_target_plane(self):
        c = copy.copy(self.start_plane)
        c.Rotate(math.radians(bricks_angle), rg.Vector3d.ZAxis, self.origin)
        return c
    
    # this method is called in the __init__ funciton
    # it creates the mesh from 8 points, transforms its plane and returns the mesh 
    def brick_mesh(self):
        br = rg.Mesh.CreateFromBox(self.pts,1,1,1)
        P = rg.Plane(self.origin, rg.Vector3d.XAxis, rg.Vector3d.YAxis)
        T1 = rg.Transform.PlaneToPlane(P, self.start_plane)
        T2 = rg.Transform.PlaneToPlane(self.start_plane, self.target_plane)
        br.Transform(T1)
        br.Transform(T2)
        
        return br
        
        
pts = []
planes = []
crvs = []
recs = []
bricks = []

for i in range(layer_cnt):
    T = rg.Transform.Translation(rg.Vector3d(0,0,i*height))
    c = copy.copy(maze_crv)
    c.Transform(T)
    crvs.append(c)
    
    
for crv in crvs:
    pts=rg.Curve.DivideEquidistant(crv,length)
    for pt in pts:
        plane = rg.Plane(pt, rg.Vector3d(0,0,1))
        planes.append(plane)
        
for plane in planes:
    brick = rg.Box(plane, rg.Interval(-length/2,length/2), 
                           rg.Interval(-width/2,width/2), 
                           rg.Interval(-height/2,height/2))
    bricks.append(brick)
# ---------- end ghpython_script_2 ----------
geometry = Geometry(ghpython_script.bricks)
geometry_2 = Geometry(ghpython_script_2.bricks)
geometry_3 = Geometry(ghpython_script.planes)
prot = RotatePlane(Plane=ghpython_script_2.planes, Angle=degrees("-90"))
unit_z = UnitZ(Factor="9")
unit_z_2 = UnitZ(Factor="20")
geometry_4 = Geometry(prot)
move = Move(Geometry=pln, Motion=unit_z_2)  # -> Geometry, Transform
move_2 = Move(Geometry=geometry_4, Motion=unit_z)  # -> Geometry, Transform

# ---- group: FABRICATION WORKFLOW
python_2 = GhPythonScript(brick_planes=move.Geometry, fabricate=Button())  # -> script, vis_planes, pick_up_plane; inputs brick_planes: list of Plane, fabricate: Boolean
# ---------- python_2: Python ----------
from imp import reload
import Rhino.Geometry as rg
import simple_ur_script as ur
reload(ur)
import simple_comm as c
reload(c)
import math as m

# change these values if needed
ROBOT_IP = "192.168.10.10"
SAFE_ROBOT_ACC = 0.4
SAFE_ROBOT_VEL = 0.3
IO = 4




def tcp(script):
    script += ur.set_tcp_by_angles(0.0, 0.0, 80.0, m.radians(0.0), m.radians(180.0),m.radians(0.0))
    
    return script


def set_robot_base():
    pt_0 = rg.Point3d(-282.1,-581.13,-15.4) # base plane origin
    pt_1 = rg.Point3d(-279,562.75,-16.75) # point on positive x axis
    pt_2 = rg.Point3d(-691.65,-580.75,-13.83) # point on positive xy plane
    robot_base = rg.Plane(pt_0,pt_1-pt_0,pt_2-pt_0)
    return robot_base


def rhino_to_robot_space(rhino_plane):
    plane = rhino_plane.Clone()
    robot_base_plane = set_robot_base()
    rhino_matrix = rg.Transform.PlaneToPlane(rg.Plane.WorldXY,robot_base_plane)
    plane.Transform(rhino_matrix)
    return plane


def pickup_brick(script,pick_up_plane):
    planes = []
    #change the distance if needed
    SAFE_DIST = 200
    
    safe_plane = pick_up_plane.Clone()
    safe_plane.Translate(safe_plane.ZAxis*SAFE_DIST)
    
    ## add to the path: go to the safe plane
    script += ur.move_l(safe_plane, SAFE_ROBOT_ACC, SAFE_ROBOT_VEL)
    planes.append(safe_plane)
    
    ## add to the path: go to the pick up plane
    script += ur.move_l(pick_up_plane, SAFE_ROBOT_ACC, SAFE_ROBOT_VEL)
    planes.append(pick_up_plane)
    
    ## add to the path: turn on the vacuum and wait 1 sec.
    script += ur.set_digital_out(IO,True)
    script += ur.sleep(1)

    # add to the path: go back to the safe_plane
    script += ur.move_l(safe_plane, SAFE_ROBOT_ACC, SAFE_ROBOT_VEL)
    planes.append(safe_plane)
    
    
    return script, planes


def place_brick(script, place_plane):
    
    planes = []
    
    SAFE_DIST = 200
    safe_plane = place_plane.Clone()
    safe_plane.Translate(rg.Vector3d.ZAxis*SAFE_DIST)
    
    # add to the path: go to the safe plane
    #script += ur.move_l(safe_plane, SAFE_ROBOT_ACC, SAFE_ROBOT_VEL)
    #planes.append(safe_plane)
    
    # add to the path: go to the place plane
    script += ur.move_l(place_plane, SAFE_ROBOT_ACC, SAFE_ROBOT_VEL)
    planes.append(place_plane)
    
    ## add to the path: turn off the vacuum and wait 1 second (hold the brick)
    #script += ur.set_digital_out(IO,False)
    #script += ur.sleep(1)
    
    # add to the path: go back to the safe plane
    #script += ur.move_l(safe_plane, SAFE_ROBOT_ACC, SAFE_ROBOT_VEL)
    #planes.append(safe_plane)
    
    return script,planes


def send(script):
    script = c.concatenate_script(script)
    c.send_script(script, ROBOT_IP)
    return script 


#location of a pick up station
pick_station = rg.Plane(rg.Point3d(-10.9, 441.9, 16), rg.Vector3d.XAxis, rg.Vector3d.YAxis)
pick_station.Rotate(m.radians(-50), pick_station.YAxis, pick_station.Origin)

script = ""
script = tcp(script)
vis_planes = []



# translate from rhino to robot_space and iterate through all planes
robot_planes = []

for p in brick_planes:
    r_plane = rhino_to_robot_space(p)
    robot_planes.append(r_plane)



script, p = pickup_brick(script,pick_station)
vis_planes.extend(p) #only to visualize the planes

for b_plane in robot_planes:
    
    script, p = place_brick(script,b_plane)
    vis_planes.extend(p)


if fabricate:
    send(script)
# ---------- end python_2 ----------
pln_2 = Plane(python_2.vis_planes)

python_3 = GhPythonScript(brick_planes=move_2.Geometry, fabricate=Button())  # -> script, vis_planes, pick_up_plane, outPut; inputs brick_planes: list of Plane, fabricate: Boolean
# ---------- python_3: Python ----------
from imp import reload
import Rhino.Geometry as rg
import simple_ur_script as ur
reload(ur)
import simple_comm as c
reload(c)
import math as m

# change these values if needed
ROBOT_IP = "192.168.10.10"
SAFE_ROBOT_ACC = 0.4
SAFE_ROBOT_VEL = 0.3
IO = 4
listen_to_UR = False



def tcp(script):
    script += ur.set_tcp_by_angles(0.0, 0.0, 80.0, m.radians(0.0), m.radians(180.0),m.radians(0.0))
    
    return script


def set_robot_base():
    pt_0 = rg.Point3d(-282.1,-581.13,-15.4) # base plane origin
    pt_1 = rg.Point3d(-279,562.75,-16.75) # point on positive x axis
    pt_2 = rg.Point3d(-691.65,-580.75,-13.83) # point on positive xy plane
    robot_base = rg.Plane(pt_0,pt_1-pt_0,pt_2-pt_0)
    return robot_base


def rhino_to_robot_space(rhino_plane):
    plane = rhino_plane.Clone()
    robot_base_plane = set_robot_base()
    rhino_matrix = rg.Transform.PlaneToPlane(rg.Plane.WorldXY,robot_base_plane)
    plane.Transform(rhino_matrix)
    return plane


def pickup_brick(script,pick_up_plane):
    planes = []
    #change the distance if needed
    SAFE_DIST = 200
    
    safe_plane = pick_up_plane.Clone()
    safe_plane.Translate(safe_plane.ZAxis*SAFE_DIST)
    
    ## add to the path: go to the safe plane
    script += ur.move_l(safe_plane, SAFE_ROBOT_ACC, SAFE_ROBOT_VEL)
    planes.append(safe_plane)
    
    ## add to the path: go to the pick up plane
    script += ur.move_l(pick_up_plane, SAFE_ROBOT_ACC, SAFE_ROBOT_VEL)
    planes.append(pick_up_plane)
    
    ## add to the path: turn on the vacuum and wait 1 sec.
    script += ur.set_digital_out(IO,True)
    script += ur.sleep(1)

    # add to the path: go back to the safe_plane
    script += ur.move_l(safe_plane, SAFE_ROBOT_ACC, SAFE_ROBOT_VEL)
    planes.append(safe_plane)
    
    
    return script, planes


def place_brick(script, place_plane):
    
    planes = []
    
    SAFE_DIST = 200
    safe_plane = place_plane.Clone()
    safe_plane.Translate(rg.Vector3d.ZAxis*SAFE_DIST)
    
    # add to the path: go to the safe plane
    script += ur.move_l(safe_plane, SAFE_ROBOT_ACC, SAFE_ROBOT_VEL)
    planes.append(safe_plane)
    
    # add to the path: go to the place plane
    script += ur.move_l(place_plane, SAFE_ROBOT_ACC, SAFE_ROBOT_VEL)
    planes.append(place_plane)
    
    ## add to the path: turn off the vacuum and wait 1 second (hold the brick)
    script += ur.set_digital_out(IO,False)
    script += ur.sleep(1)
    
    # add to the path: go back to the safe plane
    script += ur.move_l(safe_plane, SAFE_ROBOT_ACC, SAFE_ROBOT_VEL)
    planes.append(safe_plane)
    
    return script,planes


def send(script):
    script = c.concatenate_script(script)
    c.send_script(script, ROBOT_IP)
    return script 


#location of a pick up station
pick_station = rg.Plane(rg.Point3d(-10.9, 441.9, 16), rg.Vector3d.XAxis, rg.Vector3d.YAxis)
pick_station.Rotate(m.radians(-50), pick_station.YAxis, pick_station.Origin)

script = ""
script = tcp(script)
vis_planes = []



# translate from rhino to robot_space and iterate through all planes
robot_planes = []

for p in brick_planes:
    r_plane = rhino_to_robot_space(p)
    robot_planes.append(r_plane)


for b_plane in robot_planes:
    
    script, p = pickup_brick(script,pick_station)
    vis_planes.extend(p) #only to visualize the planes
    
    script, p = place_brick(script,b_plane)
    vis_planes.extend(p)


if fabricate:
    send(script)
    #new !!
    listen_to_UR = True
    

if listen_to_UR == True:
    outPut = c.listen_to_robot(ROBOT_IP)
# ---------- end python_3 ----------
pln_3 = Plane(python_3.vis_planes)

# ----
data = Data(move_2.Geometry)
panel_10 = Panel(move_2.Geometry)
panel_11 = Panel(python_3.outPut)
