# Grasshopper definition wing.gh (Grasshopper 1.0.7)

# ---- group: BRICK DIMENSIONS / length
panel = Panel("31.5")

# ---- group: BRICK DIMENSIONS / height
panel_2 = Panel("10")

# ---- group: BRICK DIMENSIONS / width
panel_3 = Panel("15")

# ----
number_slider = Slider(15, range=1..15)
dist_tolerance = Slider(1.13, range=0.9..2.1)
crv = Curve(<curve referenced from the Rhino model>)
curve = Curve(<curve referenced from the Rhino model>)
multiplication = Multiplication(A=panel, B=number_slider)
len = Length(Curve=crv)
python = GhPythonScript(
    crv1=curve,
    att_curve=crv,
    att_curve_param=Slider(0.45, range=0..1),
    max_distance=Slider(42, range=0..100),
    bricks_rotation=Slider(79, range=0..100),
    param_in_crv=Slider(0.407, range=0..1),
    length=panel,
    width=panel_3,
    height=panel_2,
    gap_ratio=Slider(0.13, range=0.01..0.9),
    threshold=Slider(1.4, range=0.01..10),
    reqHeight=multiplication,
    st_lb=Slider(0.1, range=0.1..0.45),
    st_hb=Slider(0.1, range=0.1..0.45),
    levels=number_slider,
    reductionVal=Slider(0.3, range=0.2..0.8),
    dist_tolerance=dist_tolerance)  # -> point, out, bricks, bricks_mesh, curves; inputs crv1: Curve, att_curve: Curve, max_distance: Int32, bricks_rotation: Int32, levels: Int32
# ---------- python: Python ----------
#pendings: add a check that makes sure that the new brick passes a distance equals previous bricks and a distance


import Rhino.Geometry as rg
import copy
from ghpythonlib.components import ColourRGB




class Brick(object):
    
    
    #global length 
    #global width
    #global height
    
    def __init__(self, origin, rotation = 0, color = [240, 255, 255, 255] ):
        
        self.origin = origin 
        self.param = None
        self.plane = None
        #self.curve = curve
        self. rotation = 0
        self.gap = gap_ratio * length
        self.level = 0
        if self.rotation != 0:
            RotateBrick() 
        
        self.neighbours = []
        self.color = ColourRGB(255, color[0], color[1], color[2])
        self.att_dist = None
        
    #makes an actual brick mesh from bounding box
    
    def BrickParam(self, param):
        self.param = param
        
    
    def CreateBrickMesh(self):
        return rg.Mesh.CreateFromBox(rg.Box(self.plane, rg.Interval(-length/2, length/2),
                                        rg.Interval(-width/2, width/2),
                                        rg.Interval(-height/2, height/2)), 1, 1, 1)
        
#    def RotateBrick(self):
#        return 0
#        
#        
#        
#        
#        
#        # RAMON IS STARTING TO DO MAGIC TRICKS
#        
#        
#        pt = brick.origin  # to make it simpler
#        t = att_curve.ClosestPoint(pt)  # parameter t is the closest point from the brick origins to the attractor curve
#        second_pt = att_curve.PointAt(t) # getting the points on the curve
#        points_distance = pt.DistanceTo(second_pt)  # Distances from the brick points to the points in the attrtactor curve
#        
#        # NOW, WE CHECK
#        
#        if points_distance <= max_distance:
#            
#        
#        
#        




class GenericWall(object):
    
    def __init__(self, curve, st_lb, st_hb, levels = 10, currentLevel = 0):
        self.curve = curve
        self.curves = []
        self.curves.append(curve)
        self.currentLevel = currentLevel
        self.levels = levels
        self.st_lb = st_lb
        self.st_hb = st_hb
        
        #self.isf = CalculateISF()
        
    def CalculateISF(self):
        trel = self.currentLevel/self.levels
        return st_lb * ( 1/self.st_lb * self.st_hb ) ** trel
    




class OuterWall(GenericWall):
    
    def __init__(self, curve, st_lb, st_hb, levels, currentLevel):
        GenericWall.__init__(self, curve, st_lb, st_hb, levels, currentLevel)
        
    def NextPointCalculation(self, pt_on_curve, brick_length, gap):
        # we make a circle whose radius is half the brick length
        circle = rg.Circle(pt_on_curve, brick_length/2)
        #get intersection point and move to new point
        circleCurve = rg.ArcCurve(circle)
        events = rg.Intersect.Intersection.CurveCurve(self.curve, circleCurve, 0.001, 0.0)
        index = events.Count
        point1 = events[index-1].PointA
        #we make a new circle with radius = gap + half brick length
        circle = rg.Circle(point1, brick_length/2 + gap)
        circleCurve = rg.ArcCurve(circle)
        events = rg.Intersect.Intersection.CurveCurve(self.curve, circleCurve, 0.001, 0.0)
        index = events.Count
        point2 = events[index-1].PointA
        return point2 
    
    def PopulateLevel(self, threshold, brick_length, level):
        
        bricks = []
        #get the start point of the curve:
        point = self.curve.PointAtStart
        tPt = self.curve.ClosestPoint(point,0.0001)[1]
        tEnd = self.curve.ClosestPoint(self.curve.PointAtEnd,0.0001)[1] 
        i = 0 
        tSegmentLength = self.curve.LengthParameter(threshold * brick_length)[1]
        while tPt < tEnd - tSegmentLength:
            point = self.NextPointCalculation(point, brick_length, gap_ratio * length)
            #populate point on curve
            tSuspect = self.curve.ClosestPoint(point,0.0001)[1]
            if tSuspect - tPt > 1.5: ###Hardcoded!!!
                tPt = tSuspect
                brick = Brick(point)
                brick.origin = self.curve.PointAt(tPt)
                brick.plane = self.curve.FrameAt(tPt)[1]
                brick.level = level
                bricks.append(brick)
                i += 1
            else: 
                break
        return bricks
        #if the level is 0, we start with the first curve 
        
    #changes the value of the indentation based on ISF 
    def ChangeNextLevelPositions(self, bricks, precision = 50):
        points = []
        #Calculatre iSF
        iSF = self.CalculateISF()
        # iterate over all bricks and move them to the right place
        tEnd = self.curve.ClosestPoint(self.curve.PointAtEnd,0.0001)[1] 
        for i in range(precision):
            if i != 0:
                t = (i * tEnd) / precision
                p = self.curve.PointAt(t)
                t1 = self.curve.TangentAt(t)
                v = rg.Vector3d.CrossProduct(t1, rg.Vector3d.ZAxis * -1)
                movementX = v * iSF * width
                movementZ = rg.Vector3d.ZAxis * height
                points.append(p + movementX + movementZ)
        new_crv = rg.Curve.CreateInterpolatedCurve(points, 3)
        self.curve = new_crv
        self.curves.append(new_crv)

        
    def PopulateWall(self, threshold, brick_length, levels):
        allBricks = []
        for level in range(levels):
            self.currentLevel = level
            bricks = self.PopulateLevel(threshold, brick_length, level)
            self.ChangeNextLevelPositions(bricks)
            allBricks.append(bricks) 
            
        return allBricks

new_wall_khara = OuterWall(crv1,st_lb, st_hb, levels, 0)
allbricks = new_wall_khara.PopulateWall(threshold, length, levels)
bricks_mesh = []
#print allbricks
curves = new_wall_khara.curves
#print curves
for brickList in allbricks:
    for brick in brickList:
        bricks_mesh.append(brick.CreateBrickMesh())
#        

point = att_curve.PointAt(att_curve_param) 
point = att_curve.PointAtEnd
t = att_curve.ClosestPoint(point)[1]
tMax = att_curve_param * t


for brickLists in allbricks:
    for brick in brickLists:
        pt = brick.origin
# ---------- end python ----------
panel_4 = Panel(len)
data = Data(python.bricks_mesh)
data_2 = Data(python.point)
crv_2 = Curve(<curve referenced from the Rhino model>)
python_2 = GhPythonScript(input_crv=crv_2, length=panel, min_gap=Slider(2, range=0..100), height=panel_2, levels=number_slider)  # -> out, pt, div_curve1, point_a, points_div, point_b, points, crvs, new_curves; inputs input_crv: Curve, levels: Int32
# ---------- python_2: Python ----------
import Rhino.Geometry as rg
import copy
from ghpythonlib.treehelpers import list_to_tree

points = []

pt = rg.Curve.PointAtNormalizedLength(input_crv, 1) 

print(pt)

input_crv_length = rg.Curve.GetLength(input_crv)

print(input_crv_length)

div_curve1, div_curve2 = rg.Curve.Split(input_crv, input_crv_length*0.8)

print(div_curve1, div_curve2)



#points_div = rg.Curve.DivideByLength(div_curve1, (length/2 + min_gap), True)



curves_values = rg.Curve.DivideByLength(div_curve1, (length/2 + min_gap), True)



print(len(curves_values))

# = 18 points (a to r)

point_a = rg.Curve.PointAt(div_curve1, curves_values[0])
point_b = rg.Curve.PointAt(div_curve1, curves_values[1])
#point_c = rg.Curve.PointAt(div_curve1, curves_values[2])
#point_d = rg.Curve.PointAt(div_curve1, curves_values[3])


for value in range (len(curves_values)):
    point = div_curve1.PointAt(value)
    points.append(point)
    



rg.Curve.Translate(div_curve1, 0.0 , 0.0 , height)

crvs = []
for i in range(levels):
    T = rg.Transform.Translation(rg.Vector3d(0,0,i*height))
    c = copy.copy(input_crv)
    c.Transform(T)
    crvs.append(c)



def remap(value,low1,high1, low2, high2):
    """
    value : original value
    low1 : original value's lower bound
    high1 : original value's upper bound
    low2 : remapped value's lower bound
    high2 : remapped value's upper bound
    """
    remapped_value = low2 + (value - low1) * (high2 - low2) / (high1 - low1)
    return remapped_value



new_curves =[]

#first deformation

for i, crv in enumerate(crvs):
    
    
    curve_growth_original = (levels - i)  #(levels - i)
    curve_growth_remapped = remap(curve_growth_original, 0,levels,1,0)
    split_curves = rg.Curve.Split(crv, input_crv_length*(0.8 + 0.2*(curve_growth_remapped)))
    new_curves.append(split_curves)
    

#second deformation

for i, crv in enumerate(crvs):
    
    
    curve_growth_original2 = (levels - i**1.9)  #(levels - i)
    curve_growth_remapped2 = remap(curve_growth_original2, 0,levels,0.1,0)
    split_curves = rg.Curve.Split(crv, input_crv_length*(0 + 0.1*(curve_growth_remapped2)))
    new_curves.append(split_curves)


new_curves = list_to_tree(new_curves)
# ---------- end python_2 ----------
pt = Point(python_2.point_a)
pt_2 = Point(python_2.point_b)
pt_3 = Point(python_2.pt)
crv_3 = Curve(python_2.div_curve1)
crv_4 = Curve(python_2.new_curves)
end = EndPoints(Curve=crv_4)  # -> Start, End
pt_4 = Point(python_2.points)
crv_5 = Curve(python_2.crvs)
panel_5 = Panel(python_2.points_div)
